# Grasshopper definition Mosquito_Twitter.gh (Grasshopper 0.9.76)
# plug-ins: Python Interpreter, Mosquito

# A Plugin Suite by Carson Smuts
panel = Panel("100")
twitter = SonicTweet(User="PaulKulig_TO", useIDs=Toggle(False), GetFollow=Toggle(True))  # -> User, Name, Location, Info, Followers, Created, TimeZone, Language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
twitter_2 = SonicTweet(Search="\"\"", GeoLat="43.6716149", GeoLon="-79.4237128", GeoRadius="1", nResults=panel)  # -> Message, fromUser, toUser, Date, Location, hasGeo, ProfilePic, Followers, ID
user = Panel(twitter.User)
users_name = Panel(twitter.Name)
users_location = Panel(twitter.Location)
followers = Panel(twitter.Followers)
user_creation_date = Panel(twitter.Created)
timezone = Panel(twitter.TimeZone)
users_self_description = Panel(twitter.Info)
user_language = Panel(twitter.Language)
user_id = Panel(twitter.UserID)
location = Panel(twitter_2.Location)
date = Panel(twitter_2.Date)
followers_2 = Panel(twitter.FollowerID)
current_user_status = Panel(twitter.StatusMsg)
date_of_status = Panel(twitter.StatusDate)
python = PythonScript(x=twitter_2.Location)  # -> a; inputs x: list
# ---------- python: Python ----------
import rhinoscriptsyntax as rs
import Rhino as rc


L = []

for loc in x:
    strlst = loc.split(',')
    try:#if len(strlst)>1:
        lat = strlst[0]
        lon = strlst[1]
        lat = float(lat)
        lon = float(lon)
        cpt = rs.AddPoint(lat,lon,0.)
    except:
        pass#cpt = rs.AddPoint(0,0,0)
    L.append(cpt)

latlst = []
lonlst = []
LP = []
for i,c in enumerate(L):
    pt = rs.coerce3dpoint(c)
    latlst.append(pt[0])
    lonlst.append(pt[1])

def normalize_list(lov,hibound,lobound):
    """normalized_val = ( (val-min)*(hibound-lobound) )/(max-min) + lobound"""
    max_ = max(lov)
    min_ = min(lov)
    L = []
    
    for i,v in enumerate(lov):
        if max_-min_ > 0.:
            norm_val = ((hibound-lobound)*(v-min_))/(max_-min_) + lobound
        else: 
            norm_val = 1/float(len(lov))
        L.append(norm_val)
    return L

norm_lat = normalize_list(latlst,100.,0.)
norm_lon = normalize_list(lonlst,100.,0.)

L = []
for lat,lon in zip(norm_lat,norm_lon):
    pt = rc.Geometry.Point3d(lat,lon,0.)
    L.append(pt)

a = L
# ---------- end python ----------
geo = Geometry(python)
tag = TextTag(Location=python, Text=twitter_2.fromUser)
has_geo = Panel(twitter_2.hasGeo)
senders_name = Panel(twitter_2.fromUser)
twitter_3 = SonicTweet(User=followers_2, useIDs=Toggle(True))  # -> User, Name, Location, Info, Followers, Created, TimeZone, Language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
recepients_name = Panel(twitter_2.toUser)
follower_names = Panel(twitter_3.User)
message = Panel(twitter_2.Message)
profile_url = Panel(twitter_2.ProfilePic)
