# Grasshopper definition Quick analysis.gh (Grasshopper 0.9.76)
# plug-ins: Python Interpreter

geo = Geometry([<brep referenced from the Rhino model> x6])  # disabled
geo_2 = Geometry([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])
geo_3 = Geometry([<brep referenced from the Rhino model> x5])  # disabled
geo_4 = Geometry([<brep referenced from the Rhino model> x5])  # disabled
geo_5 = Geometry([<brep referenced from the Rhino model> x5])  # disabled
geo_6 = Geometry([<brep referenced from the Rhino model> x4])  # disabled
geo_7 = Geometry([<brep referenced from the Rhino model> x4])  # disabled
geo_8 = Geometry([<brep referenced from the Rhino model> x6])  # disabled
geo_9 = Geometry(<brep referenced from the Rhino model>)  # disabled
geo_10 = Geometry(<brep referenced from the Rhino model>)  # disabled
geo_11 = Geometry(<brep referenced from the Rhino model>)  # disabled
geo_12 = Geometry(<brep referenced from the Rhino model>)  # disabled
capex = CapHolesEx(Brep=[geo_10, geo_9, geo_12])  # -> Brep, Caps, Solid; disabled
toggle = BooleanToggle(True)
northarrow = Ladybug_North(scale="8")  # -> northSign; plug-in component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
splitmass = Honeybee_SplitBuildingMass(bldgMasses=[geo_5, geo, geo_2, geo_3, geo_4], bldgsFlr2FloorHeights="@4.2", runIt=toggle)  # -> readMe, splitBldgMasses; plug-in component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
splitmass_2 = Honeybee_SplitBuildingMass(bldgMasses=geo_8, bldgsFlr2FloorHeights="@4.2", runIt=toggle)  # -> readMe, splitBldgMasses; disabled; plug-in component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
splitmass_3 = Honeybee_SplitBuildingMass(bldgMasses=[geo_11, capex.Brep], bldgsFlr2FloorHeights="@4.2", runIt=toggle)  # -> readMe, splitBldgMasses; disabled; plug-in component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
honeybee = Honeybee_Honeybee()  # -> Vviiiiiiiiiizzz; plug-in component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
ladybug = Ladybug_Ladybug()  # -> Vviiiiiiiiiizzz; plug-in component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
mass2zone = Honeybee_Masses2Zones(
    zoneMasses=flatten([splitmass.splitBldgMasses, geo_6, geo_7, splitmass_2.splitBldgMasses, splitmass_3.splitBldgMasses]),
    isConditioned=True,
    maxRoofAngle=30,
    createHBZones=Toggle(True))  # -> readMe, HBZones; plug-in component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
concat = Concatenate(FragmentA="2")
concat_2 = Concatenate(FragmentA="2", FragmentB="window", JoinSeparator=" ")
callfromepconstrlibrary = Honeybee_CallFromEPConstructionLibrary(keywords=concat)  # -> ThermMaterials, EPMaterials, EPWindowMaterials, EPConstructions; plug-in component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
callfromepconstrlibrary_2 = Honeybee_CallFromEPConstructionLibrary(keywords=concat_2)  # -> ThermMaterials, EPMaterials, EPWindowMaterials, EPConstructions; plug-in component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
glazingcreator = Honeybee_GlazingBasedOnRatio(HBObjects=mass2zone.HBZones, glzRatio="0.5", runIt=Toggle(True))  # -> readMe, HBObjWGLZ; plug-in component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
panel = Panel(callfromepconstrlibrary.EPConstructions)
panel_2 = Panel(callfromepconstrlibrary_2.EPConstructions)
item = ListItem(List=callfromepconstrlibrary_2.EPConstructions, Index=44, Wrap=True)
item_2 = ListItem(List=callfromepconstrlibrary.EPConstructions, Index=198, Wrap=True)
decomposebytype = Honeybee_DecomposeBasedOnType(HBZone=glazingcreator.HBObjWGLZ)  # -> walls, interiorWalls, airWalls, flatten(windows), interiorWindows, skylights, roofs, ceilings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; plug-in component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
setepzonecnstr = Honeybee_SetEPZoneConstruction(HBZone=glazingcreator.HBObjWGLZ, wallEPConstruction=item_2, windowEPConstruction=item)  # -> simplify(modifiedHBZone); plug-in component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
preview = CustomPreview(Geometry=decomposebytype.windows, Shader=ColourSwatch(SwatchColor=RGBA(84, 218, 255, 126)))
open_weather_file = Ladybug_OpenEPWWeatherFile(open=Toggle(True))  # -> epwFile; plug-in component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
toggle_2 = BooleanToggle(True)
epoutput = Honeybee_GenerateEPOutput(
    zoneEnergyUse=toggle_2,
    zoneGainsAndLosses=toggle_2,
    zoneComfortMetrics=toggle_2,
    comfortMapVariables=toggle_2,
    zoneHVACParams=toggle_2,
    surfaceTempAnalysis=toggle_2,
    surfaceEnergyAnalysis=toggle_2,
    glazingSolarAnalysis=toggle_2,
    timestep="annual")  # -> report, flatten(simulationOutputs); plug-in component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
toggle_3 = BooleanToggle(True)
northarrow_2 = Ladybug_North(north="18.75", scale="3")  # -> northSign; plug-in component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
exporttoopenstudio = Honeybee_ExportToOpenStudio(
    north="18.75",
    epwWeatherFile=open_weather_file,
    HBZones=flatten(setepzonecnstr),
    simulationOutputs=flatten(epoutput.simulationOutputs),
    writeOSM=toggle_3,
    runSimulation=toggle_3)  # -> readMe, osmFileAddress, idfFileAddress, resultsFileAddress, rddFileAddress, studyFolder; plug-in component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
readepsrfresult = Honeybee_ReadEPSurfaceResult(resultFileAddress=exporttoopenstudio.resultsFileAddress)  # -> surfaceIndoorTemp, surfaceOutdoorTemp, surfaceEnergyFlow, opaqueEnergyFlow, glazEnergyFlow, windowTotalSolarEnergy, windowBeamEnergy, windowDiffEnergy, windowTransmissivity, port; disabled; plug-in component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
readepresult = Honeybee_ReadEPResult(resultFileAddress=exporttoopenstudio.resultsFileAddress)  # -> totalThermalLoad, thermalLoadBalance, cooling, heating, electricLight, electricEquip, port, port_2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; plug-in component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
toggle_4 = BooleanToggle(True)  # disabled
colorsurfaces = Honeybee_ColorSurfacesByEPResult(srfData=readepsrfresult.surfaceIndoorTemp, HBZones=flatten(mass2zone.HBZones), runIt=toggle_4)  # -> readMe, srfColoredMesh, zoneWireFrame, legend, legendBasePt, analysisTitle, srfBreps, srfColors, srfValues, port; disabled; plug-in component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
flrnorm = Honeybee_NormalizeDataByFloorArea(simData=readepresult.cooling, HBZones=flatten(glazingcreator.HBObjWGLZ))  # -> totNormData, zoneNormData; plug-in component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
mesh = Mesh(colorsurfaces.srfColoredMesh)  # disabled
colorzones = Honeybee_ColorZonesByEPResult(
    zoneData=readepresult.totalThermalLoad,
    HBZones=flatten(glazingcreator.HBObjWGLZ),
    normalizeByFloorArea=Toggle(True),
    runIt=Toggle(True))  # -> readMe, zoneColoredMesh, zoneWireFrame, legend, legendBasePt, analysisTitle, zoneBreps, zoneColors, zoneValues, floorNormZoneData; plug-in component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
panel_3 = Panel(flrnorm.totNormData)
preview_2 = CustomPreview(Geometry=colorzones.zoneWireFrame, Shader=colorzones.zoneColors)
