# Grasshopper definition straight_skeleton_algorithm_2.gh (Grasshopper 0.9.76)
# plug-ins: Python Interpreter

mandelbrot = PythonScript(run=Toggle(False))  # -> mb, color
# ---------- mandelbrot: Python ----------
import math
import Rhino as rc

def mandelbrot(z_,c_,n_=40):
    #zn+1 = zn^2 + c
    #c = a + bi (pt on xy plane)
    #If |zn| stays bounded as n -> infinity then c belongs to the Mandelbrot set. 
    #and if n less then 100
    zbound = 1000
    zn1 = reduce(lambda a,b: a*a + c_,range(n_)) 
    if abs(zn1) > zbound:
        #print abs(zn1)
        return float("nan"),9999
    else:
        return zn1, abs(zn1)

if run:
    ptlst, rgblst = [],[]
    epsilon = 150
    realnumlin = map(lambda a: a * 0.01, range(-1*epsilon, 1*epsilon))
    complexnumlin = map(lambda a: a * 0.01, range(-1*epsilon, 1*epsilon))
    print len(realnumlin), len(complexnumlin)
    for i in xrange(len(realnumlin)):
        for j in xrange(len(complexnumlin)):
            x,y = realnumlin[i], complexnumlin[j]
            
            #complex: a + bj (j == i in python)
            c = complex(x,y)
            #print 'r:', c.real, 'i:', c.imag
            z,rgb = mandelbrot(0,c,50)
            if not math.isnan(z.real):
                pt = rc.Geometry.Vector3d(x,y,0)
                ptlst.append(pt)
                rgblst.append(math.pow(rgb,1/3.))
            #else:
            #    pt = rc.Geometry.Vector3d(x,y,0)
            #    ptlst.append(pt)
            #    rgblst.append(3)
            
    mb = ptlst
    color = rgblst
    for i in color:
        print i
# ---------- end mandelbrot ----------
list = ValueList({"dir", "file"}, selected="dir")
geo = Geometry(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)
geo_2 = Geometry(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)
geo_3 = Geometry(<curve referenced from the Rhino model>)
geo_4 = Geometry(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)
sort = SortList(Keys=mandelbrot.color)  # -> Keys, ValuesA

# ---- group: find directory
bibil = PythonScript(dir=["C:\\master\\git\\bibil\\src", "C:\Users\631\Documents\GitHub\Bibil\src"], type=list, run=Toggle(True))  # -> dir; inputs dir: list
# ---------- bibil: Python ----------
import os
import sys

ghenv.Component.Params.Output[0].Name = "null"
ghenv.Component.Params.Output[0].NickName = "null"

#sys.path.append("C:\Program Files\Rhinoceros 5.0 (64-bit)\System")

if run:
    confirm_dir = None
    for d in dir:
        try:
            if type == "file":
                file_ = open(d)
                file_.close()
            else:
                print os.listdir(d)
            confirm_dir = d
            break
        except Exception as e:
            #print str(e)
            continue
    if confirm_dir != None:
        ghenv.Component.Params.Output[0].Name = type
        ghenv.Component.Params.Output[0].NickName = type
        dir = confirm_dir
        file = confirm_dir
null = None
# ---------- end bibil ----------

# ----
geo_5 = Geometry(geo_3)
vec = VectorXYZ(XComponent=0, YComponent=0, ZComponent=Slider(6, range=0..100))  # -> Vector, Length
item = ListItem(List=sort.Keys, Index="-1", Wrap=True)
item_2 = ListItem(List=sort.Keys, Index=0, Wrap=True)
extr = Extrude(Base=geo_5, Direction=vec.Vector)

# ---- group: straight_skeleton
python_script = PythonScript(i=bibil)  # -> o
# ---------- python_script: Python ----------
import os

if i:
    o = os.path.join(str(i),"miru\\miru_straight_skeleton.py")
# ---------- end python_script ----------
file = ReadFile(File=python_script, PerLineParse=False)

# ----
capex = CapHolesEx(Brep=extr)  # -> Brep, Caps, Solid

# ---- group: tree
python_script_2 = PythonScript(i=bibil)  # -> o
# ---------- python_script_2: Python ----------
import os

if i:
    o = os.path.join(str(i),"bibil\\bibil_tree.py")
# ---------- end python_script_2 ----------
file_2 = ReadFile(File=python_script_2, PerLineParse=False)
bibil_2 = PythonScript(Code=file_2)

# ---- group: grammar
python_script_3 = PythonScript(i=bibil)  # -> o
# ---------- python_script_3: Python ----------
import os

if i:
    o = os.path.join(str(i),"bibil\\bibil_grammar.py")
# ---------- end python_script_3 ----------
file_3 = ReadFile(File=python_script_3, PerLineParse=False)
bibil_3 = PythonScript(Code=file_3)

# ---- group: shape
python_script_4 = PythonScript(i=bibil)  # -> o
# ---------- python_script_4: Python ----------
import os

if i:
    o = os.path.join(str(i),"bibil\\bibil_shape.py")
#o = os.path.join(str(i),"research\\bibil_shape_shape_3d_2d.py")
# ---------- end python_script_4 ----------
file_4 = ReadFile(File=python_script_4, PerLineParse=False)
bibil_4 = PythonScript(Code=file_4)

# ---- group: UI
python_script_5 = PythonScript(i=bibil)  # -> o
# ---------- python_script_5: Python ----------
import os

if i:
    o = os.path.join(str(i),"bibil\\bibil_UI.py")
# ---------- end python_script_5 ----------
file_5 = ReadFile(File=python_script_5, PerLineParse=False)

# ---- group: grammar_divide
python_script_6 = PythonScript(i=bibil)  # -> o
# ---------- python_script_6: Python ----------
import os

if i:
    o = os.path.join(str(i),"miru\\miru_divide.py")
# ---------- end python_script_6 ----------
file_6 = ReadFile(File=python_script_6, PerLineParse=False)

# ---- group: grammar_courtyard
python_script_7 = PythonScript(i=bibil)  # -> o
# ---------- python_script_7: Python ----------
import os

if i:
    o = os.path.join(str(i),"miru\\miru_court.py")
# ---------- end python_script_7 ----------
file_7 = ReadFile(File=python_script_7, PerLineParse=False)

# ---- group: grammar_tower
python_script_8 = PythonScript(i=bibil)  # -> o
# ---------- python_script_8: Python ----------
import os

if i:
    o = os.path.join(str(i),"miru\\miru_packing.py")
# ---------- end python_script_8 ----------
file_8 = ReadFile(File=python_script_8, PerLineParse=False)

# ---- group: stepback
python_script_9 = PythonScript(i=bibil)  # -> o
# ---------- python_script_9: Python ----------
import os

if i:
    o = os.path.join(str(i),"miru\\miru_stepback.py")
# ---------- end python_script_9 ----------
file_9 = ReadFile(File=python_script_9, PerLineParse=False)

# ---- group: grammar_height
python_script_10 = PythonScript(i=bibil)  # -> o
# ---------- python_script_10: Python ----------
import os

if i:
    o = os.path.join(str(i),"miru\\miru_height.py")
# ---------- end python_script_10 ----------
file_10 = ReadFile(File=python_script_10, PerLineParse=False)

# ---- group: grammar_analysis_pts
python_script_11 = PythonScript(i=bibil)  # -> o
# ---------- python_script_11: Python ----------
import os

if i:
    o = os.path.join(str(i),"miru\\miru_analysis.py")
# ---------- end python_script_11 ----------
file_11 = ReadFile(File=python_script_11, PerLineParse=False)

# ---- group: meta_tree
python_script_12 = PythonScript(i=bibil)  # -> o
# ---------- python_script_12: Python ----------
import os

if i:
    o = os.path.join(str(i),"miru\\miru_meta_tree.py")
# ---------- end python_script_12 ----------
file_12 = ReadFile(File=python_script_12, PerLineParse=False)

# ---- group: land_use
python_script_13 = PythonScript(i=bibil)  # -> o
# ---------- python_script_13: Python ----------
import os

if i:
    o = os.path.join(str(i),"miru\\miru_landuse.py")
# ---------- end python_script_13 ----------
file_13 = ReadFile(File=python_script_13, PerLineParse=False)

# ---- group: shape2height
python_script_14 = PythonScript(i=bibil)  # -> o
# ---------- python_script_14: Python ----------
import os

if i:
    o = os.path.join(str(i),"miru\\miru_shape2height.py")
# ---------- end python_script_14 ----------
file_14 = ReadFile(File=python_script_14, PerLineParse=False)

# ---- group: extract_slice
python_script_15 = PythonScript(i=bibil)  # -> o
# ---------- python_script_15: Python ----------
import os

if i:
    o = os.path.join(str(i),"miru\\miru_extract_slice.py")
# ---------- end python_script_15 ----------
file_15 = ReadFile(File=python_script_15, PerLineParse=False)

# ----
gradient = Gradient(
    LowerLimit=item_2,
    UpperLimit=Slider(9, range=0..100),
    Parameter=mandelbrot.color,
    stops=[0.0641: RGB(0, 255, 255), 0.0982: RGB(255, 255, 0), 0.124: RGB(255, 0, 255)])

# ---- group: pyeuclid
python_script_16 = PythonScript(i=bibil)  # -> o
# ---------- python_script_16: Python ----------
import os

if i:
    o = os.path.join(str(i),"bibil\\pyeuclid.py")
# ---------- end python_script_16 ----------
file_16 = ReadFile(File=python_script_16, PerLineParse=False)
bibil_5 = PythonScript(Code=file_16)

# ---- group: bula
python_script_17 = PythonScript(i=bibil)  # -> o
# ---------- python_script_17: Python ----------
import os

if i:
    o = os.path.join(str(i),"bula\\bula_minimal.py")
# ---------- end python_script_17 ----------
file_17 = ReadFile(File=python_script_17, PerLineParse=False)
bibil_6 = PythonScript(Code=file_17)

# ----
number_slider = Slider(30, range=0..100)
cir = Circle(Plane=mandelbrot.mb, Radius="0.004")
preview = CustomPreview(Geometry=cir, Shader=gradient)
geo_6 = Geometry(capex.Brep)
list_2 = ValueList({"divide by depth": "subdivide_depth", "divide by same depth": "subdivide_depth_same", "divide by dim": "subdivide_dim"}, selected="divide by same depth")
list_3 = ValueList({"YZ": "NS", "XZ": "EW", "XY": "Z"}, selected="XZ")

# ---- group: SETBACK
miru = PythonScript(Code=file_9, Height_stepback="22.5:6.0", Run=Toggle(False))

# ---- group: straight_skeleton
miru_2 = PythonScript(Code=file, PerimeterZoneDepth_=number_slider, Step=Slider(0, range=0..4), Run=Toggle(True))

# ---- group: PACKING
separatedata = Ladybug_SeparateData(Code=file_8, X_keep_omit="27.0,25.0", Y_keep_omit="27.0,25.0", Seperation_ref="-1", Run=Toggle(False))

# ----
honeybee = Honeybee_Honeybee()  # -> Vviiiiiiiiiizzz; plug-in component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
ladybug = Ladybug_Ladybug()  # -> Vviiiiiiiiiizzz; plug-in component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
splitmass = Honeybee_SplitBuildingMass(bldgMasses=geo_6, perimeterZoneDepth=number_slider, runIt=Toggle(False))  # -> readMe, splitBldgMasses; plug-in component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

# ---- group: EXTRACT_SLICE
miru_3 = PythonScript(Code=file_15, Run=Toggle(False))

# ---- group: DIVIDE
miru_4 = PythonScript(
    Code=file_6,
    Divide_num=Slider(2, range=0..10),
    Divide_cut=Slider(0, range=0..100),
    Divide_type=list_2,
    Divide_ratio=Slider(0.5, range=0..1),
    Axis=list_3,
    Run=Toggle(False))

# ---- group: PERIMETER
miru_5 = PythonScript(Code=file_7, Width=Slider(20, range=0..100), Cut_width=Slider(0, range=0..100), Court_ref="0", Run=Toggle(False))

# ---- group: HEIGHT
miru_6 = PythonScript(Code=file_10, Height=Slider(16.5, range=0..100), Run=Toggle(True))

# ---- group: TREE RULES
miru_7 = PythonScript(Code=file_12, Run=Toggle(False))

# ---- group: SHAPE2HEIGHT
miru_8 = PythonScript(Code=file_14, Run=Toggle(False))

# ----
pt = Point(Point(-431.1114305, 136.9235945, 0))
pt_2 = Point(Point(-563.9556526, 25.81200591, 0))
neg = Negative(Value=Slider(119, range=0..1000))
vec_2 = VectorXYZ(XComponent=neg, YComponent=0, ZComponent=0)  # -> Vector, Length
move = Move(Geometry=geo_5, Motion=vec_2.Vector)  # -> Geometry, Transform
wires = BrepWireframe(Brep=[move.Geometry, geo_5], Density=-1)
preview_2 = CustomPreview(Geometry=wires, Shader=ColourSwatch(SwatchColor=RGB(0, 0, 0)))
vec2pt = Vector2Pt(PointA=pt, PointB=pt_2, Unitize=False)  # -> Vector, Length

# ---- group: SHAPENODE
bibil_7 = PythonScript(Code=file_5, Rule_in=flatten(miru_2), Node_in=flatten(geo_6), Run=Toggle(True))  # -> Node_out, Debug

# ----
move_2 = Move(Geometry=splitmass.splitBldgMasses, Motion=vec_2.Vector)  # -> Geometry, Transform
g = PythonScript(node=bibil_7.Node_out)  # -> pt, txt; inputs node: list
# ---------- g: Python ----------
node = filter(lambda n: n!=None,node)
if node and node != []:
    pt = []
    txt = []
    for n in node:
        if n.grammar.type.has_key('idlst'):
            txt = n.grammar.type['idlst']
            pt = n.grammar.type['ptlst']
    print txt
# ---------- end g ----------
geo_7 = Geometry(bibil_7.Debug)
geo_8 = Geometry(move_2.Geometry)
dash = DashPattern(Curve=geo_5, Pattern=Slider(3, range=0..10))  # -> Dashes, Gaps
tag = TextTag3D(
    Location=g.pt,
    Text=g.txt,
    Size=Slider(5, range=0..10),
    Colour=ColourSwatch(SwatchColor=RGB(0, 255, 97)),
    Justification=5)
panel = Panel(bibil_7.Debug)
preview_3 = CustomPreview(Geometry=geo_7, Shader=ColourSwatch(SwatchColor=RGB(0, 255, 0)))
wires_2 = BrepWireframe(Brep=[geo_7, geo_8], Density=-1)  # disabled
preview_4 = CustomPreview(Geometry=wires_2, Shader=ColourSwatch(SwatchColor=RGB(0, 0, 0)))
geo_9 = Geometry([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])
geo_10 = Geometry([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])
preview_5 = CustomPreview(
    Geometry=geo_9,
    Shader={ambient=RGB(0, 0, 0), diffuse=RGB(255, 105, 180), emission=RGB(76, 32, 54), shine=0.5, specular=RGB(255, 255, 255), transparency=0})
