# Grasshopper definition trinco_tower_twist_test_11.gh (Grasshopper 0.9.76)
# plug-ins: Python Interpreter

list = ValueList({"dir", "file"}, selected="dir")

# ---- group: find directory
bibil = PythonScript(
    dir=["C:\\Users\\vasanthakumars\\Documents\\GitHub\\bibil\\src", "C:\\saeran\\master\\git\\bibil\\src"],
    type=list,
    run=Toggle(True))  # -> dir; inputs dir: list
# ---------- bibil: Python ----------
import os
import sys

ghenv.Component.Params.Output[0].Name = "null"
ghenv.Component.Params.Output[0].NickName = "null"

#sys.path.append("C:\Program Files\Rhinoceros 5.0 (64-bit)\System")

if run:
    confirm_dir = None
    for d in dir:
        try:
            if type == "file":
                file_ = open(d)
                file_.close()
            else:
                print os.listdir(d)
            confirm_dir = d
            break
        except Exception as e:
            #print str(e)
            continue
    if confirm_dir != None:
        ghenv.Component.Params.Output[0].Name = type
        ghenv.Component.Params.Output[0].NickName = type
        dir = confirm_dir
        file = confirm_dir
null = None
# ---------- end bibil ----------

# ---- group: node_bucket
python_script = PythonScript(i=bibil)  # -> o
# ---------- python_script: Python ----------
import os

if i:
    o = os.path.join(str(i),"miru\\miru_shape_bucket.py")
# ---------- end python_script ----------
file = ReadFile(File=python_script, PerLineParse=False)

# ---- group: tree
python_script_2 = PythonScript(i=bibil)  # -> o
# ---------- python_script_2: Python ----------
import os

if i:
    o = os.path.join(str(i),"bibil\\bibil_tree.py")
# ---------- end python_script_2 ----------
file_2 = ReadFile(File=python_script_2, PerLineParse=False)
bibil_2 = PythonScript(Code=file_2)

# ---- group: grammar
python_script_3 = PythonScript(i=bibil)  # -> o
# ---------- python_script_3: Python ----------
import os

if i:
    o = os.path.join(str(i),"bibil\\bibil_grammar.py")
# ---------- end python_script_3 ----------
file_3 = ReadFile(File=python_script_3, PerLineParse=False)
bibil_3 = PythonScript(Code=file_3)

# ---- group: shape
python_script_4 = PythonScript(i=bibil)  # -> o
# ---------- python_script_4: Python ----------
import os

if i:
    o = os.path.join(str(i),"bibil\\bibil_shape.py")
#o = os.path.join(str(i),"research\\bibil_shape_shape_3d_2d.py")
# ---------- end python_script_4 ----------
file_4 = ReadFile(File=python_script_4, PerLineParse=False)
bibil_4 = PythonScript(Code=file_4)

# ---- group: bula
python_script_5 = PythonScript(i=bibil)  # -> o
# ---------- python_script_5: Python ----------
import os

if i:
    o = os.path.join(str(i),"bula\\bula_minimal.py")
# ---------- end python_script_5 ----------
file_5 = ReadFile(File=python_script_5, PerLineParse=False)
bibil_5 = PythonScript(Code=file_5)

# ---- group: UI
python_script_6 = PythonScript(i=bibil)  # -> o
# ---------- python_script_6: Python ----------
import os

if i:
    o = os.path.join(str(i),"bibil\\bibil_UI.py")
# ---------- end python_script_6 ----------
file_6 = ReadFile(File=python_script_6, PerLineParse=False)

# ---- group: grammar_divide
python_script_7 = PythonScript(i=bibil)  # -> o
# ---------- python_script_7: Python ----------
import os

if i:
    o = os.path.join(str(i),"miru\\miru_divide.py")
# ---------- end python_script_7 ----------
file_7 = ReadFile(File=python_script_7, PerLineParse=False)

# ---- group: grammar_courtyard
python_script_8 = PythonScript(i=bibil)  # -> o
# ---------- python_script_8: Python ----------
import os

if i:
    o = os.path.join(str(i),"miru\\miru_court.py")
# ---------- end python_script_8 ----------
file_8 = ReadFile(File=python_script_8, PerLineParse=False)

# ---- group: grammar_tower
python_script_9 = PythonScript(i=bibil)  # -> o
# ---------- python_script_9: Python ----------
import os

if i:
    o = os.path.join(str(i),"miru\\miru_packing.py")
# ---------- end python_script_9 ----------
file_9 = ReadFile(File=python_script_9, PerLineParse=False)

# ---- group: stepback
python_script_10 = PythonScript(i=bibil)  # -> o
# ---------- python_script_10: Python ----------
import os

if i:
    o = os.path.join(str(i),"miru\\miru_stepback.py")
# ---------- end python_script_10 ----------
file_10 = ReadFile(File=python_script_10, PerLineParse=False)

# ---- group: grammar_height
python_script_11 = PythonScript(i=bibil)  # -> o
# ---------- python_script_11: Python ----------
import os

if i:
    o = os.path.join(str(i),"miru\\miru_height.py")
# ---------- end python_script_11 ----------
file_11 = ReadFile(File=python_script_11, PerLineParse=False)

# ---- group: grammar_analysis_pts
python_script_12 = PythonScript(i=bibil)  # -> o
# ---------- python_script_12: Python ----------
import os

if i:
    o = os.path.join(str(i),"miru\\miru_analysis.py")
# ---------- end python_script_12 ----------
file_12 = ReadFile(File=python_script_12, PerLineParse=False)

# ---- group: meta_tree
python_script_13 = PythonScript(i=bibil)  # -> o
# ---------- python_script_13: Python ----------
import os

if i:
    o = os.path.join(str(i),"miru\\miru_meta_tree.py")
# ---------- end python_script_13 ----------
file_13 = ReadFile(File=python_script_13, PerLineParse=False)

# ---- group: land_use
python_script_14 = PythonScript(i=bibil)  # -> o
# ---------- python_script_14: Python ----------
import os

if i:
    o = os.path.join(str(i),"miru\\miru_landuse.py")
# ---------- end python_script_14 ----------
file_14 = ReadFile(File=python_script_14, PerLineParse=False)

# ---- group: shape2height
python_script_15 = PythonScript(i=bibil)  # -> o
# ---------- python_script_15: Python ----------
import os

if i:
    o = os.path.join(str(i),"miru\\miru_shape2height.py")
# ---------- end python_script_15 ----------
file_15 = ReadFile(File=python_script_15, PerLineParse=False)

# ---- group: extract_slice
python_script_16 = PythonScript(i=bibil)  # -> o
# ---------- python_script_16: Python ----------
import os

if i:
    o = os.path.join(str(i),"miru\\miru_extract_slice.py")
# ---------- end python_script_16 ----------
file_16 = ReadFile(File=python_script_16, PerLineParse=False)

# ----
list_2 = ValueList({"divide by depth": "subdivide_depth", "divide by same depth": "subdivide_depth_same", "divide by dim": "subdivide_dim"}, selected="divide by same depth")
list_3 = ValueList({"YZ": "NS", "XZ": "EW", "XY": "Z"}, selected="XZ")

# ---- group: ENERGY_MODEL_BUCKET
miru = PythonScript(Code=file, Run=Toggle(True))

# ---- group: SETBACK
miru_2 = PythonScript(Code=file_10, Height_stepback="22.5:6.0", Run=Toggle(False))

# ---- group: PACKING
separatedata = Ladybug_SeparateData(Code=file_9, X_keep_omit="27.0,25.0", Y_keep_omit="27.0,25.0", Seperation_ref="-1", Run=Toggle(True))

# ---- group: EXTRACT_SLICE
miru_3 = PythonScript(Code=file_16, Run=Toggle(False))

# ---- group: DIVIDE
miru_4 = PythonScript(
    Code=file_7,
    Divide_num=Slider(2, range=0..10),
    Divide_cut=Slider(0, range=0..100),
    Divide_type=list_2,
    Divide_ratio=Slider(0.5, range=0..1),
    Axis=list_3,
    Run=Toggle(False))

# ---- group: PERIMETER
miru_5 = PythonScript(Code=file_8, Width=Slider(20, range=0..100), Cut_width=Slider(0, range=0..100), Court_ref="0", Run=Toggle(False))

# ---- group: HEIGHT
miru_6 = PythonScript(Code=file_11, Height=Slider(16.5, range=0..100), Run=Toggle(True))

# ---- group: TREE RULES
miru_7 = PythonScript(Code=file_13, Run=Toggle(False))

# ---- group: SHAPE2HEIGHT
miru_8 = PythonScript(Code=file_15, Run=Toggle(False))

# ----
# SET SITE
# CONSTRAINTS
ladybug = Ladybug_Ladybug()  # -> Vviiiiiiiiiizzz; plug-in component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

# ----
# ZONING BOUNDARIES
toggle = BooleanToggle(True)
geo = Geometry([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])
geo_2 = Geometry([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])

# ---- group: d10
geo_3 = Geometry([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])

# ---- group: d04
geo_4 = Geometry([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])

# ---- group: cutting obj
geo_5 = Geometry([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])

# ---- group: d08
geo_6 = Geometry([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])

# ---- group: d06
geo_7 = Geometry([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])

# ---- group: d02
geo_8 = Geometry([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])

# ----
# SOFT SITES
panel = Panel("d08")
bibil_6 = PythonScript(Code=file_6, Node_in=flatten(geo_3), Label_="d10", Run=Toggle(False))  # -> Node_out, Debug
bibil_7 = PythonScript(Code=file_6, Node_in=flatten(geo_6), Label_=panel, Run=Toggle(False))  # -> Node_out, Debug
bibil_8 = PythonScript(Code=file_6, Node_in=flatten(geo_7), Label_="d06", Run=Toggle(True))  # -> Node_out, Debug
bibil_9 = PythonScript(Code=file_6, Node_in=flatten(geo_4), Label_="d04", Run=Toggle(True))  # -> Node_out, Debug
bibil_10 = PythonScript(Code=file_6, Node_in=flatten(geo_8), Label_="d02", Run=Toggle(False))  # -> Node_out, Debug

# ----
# AVENUES
number_slider = Slider(25, range=0..100)
geo_9 = Geometry([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])

# ----
# STREETS
number_slider_2 = Slider(33, range=0..100)
geo_10 = Geometry(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)

# ---- group: META-RES
bibil_11 = PythonScript(Code=file_6, Node_in=flatten(geo), Label_="ResRoot", Run=toggle)  # -> Node_out, Debug

# ---- group: META-COM
bibil_12 = PythonScript(Code=file_6, Node_in=flatten(geo_2), Label_="ComRoot", Run=Toggle(True))  # -> Node_out, Debug

# ----
# REF CRVS
geo_11 = Geometry([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])

# ---- group: DENSITY_UNIFORMITY
number_slider_3 = Slider(0, range=0..4)

# ---- group: PODIUM HT
number_slider_4 = Slider(0, range=0..4)

# ---- group: SET/STEPBACK
number_slider_5 = Slider(0, range=0..4)

# ----
# SET MASSING
# PARAMETERS
toggle_2 = BooleanToggle(True)
data = Data([bibil_11.Node_out, bibil_12.Node_out])
fly = Ladybug_fly(inputSliders=[number_slider_3, number_slider_5, number_slider_4], fly=Toggle(False))  # -> Vviiiiiiiiiizzz; plug-in component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
python = PythonScript(init_zones=data, init_nodes=[bibil_9.Node_out, bibil_8.Node_out], run=Toggle(True))  # -> res_node, com_node; inputs init_zones: list, init_nodes: list
# ---------- python: Python ----------
import random
import scriptcontext as sc
import Rhino as rc
import rhinoscriptsyntax as rs

Bula = sc.sticky['Bula']
Grammar = sc.sticky['Grammar']
sc.sticky['GLOBAL_COLLISION_LIST'] = []

def normalize_all_heights(raw_nodes):
    D={}
    max = raw_nodes[0].shape.ht
    min = raw_nodes[0].shape.ht
    htlst = []
    for i in xrange(len(raw_nodes)):
        ht = raw_nodes[i].shape.ht
        if ht>max:
            max = ht
        if ht<min:
            min = ht
        htlst.append(ht)
    #max and min heights
    normlst = B.normalize_list(htlst,191.5,4.5)
    map(lambda nh: nh[0].shape.op_extrude(nh[1]),zip(raw_nodes,normlst))
    return raw_nodes
def set_parcel_by_zone(parcel_,zone_):
    L = []
    cpt = parcel_.shape.cpt
    for j in xrange(len(zone_)):
        zonecrv = zone_[j]
        #debug.append(zonecrv)
        IsIn = rs.PointInPlanarClosedCurve(cpt,zonecrv)
        if IsIn>0.5:
            IsDefined = True
            #debug.append(parcel)
            L.append(parcel)
            break
    return L

if run:
    B = Bula()
    G = Grammar()
    # Normalize all heights
    norm_nodes = normalize_all_heights(init_nodes)
    
    # Sort the parcels by res/com boundaries
    # There needs to be a better spatial partiioning algorithm to do this part
    # Time complexity = O(2m) + O(4n)
    
    res_zones = []
    res_parcels,com_parcels = [],[]
    
    for i in xrange(len(init_zones)):
        zone = init_zones[i]
        if 'res' in zone.grammar.type['label'].lower():
            res_zones.append(zone.shape.bottom_crv)
            
    for i in xrange(len(norm_nodes)):
        norm = norm_nodes[i]
        IsInRes = set_parcel_by_zone(norm,res_zones)
        if IsInRes:
            res_parcels.append(norm)
        else:
            com_parcels.append(norm)
    
    zone_lst = [res_parcels, com_parcels]
    
    # Bucket according to density label
    bucket_dict = {"apply2list":True, "keys2bucket":["label"],\
                    "fx2bucket":"lambda n:n.grammar.type['label']"}
    for i in xrange(len(zone_lst)):
        nodesbytype = zone_lst[i]
        bucketed_lst = G.bucket_shape(nodesbytype,bucket_dict)
        nestedbylabel = bucketed_lst[0]
        nestedbylabel.sort(key=lambda tple:tple[0])
        zone_lst[i] = map(lambda l:l[1],nestedbylabel)
    
    res_node = zone_lst[0]
    com_node = zone_lst[1]
# ---------- end python ----------

# ---- group: GLOBAL COLLISION
python_2 = PythonScript(reset=toggle_2)  # -> o
# ---------- python_2: Python ----------
import scriptcontext as sc

if reset: sc.sticky['GLOBAL_COLLISION_LIST'] = []

o = sc.sticky['GLOBAL_COLLISION_LIST']
print o
# ---------- end python_2 ----------

# ----
panel_2 = Panel(python_2)
g = PythonScript(node=python.res_node)  # -> flatgeom; inputs node: list
# ---------- g: Python ----------
node = reduce(lambda x,y: x+y,node)
node = filter(lambda n: n!=None,node)
if node and node != []:
    geom = []
    for n in node:
        geom.append(n.shape.geom)
flatgeom=geom
# ---------- end g ----------
g_2 = PythonScript(node=python.com_node)  # -> flatgeom; inputs node: list
# ---------- g_2: Python ----------
node = reduce(lambda x,y: x+y,node)
node = filter(lambda n: n!=None,node)
if node and node != []:
    geom = []
    for n in node:
        geom.append(n.shape.geom)

flatgeom=geom
# ---------- end g_2 ----------

# ---- group: RES
python_3 = PythonScript(x=python.res_node, y=number_slider_3)  # -> hi, lo
# ---------- python_3: Python ----------
    #set_density(com)
    def set_density(parcel):
        #This should be part of the mapping function in Bula
        lo,hi = [],[]
        MIN_HI_DIST = 45.0
        MIN_MID_DIST = 24.0
        for i,p in enumerate(parcel):
            x_dist = p.shape.x_dist
            y_dist = p.shape.y_dist
            demand_ = p.shape.ht
            #print i,': ', round(demand_,2)
            # HIRISE
            if demand_ > 31.5 and x_dist > MIN_HI_DIST and y_dist > MIN_HI_DIST:
                hi.append(p)
            # MIDRISE
            elif demand_ > 7.5 and x_dist > MIN_MID_DIST and y_dist > MIN_MID_DIST:
                if demand_ > 22.5:
                    mid2.append(p)
                else:
                    mid1.append(p)
            # LOWRISE
            else:
                #lowrise
                lo.append(p)
        #print '---'
        return hi,mid2,mid1,lo
# ---------- end python_3 ----------

# ---- group: COM
python_4 = PythonScript(x=python.com_node, y=number_slider_3)  # -> hi, lo; same code as python_3

# ----
panel_3 = Panel("27.0,20.0")
panel_4 = Panel("13.5:3.0")

panel_5 = Panel("""13.5:3.0
19.5:6.0""")
panel_6 = Panel("0.0>0.0:-3.0>3.0")
panel_7 = Panel("""7.5:9.0
13.5:15.0""")
miru_9 = PythonScript(
    Code=file_10,
    Height_stepback=panel_7,
    Stepback_ref=geo_10,
    Stepback_tol=number_slider_2,
    From_rear=Toggle(True),
    Run=Toggle(False))

# ----
# MID COMMERCIAL
# PODIUM
toggle_3 = BooleanToggle(True)
# SET DESIGN
# GRAMMARS
# HIGH RESIDENTIAL
# PODIUM
toggle_4 = BooleanToggle(True)

# ---- group: SETBACK
miru_10 = PythonScript(Code=file_10, Height_stepback="22.5:6.0", Stepback_ref="0", Stepback_tol=number_slider_2, Run=Toggle(True))

miru_11 = PythonScript(Code=file_10, Height_stepback="22.5:6.0", Stepback_ref=geo_9, Stepback_tol=number_slider, Run=Toggle(False))

miru_12 = PythonScript(Code=file_10, Height_stepback="13.5:3.0", Stepback_ref=geo_10, Stepback_tol=number_slider_2, Run=Toggle(True))

miru_13 = PythonScript(Code=file_10, Height_stepback=panel_5, Stepback_ref=geo_10, Stepback_tol=number_slider_2, Run=Toggle(True))

miru_14 = PythonScript(Code=file_10, Height_stepback="19.5:3.0", Stepback_ref=geo_9, Stepback_tol=number_slider, Run=Toggle(True))

# ---- group: PERIMETER
miru_15 = PythonScript(Code=file_8, Width=Slider(34, range=0..100), Cut_width=Slider(0, range=0..100), Court_ref="0", Run=Toggle(True))

# ---- group: HEIGHT
miru_16 = PythonScript(Code=file_11, Height=Slider(28.5, range=0..100), Run=Toggle(True))

miru_17 = PythonScript(Code=file_11, Height=Slider(28.5, range=0..100), Randomize="-6.0>6.0", Run=Toggle(True))

# ---- group: TREE RULES
miru_18 = PythonScript(Code=file_13, Node=bibil_11.Node_out, Run=toggle_4)

miru_19 = PythonScript(Code=file_13, Node=bibil_12.Node_out, Run=toggle_3)

# ----
geo_12 = Geometry([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])
geo_13 = Geometry([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])
geo_14 = Geometry([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])
geo_15 = Geometry([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])

# ---- group: SHAPENODE
bibil_13 = PythonScript(
    Code=file_6,
    Rule_in=flatten([miru_18, miru_15, miru_16, miru_12, miru_10, miru_11]),
    Node_in=flatten(geo_12),
    Label_="HiRes",
    Run=Toggle(True))  # -> Node_out, Debug

bibil_14 = PythonScript(
    Code=file_6,
    Rule_in=flatten([miru_19, miru_17, miru_13, miru_9, miru_14]),
    Node_in=flatten(geo_14),
    Label_="MidComm",
    Run=Toggle(True))  # -> Node_out, Debug

# ----
g_3 = PythonScript(node=bibil_13.Node_out)  # -> geom; inputs node: list
# ---------- g_3: Python ----------
node = filter(lambda n: n!=None,node)
if node and node != []:
    geom = []
    for n in node:
        if n.shape.z_dist < 1.2:
            geom.append(n.shape.bottom_crv)
        else:
            geom.append(n.shape.geom)
    print geom
# ---------- end g_3 ----------
g_4 = PythonScript(node=bibil_14.Node_out)  # -> geom; inputs node: list; same code as g_3
geo_16 = Geometry(bibil_14.Debug)
# TOWERS
toggle_5 = BooleanToggle(True)

# ---- group: PACKING
separatedata_2 = Ladybug_SeparateData(Code=file_9, X_keep_omit="27.0,20.0", Y_keep_omit="27.0,20.0", Seperation_ref="-1", Run=Toggle(True))

# ---- group: EXTRACT_SLICE
miru_20 = PythonScript(Code=file_16, Run=toggle_5)

# ---- group: HEIGHT
miru_21 = PythonScript(Code=file_11, Height_ref="HiRes", Run=Toggle(True))

# ---- group: SHAPENODE
bibil_15 = PythonScript(Code=file_6, Rule_in=flatten([miru_20, separatedata_2, miru_21]), Node_in=flatten(bibil_13.Node_out), Run=Toggle(True))  # -> Node_out, Debug

# ----
g_5 = PythonScript(node=bibil_15.Node_out)  # -> geom; inputs node: list
# ---------- g_5: Python ----------
node = filter(lambda n: n!=None,node)
if node and node != []:
    geom = []
    for n in node:
        #print n.shape.z_dist
        if n.shape.z_dist > 9.:
            geom.append(n.shape.geom)
    print geom
# ---------- end g_5 ----------
geo_17 = Geometry(bibil_15.Debug)
geo_18 = Geometry([g_3, g_5, g_4])
material = CreateMaterial(
    Diffuse=ColourSwatch(SwatchColor=RGB(129, 255, 255)),
    Specular=RGB(255, 255, 255),
    Emission=RGB(0, 0, 0),
    Transparency=Slider(0, range=0..1),
    Shine=0)
mesh = Mesh(geo_18)
preview = CustomPreview(Geometry=mesh, Shader=material)
