# Grasshopper definition trinco_tower_twist_test_3.gh (Grasshopper 0.9.76)
# plug-ins: Python Interpreter

list = ValueList({"dir", "file"}, selected="dir")

# ---- group: find directory
bibil = PythonScript(
    dir=["C:\\Users\\vasanthakumars\\Documents\\GitHub\\bibil\\src", "C:\\saeran\\master\\git\\bibil\\src"],
    type=list,
    run=Toggle(True))  # -> dir; inputs dir: list
# ---------- bibil: Python ----------
import os

ghenv.Component.Params.Output[0].Name = "null"
ghenv.Component.Params.Output[0].NickName = "null"

if run:
    confirm_dir = None
    for d in dir:
        try:
            if type == "file":
                file_ = open(d)
                file_.close()
            else:
                print os.listdir(d)
            confirm_dir = d
            break
        except Exception as e:
            #print str(e)
            continue
    if confirm_dir != None:
        ghenv.Component.Params.Output[0].Name = type
        ghenv.Component.Params.Output[0].NickName = type
        dir = confirm_dir
        file = confirm_dir
null = None
# ---------- end bibil ----------

# ---- group: tree
python_script = PythonScript(i=bibil)  # -> o
# ---------- python_script: Python ----------
import os

if i:
    o = os.path.join(str(i),"bibil\\bibil_tree.py")
# ---------- end python_script ----------
file = ReadFile(File=python_script, PerLineParse=False)
bibil_2 = PythonScript(Code=file)

# ---- group: grammar
python_script_2 = PythonScript(i=bibil)  # -> o
# ---------- python_script_2: Python ----------
import os

if i:
    o = os.path.join(str(i),"bibil\\bibil_grammar.py")
# ---------- end python_script_2 ----------
file_2 = ReadFile(File=python_script_2, PerLineParse=False)
bibil_3 = PythonScript(Code=file_2)

# ---- group: shape
python_script_3 = PythonScript(i=bibil)  # -> o
# ---------- python_script_3: Python ----------
import os

if i:
    o = os.path.join(str(i),"bibil\\bibil_shape.py")
#o = os.path.join(str(i),"research\\bibil_shape_shape_3d_2d.py")
# ---------- end python_script_3 ----------
file_3 = ReadFile(File=python_script_3, PerLineParse=False)
bibil_4 = PythonScript(Code=file_3)

# ---- group: miru
python_script_4 = PythonScript(i=bibil)  # -> o
# ---------- python_script_4: Python ----------
import os

if i:
    o = os.path.join(str(i),"miru\\miru_miru.py")
# ---------- end python_script_4 ----------
file_4 = ReadFile(File=python_script_4, PerLineParse=False)
bibil_5 = PythonScript(Code=file_4)

# ---- group: bula
python_script_5 = PythonScript(i=bibil)  # -> o
# ---------- python_script_5: Python ----------
import os

if i:
    o = os.path.join(str(i),"bula\\bula_minimal.py")
# ---------- end python_script_5 ----------
file_5 = ReadFile(File=python_script_5, PerLineParse=False)
bibil_6 = PythonScript(Code=file_5)

# ---- group: UI
python_script_6 = PythonScript(i=bibil)  # -> o
# ---------- python_script_6: Python ----------
import os

if i:
    o = os.path.join(str(i),"bibil\\bibil_UI.py")
# ---------- end python_script_6 ----------
file_6 = ReadFile(File=python_script_6, PerLineParse=False)

# ---- group: grammar_divide
python_script_7 = PythonScript(i=bibil)  # -> o
# ---------- python_script_7: Python ----------
import os

if i:
    o = os.path.join(str(i),"miru\\miru_divide.py")
# ---------- end python_script_7 ----------
file_7 = ReadFile(File=python_script_7, PerLineParse=False)

# ---- group: grammar_courtyard
python_script_8 = PythonScript(i=bibil)  # -> o
# ---------- python_script_8: Python ----------
import os

if i:
    o = os.path.join(str(i),"miru\\miru_court.py")
# ---------- end python_script_8 ----------
file_8 = ReadFile(File=python_script_8, PerLineParse=False)

# ---- group: grammar_tower
python_script_9 = PythonScript(i=bibil)  # -> o
# ---------- python_script_9: Python ----------
import os

if i:
    o = os.path.join(str(i),"miru\\miru_packing.py")
# ---------- end python_script_9 ----------
file_9 = ReadFile(File=python_script_9, PerLineParse=False)

python_script_10 = PythonScript(i=bibil)  # -> o
# ---------- python_script_10: Python ----------
import os

if i:
    o = os.path.join(str(i),"miru\\miru_stepback.py")
# ---------- end python_script_10 ----------
file_10 = ReadFile(File=python_script_10, PerLineParse=False)

# ---- group: grammar_height
python_script_11 = PythonScript(i=bibil)  # -> o
# ---------- python_script_11: Python ----------
import os

if i:
    o = os.path.join(str(i),"miru\\miru_height.py")
# ---------- end python_script_11 ----------
file_11 = ReadFile(File=python_script_11, PerLineParse=False)

# ---- group: grammar_analysis_pts
python_script_12 = PythonScript(i=bibil)  # -> o
# ---------- python_script_12: Python ----------
import os

if i:
    o = os.path.join(str(i),"miru\\miru_analysis.py")
# ---------- end python_script_12 ----------
file_12 = ReadFile(File=python_script_12, PerLineParse=False)

# ---- group: meta_tree
python_script_13 = PythonScript(i=bibil)  # -> o
# ---------- python_script_13: Python ----------
import os

if i:
    o = os.path.join(str(i),"miru\\miru_meta_tree.py")
# ---------- end python_script_13 ----------
file_13 = ReadFile(File=python_script_13, PerLineParse=False)

# ---- group: land_use
python_script_14 = PythonScript(i=bibil)  # -> o
# ---------- python_script_14: Python ----------
import os

if i:
    o = os.path.join(str(i),"miru\\miru_landuse.py")
# ---------- end python_script_14 ----------
file_14 = ReadFile(File=python_script_14, PerLineParse=False)

# ---- group: shape2height
python_script_15 = PythonScript(i=bibil)  # -> o
# ---------- python_script_15: Python ----------
import os

if i:
    o = os.path.join(str(i),"miru\\miru_shape2height.py")
# ---------- end python_script_15 ----------
file_15 = ReadFile(File=python_script_15, PerLineParse=False)

# ---- group: extract_slice
python_script_16 = PythonScript(i=bibil)  # -> o
# ---------- python_script_16: Python ----------
import os

if i:
    o = os.path.join(str(i),"miru\\miru_extract_slice.py")
# ---------- end python_script_16 ----------
file_16 = ReadFile(File=python_script_16, PerLineParse=False)

python_script_17 = PythonScript(i=bibil)  # -> o
# ---------- python_script_17: Python ----------
import os

if i:
    o = os.path.join(str(i),"miru\\miru_shape_bucket.py")
# ---------- end python_script_17 ----------
file_17 = ReadFile(File=python_script_17, PerLineParse=False)

# ---- group: GEOREF
# Note: Change this number with caution,
vec = Vector(Vector(-545901.6391, 3981870.516, 0))  # disabled

# ---- group: CPT
# Increase bounds iterratively.
vec_2 = Vector(Vector(0, 3981920.861, 0))

# ----
list_2 = ValueList({"divide by depth": "subdivide_depth", "divide by same depth": "subdivide_depth_same", "divide by dim": "subdivide_dim"}, selected="divide by same depth")
list_3 = ValueList({"YZ": "NS", "XZ": "EW", "XY": "Z"}, selected="XZ")

# ---- group: A=pt2move2
subtraction = Subtraction(A=vec, B=vec_2)  # disabled

# ---- group: PACKING
separatedata = Ladybug_SeparateData(Code=file_9, X_keep_omit="27.0,25.0", Y_keep_omit="27.0,25.0", Seperation_ref="-1", Run=Toggle(True))

# ---- group: HEIGHT
miru = PythonScript(Code=file_11, Height=Slider(16.5, range=0..100), Run=Toggle(True))

# ---- group: EXTRACT_SLICE
miru_2 = PythonScript(Code=file_16, Run=Toggle(False))

# ---- group: DIVIDE
miru_3 = PythonScript(
    Code=file_7,
    Divide_num=Slider(2, range=0..10),
    Divide_cut=Slider(0, range=0..100),
    Divide_type=list_2,
    Divide_ratio=Slider(0.5, range=0..1),
    Axis=list_3,
    Run=Toggle(False))

# ----
bibil_7 = PythonScript(Code=file_6, Run=Toggle(True))  # -> Node_out, Debug

# ---- group: PERIMETER
miru_4 = PythonScript(Code=file_8, Width=Slider(20, range=0..100), Cut_width=Slider(0, range=0..100), Court_ref="0", Run=Toggle(False))

# ----
geo = Geometry([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])  # disabled

# ---- group: TREE RULES
miru_5 = PythonScript(Code=file_13, Run=Toggle(False))

# ---- group: SHAPE2HEIGHT
miru_6 = PythonScript(Code=file_15, Run=Toggle(False))

# ---- group: ENERGY_MODEL_BUCKET
miru_7 = PythonScript(Code=file_17, Run=Toggle(True))

# ----
move = Move(Geometry=geo, Motion=subtraction)  # -> Geometry, Transform; disabled
geo_2 = Geometry(move.Geometry)  # disabled
# HI-RESIDENTIAL-BASE
number_slider = Slider(1, range=0..10)
number_slider_2 = Slider(31.5, range=0..100)
list_4 = ValueList({"divide by depth": "subdivide_depth", "divide by same depth": "subdivide_depth_same", "divide by dim": "subdivide_dim"}, selected="divide by depth")
list_5 = ValueList({"YZ": "NS", "XZ": "EW", "XY": "Z"}, selected="XZ")
panel = Panel("0")
geo_3 = Geometry(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)

# ---- group: SETBACK
miru_8 = PythonScript(Code=file_10, Height_stepback="13.5:3.0", Stepback_ref=geo_3, Run=Toggle(True))

miru_9 = PythonScript(Code=file_10, Height_stepback="25.5:6.0", Stepback_ref="2", Run=Toggle(True))

# ---- group: DIVIDE
miru_10 = PythonScript(
    Code=file_7,
    Divide_num=number_slider,
    Divide_cut=Slider(10, range=0..100),
    Divide_type=list_4,
    Divide_ratio=Slider(0.5, range=0..1),
    Axis=list_5,
    Run=Toggle(True))

# ---- group: PERIMETER
miru_11 = PythonScript(Code=file_8, Width=Slider(36, range=0..100), Cut_width=Slider(0, range=0..100), Court_ref="0", Run=Toggle(True))

# ---- group: HEIGHT
miru_12 = PythonScript(Code=file_11, Height=Slider(31.5, range=0..100), Run=Toggle(True))

# ----
geo_4 = Geometry(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)

# ---- group: SHAPENODE
bibil_8 = PythonScript(
    Code=file_6,
    Rule_in=flatten([miru_10, miru_11, miru_12, miru_8, miru_9]),
    Node_in=flatten(geo_4),
    Label_="comm-hi",
    Run=Toggle(True))  # -> Node_out, Debug

# ----
g = PythonScript(node=bibil_8.Node_out)  # -> geom; inputs node: list
# ---------- g: Python ----------
node = filter(lambda n: n!=None,node)
if node and node != []:
    geom = []
    for n in node:
        if n.shape.z_dist < 1.2:
            geom.append(n.shape.bottom_crv)
        else:
            geom.append(n.shape.geom)
    print geom
# ---------- end g ----------
g_2 = PythonScript(node=bibil_8.Node_out)  # -> label; inputs node: list
# ---------- g_2: Python ----------
node = filter(lambda n: n!=None,node)
if node and node != []:
    label = []
    if True:#for i,n in enumerate(node):
        #print i
        root = node[0].get_root()
        L = root.traverse_tree(lambda n:n,internal=True) 
        for i in L:
            print i
            label.append(i)
        #label.append('--')
        #print '---'
# ---------- end g_2 ----------
g_3 = PythonScript(node=bibil_8.Node_out)  # -> bucket, debug; inputs node: list
# ---------- g_3: Python ----------
import scriptcontext as sc
sc.sticky['debug'] = []
import rhinoscriptsyntax as rs


node = filter(lambda n: n!=None,node)

if node and node != []:
    bucket = []
    for n in node:
        lstn = n.backtrack_tree(lambda n_:n_.grammar.type.has_key('ratio'),accumulate=True)
        bucket.append(n.shape.bottom_crv)
        for nl in lstn:
            if 'stepback' in nl.grammar.type['grammar']:
                print nl
                stpd = nl.grammar.type['stepback_data']
                ht = float(stpd[0][0])+3
                print stpd
                pt = n.shape.cpt
                refpt = rs.AddPoint(pt[0],pt[1],ht)
                topcrv = n.shape.get_bottom(n.shape.geom,refpt)
                bucket.append(topcrv)
        print '--'
    print '------'
    #print geom
debug = sc.sticky['debug']
# ---------- end g_3 ----------

# ---- group: ENERGY_MODEL_BUCKET
miru_13 = PythonScript(Code=file_17, Run=Toggle(True))

# ----
wires = BrepWireframe(Brep=g, Density=-1)
preview = CustomPreview(
    Geometry=wires,
    Shader={ambient=RGB(0, 0, 0), diffuse=RGB(255, 105, 180), emission=RGB(76, 32, 54), shine=0.5, specular=RGB(255, 255, 255), transparency=0})
bibil_9 = PythonScript(Code=file_6, Rule_in=flatten(miru_13), Node_in=flatten(bibil_8.Node_out), Run=Toggle(True))  # -> Node_out, Debug
g_4 = PythonScript(node=bibil_9.Node_out)  # -> geom; inputs node: list; same code as g

# ---- group: PACKING
separatedata_2 = Ladybug_SeparateData(Code=file_9, X_keep_omit="27.0,35.0", Y_keep_omit="27.0,35.0", Seperation_ref="-1", Run=Toggle(True))

# ---- group: EXTRACT_SLICE
miru_14 = PythonScript(Code=file_16, Run=Toggle(True))

# ---- group: SHAPENODE
bibil_10 = PythonScript(Code=file_6, Rule_in=flatten([miru_14, separatedata_2]), Node_in=flatten(bibil_8.Node_out), Run=Toggle(False))  # -> Node_out, Debug

# ----
g_5 = PythonScript(node=bibil_10.Node_out)  # -> geom; inputs node: list
# ---------- g_5: Python ----------
node = filter(lambda n: n!=None,node)
if node and node != []:
    geom = []
    for n in node:
        if n.shape.z_dist < 1.2:
            geom.append(n.shape.bottom_crv)
        else:
            geom.append(n.shape.geom)
        print n
        print n.grammar.type['top'] 
        print '---'
# ---------- end g_5 ----------
g_6 = PythonScript(node=bibil_10.Node_out)  # -> label; inputs node: list; same code as g_2
preview_2 = CustomPreview(
    Geometry=g_5,
    Shader={ambient=RGB(0, 0, 0), diffuse=RGB(255, 105, 180), emission=RGB(76, 32, 54), shine=0.5, specular=RGB(255, 255, 255), transparency=0})
# HI-RESIDENTIAL-MID
number_slider_3 = Slider(1, range=0..10)
# HI-RESIDENTIAL-HI
number_slider_4 = Slider(55, range=0..100)
list_6 = ValueList({"divide by depth": "subdivide_depth", "divide by same depth": "subdivide_depth_same", "divide by dim": "subdivide_dim"}, selected="divide by same depth")
list_7 = ValueList({"YZ": "NS", "XZ": "EW", "XY": "Z"}, selected="XZ")

# ---- group: SETBACK
miru_15 = PythonScript(Code=file_10, Height_stepback="31.5:11.5", Stepback_ref="0", Run=Toggle(True))

# ---- group: DIVIDE
miru_16 = PythonScript(
    Code=file_7,
    Divide_num=number_slider_3,
    Divide_cut=Slider(0, range=0..100),
    Divide_type=list_6,
    Divide_ratio=Slider(0.5, range=0..1),
    Axis=list_7,
    Run=Toggle(True))

# ---- group: HEIGHT
miru_17 = PythonScript(Code=file_11, Height=number_slider_4, Randomize="-30.0>30.0", Run=Toggle(True))

miru_18 = PythonScript(Code=file_11, Height=Slider(6, range=0..100), Randomize="-3.0>6.0", Run=Toggle(True))

# ---- group: SHAPENODE
bibil_11 = PythonScript(Code=file_6, Rule_in=flatten(miru_17), Node_in=flatten(bibil_10.Node_out), Run=Toggle(False))  # -> Node_out, Debug

bibil_12 = PythonScript(Code=file_6, Rule_in=flatten([miru_16, miru_18, miru_15]), Node_in=flatten(bibil_10.Debug), Run=Toggle(False))  # -> Node_out, Debug

# ----
g_7 = PythonScript(node=bibil_11.Node_out)  # -> geom; inputs node: list; same code as g
g_8 = PythonScript(node=bibil_12.Node_out)  # -> geom; inputs node: list; same code as g
material = CreateMaterial(
    Diffuse=ColourSwatch(SwatchColor=RGB(0, 255, 255)),
    Specular=RGB(255, 255, 255),
    Emission=RGB(0, 0, 0),
    Transparency=Slider(0, range=0..1),
    Shine=0)
mesh = Mesh([g, g_7, g_8])
preview_3 = CustomPreview(Geometry=mesh, Shader=material)
