# Grasshopper definition hb_radiation_internal.gh (Grasshopper 0.9.76)
# plug-ins: Python Interpreter

ladybug = Ladybug_Ladybug()  # -> Vviiiiiiiiiizzz; plug-in component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
honeybee = Honeybee_Honeybee()  # -> Vviiiiiiiiiizzz; plug-in component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
listzoneprograms = Honeybee_ListZonePrograms(bldgProgram=Slider(0, range=0..100))  # -> OfficeZonePrograms; plug-in component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

# ---- group: Exterior wall
geo = Geometry(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)

# ---- group: Window
geo_2 = Geometry(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)

# ---- group: floor
geo_3 = Geometry(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)

# ----
ceiling = Geometry(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)
glzparamlist = Honeybee_GlazingParametersList(northGlzParam=0, westGlzParam=0, southGlzParam="0.6", eastGlzParam=0)  # -> glzParamList; plug-in component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
item = ListItem(List=listzoneprograms, Index=0, Wrap=True)

# ----
# Zone to analyze
toggle = BooleanToggle(True)
geo_4 = Geometry(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)
mass2zone = Honeybee_Masses2Zones(zoneMasses=flatten(geo_4), zonePrograms=item, isConditioned=True, maxRoofAngle=30, createHBZones=toggle)  # -> readMe, HBZones; plug-in component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

python = PythonScript(g=[geo, geo_2], num=Slider(18, range=0..100), dim=Slider(-3000, range=-3000..3000), axis="y")  # -> a
# ---------- python: Python ----------
import rhinoscriptsyntax as rs


L = []
L.append(g)
dim_ = dim
for i in range(int(num)):
    if axis == 'y':
        g_ = rs.CopyObject(g,[0,dim_,0])
    else:
        g_ = rs.CopyObject(g,[0,0,dim_])
    L.append(g_)
    dim_ += dim

a = L
# ---------- end python ----------
python_2 = PythonScript(g=[python, geo_3, ceiling], num=Slider(26, range=0..100), dim=Slider(4500, range=-4500..10000), axis="z")  # -> a; same code as python

# ----
# Create glazing
toggle_2 = BooleanToggle(True)
glazingcreator = Honeybee_GlazingBasedOnRatio(HBObjects=mass2zone.HBZones, glzRatio=glzparamlist, runIt=toggle_2)  # -> readMe, HBObjWGLZ; plug-in component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

geo_5 = Geometry([python, python_2])

# ----
# Create test grid!!!
genhbzonetestpts = Honeybee_GenerateZoneTestPoints(
    HBZone=glazingcreator.HBObjWGLZ,
    gridSize=Slider(2000, range=0..10000),
    distBaseSrf=Slider(1000, range=0..1000),
    moveTestMesh=True)  # -> readMe, simplify(testPoints), simplify(ptsVectors), simplify(facesArea), simplify(mesh); plug-in component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

# ----
# Generate sky file
toggle_3 = BooleanToggle(True)
open_weather_file = Ladybug_OpenEPWWeatherFile(open=Toggle(True))  # -> epwFile; plug-in component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
gencumsky = Honeybee_GenerateCumulativeSky(weatherFile=open_weather_file, generateSky=toggle_3)  # -> skyFilePath; plug-in component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

# ----
# Visualize
decomposebytype = Honeybee_DecomposeBasedOnType(HBZone=glazingcreator.HBObjWGLZ)  # -> walls, interiorWalls, airWalls, windows, interiorWindows, skylights, roofs, ceilings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; plug-in component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
preview = CustomPreview(Geometry=decomposebytype.walls, Shader=ColourSwatch(SwatchColor=RGB(255, 241, 112)))
preview_2 = CustomPreview(Geometry=decomposebytype.windows, Shader=ColourSwatch(SwatchColor=RGBA(176, 233, 255, 153)))

# ----
# be sure to set Simulation type to 1 for solar radiation!
gridbasedsimulation = Honeybee_GridBasedSimulation(skyFile=gencumsky, testPoints=genhbzonetestpts.testPoints, testMesh=genhbzonetestpts.mesh, simulationType=1)  # -> analysisRecipe; plug-in component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

toggle_4 = BooleanToggle(True)
rundaylightanalysis = Honeybee_RunDaylightSimulation(
    HBObjects=flatten(glazingcreator.HBObjWGLZ),
    analysisRecipe=gridbasedsimulation,
    writeRad=toggle_4,
    runRad=toggle_4,
    workingDir="C:\Users\vasanthakumars\Desktop\temp_folder",
    overwriteResults=True)  # -> readMe, analysisType, resultsUnit, cumulative_radiation_values, testPts, resultFiles, radGeoFile, studyFolder, done; plug-in component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
legendpar = Ladybug_LegendParameters(lowBound=150, highBound=350, numSegments=7)  # -> legendPar; plug-in component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
# Annual solar radiation inside building Kwh
panel = Panel("4")

# ----
# Visualize
panel_2 = Panel("Annual solar radiation inside building Kwh")
recolormesh = Ladybug_RecolorMesh(
    analysisResult=rundaylightanalysis.cumulative_radiation_values,
    inputMesh=genhbzonetestpts.mesh,
    heightDomain="24",
    legendPar=legendpar,
    analysisTitle=panel_2)  # -> readMe, newMesh, newLegend, legendBasePt, meshColors, legendColors; plug-in component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

swatch = ColourSwatch(SwatchColor=RGB(255, 208, 0))
swatch_2 = ColourSwatch(SwatchColor=RGB(115, 0, 255))
