# Grasshopper definition trinco_projected_population.gh (Grasshopper 0.9.76)
# plug-ins: Python Interpreter

list = ValueList({"dir", "file"}, selected="dir")

# ---- group: find directory
bibil = PythonScript(
    dir=["C:\\Users\\vasanthakumars\\Documents\\GitHub\\bibil\\src", "C:\\saeran\\master\\git\\bibil\\src"],
    type=list,
    run=Toggle(True))  # -> dir; inputs dir: list
# ---------- bibil: Python ----------
import os

ghenv.Component.Params.Output[0].Name = "null"
ghenv.Component.Params.Output[0].NickName = "null"

if run:
    confirm_dir = None
    for d in dir:
        try:
            if type == "file":
                file_ = open(d)
                file_.close()
            else:
                print os.listdir(d)
            confirm_dir = d
            break
        except Exception as e:
            #print str(e)
            continue
    if confirm_dir != None:
        ghenv.Component.Params.Output[0].Name = type
        ghenv.Component.Params.Output[0].NickName = type
        dir = confirm_dir
        file = confirm_dir
null = None
# ---------- end bibil ----------

# ---- group: tree
python_script = PythonScript(i=bibil)  # -> o
# ---------- python_script: Python ----------
import os

if i:
    o = os.path.join(str(i),"bibil\\bibil_tree.py")
# ---------- end python_script ----------
file = ReadFile(File=python_script, PerLineParse=False)
bibil_2 = PythonScript(Code=file)

# ---- group: grammar
python_script_2 = PythonScript(i=bibil)  # -> o
# ---------- python_script_2: Python ----------
import os

if i:
    o = os.path.join(str(i),"bibil\\bibil_grammar.py")
# ---------- end python_script_2 ----------
file_2 = ReadFile(File=python_script_2, PerLineParse=False)
bibil_3 = PythonScript(Code=file_2)

# ---- group: shape
python_script_3 = PythonScript(i=bibil)  # -> o
# ---------- python_script_3: Python ----------
import os

if i:
    o = os.path.join(str(i),"bibil\\bibil_shape.py")
#o = os.path.join(str(i),"research\\bibil_shape_shape_3d_2d.py")
# ---------- end python_script_3 ----------
file_3 = ReadFile(File=python_script_3, PerLineParse=False)
bibil_4 = PythonScript(Code=file_3)

# ---- group: miru
python_script_4 = PythonScript(i=bibil)  # -> o
# ---------- python_script_4: Python ----------
import os

if i:
    o = os.path.join(str(i),"miru\\miru_miru.py")
# ---------- end python_script_4 ----------
file_4 = ReadFile(File=python_script_4, PerLineParse=False)
bibil_5 = PythonScript(Code=file_4)

# ---- group: bula
python_script_5 = PythonScript(i=bibil)  # -> o
# ---------- python_script_5: Python ----------
import os

if i:
    o = os.path.join(str(i),"bula\\bula_minimal.py")
# ---------- end python_script_5 ----------
file_5 = ReadFile(File=python_script_5, PerLineParse=False)
bibil_6 = PythonScript(Code=file_5)

# ---- group: UI
python_script_6 = PythonScript(i=bibil)  # -> o
# ---------- python_script_6: Python ----------
import os

if i:
    o = os.path.join(str(i),"bibil\\bibil_UI.py")
# ---------- end python_script_6 ----------
file_6 = ReadFile(File=python_script_6, PerLineParse=False)

# ---- group: grammar_divide
python_script_7 = PythonScript(i=bibil)  # -> o
# ---------- python_script_7: Python ----------
import os

if i:
    o = os.path.join(str(i),"miru\\miru_divide.py")
# ---------- end python_script_7 ----------
file_7 = ReadFile(File=python_script_7, PerLineParse=False)

# ---- group: grammar_courtyard
python_script_8 = PythonScript(i=bibil)  # -> o
# ---------- python_script_8: Python ----------
import os

if i:
    o = os.path.join(str(i),"miru\\miru_court.py")
# ---------- end python_script_8 ----------
file_8 = ReadFile(File=python_script_8, PerLineParse=False)

# ---- group: grammar_tower
python_script_9 = PythonScript(i=bibil)  # -> o
# ---------- python_script_9: Python ----------
import os

if i:
    o = os.path.join(str(i),"miru\\miru_packing.py")
# ---------- end python_script_9 ----------
file_9 = ReadFile(File=python_script_9, PerLineParse=False)

python_script_10 = PythonScript(i=bibil)  # -> o
# ---------- python_script_10: Python ----------
import os

if i:
    o = os.path.join(str(i),"miru\\miru_stepback.py")
# ---------- end python_script_10 ----------
file_10 = ReadFile(File=python_script_10, PerLineParse=False)

# ---- group: grammar_height
python_script_11 = PythonScript(i=bibil)  # -> o
# ---------- python_script_11: Python ----------
import os

if i:
    o = os.path.join(str(i),"miru\\miru_height.py")
# ---------- end python_script_11 ----------
file_11 = ReadFile(File=python_script_11, PerLineParse=False)

# ---- group: grammar_analysis_pts
python_script_12 = PythonScript(i=bibil)  # -> o
# ---------- python_script_12: Python ----------
import os

if i:
    o = os.path.join(str(i),"miru\\miru_analysis.py")
# ---------- end python_script_12 ----------
file_12 = ReadFile(File=python_script_12, PerLineParse=False)

# ---- group: meta_tree
python_script_13 = PythonScript(i=bibil)  # -> o
# ---------- python_script_13: Python ----------
import os

if i:
    o = os.path.join(str(i),"miru\\miru_meta_tree.py")
# ---------- end python_script_13 ----------
file_13 = ReadFile(File=python_script_13, PerLineParse=False)

# ---- group: land_use
python_script_14 = PythonScript(i=bibil)  # -> o
# ---------- python_script_14: Python ----------
import os

if i:
    o = os.path.join(str(i),"miru\\miru_landuse.py")
# ---------- end python_script_14 ----------
file_14 = ReadFile(File=python_script_14, PerLineParse=False)

# ---- group: shape2height
python_script_15 = PythonScript(i=bibil)  # -> o
# ---------- python_script_15: Python ----------
import os

if i:
    o = os.path.join(str(i),"miru\\miru_shape2height.py")
# ---------- end python_script_15 ----------
file_15 = ReadFile(File=python_script_15, PerLineParse=False)

# ---- group: extract_slice
python_script_16 = PythonScript(i=bibil)  # -> o
# ---------- python_script_16: Python ----------
import os

if i:
    o = os.path.join(str(i),"miru\\miru_extract_slice.py")
# ---------- end python_script_16 ----------
file_16 = ReadFile(File=python_script_16, PerLineParse=False)

# ---- group: GEOREF
# Note: Change this number with caution,
vec = Vector(Vector(-545901.6391, 3981870.516, 0))  # disabled

# ---- group: CPT
# Increase bounds iterratively.
vec_2 = Vector(Vector(0, 3981920.861, 0))

# ----
list_2 = ValueList({"divide by depth": "subdivide_depth", "divide by same depth": "subdivide_depth_same", "divide by dim": "subdivide_dim"}, selected="divide by same depth")
list_3 = ValueList({"YZ": "NS", "XZ": "EW", "XY": "Z"}, selected="XZ")

# ---- group: A=pt2move2
subtraction = Subtraction(A=vec, B=vec_2)  # disabled

# ---- group: PACKING
separatedata = Ladybug_SeparateData(Code=file_9, X_keep_omit="27.0,25.0", Y_keep_omit="27.0,25.0", Seperation_ref="-1", Run=Toggle(True))

# ---- group: HEIGHT
miru = PythonScript(Code=file_11, Height=Slider(16.5, range=0..100), Run=Toggle(True))

# ---- group: EXTRACT_SLICE
miru_2 = PythonScript(Code=file_16, Run=Toggle(False))

# ---- group: DIVIDE
miru_3 = PythonScript(
    Code=file_7,
    Divide_num=Slider(2, range=0..10),
    Divide_cut=Slider(0, range=0..100),
    Divide_type=list_2,
    Divide_ratio=Slider(0.5, range=0..1),
    Axis=list_3,
    Run=Toggle(False))

# ---- group: PERIMETER
miru_4 = PythonScript(Code=file_8, Width=Slider(20, range=0..100), Cut_width=Slider(0, range=0..100), Court_ref="0", Run=Toggle(False))

# ----
geo = Geometry([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])  # disabled

# ---- group: TREE RULES
miru_5 = PythonScript(Code=file_13, Run=Toggle(False))

# ---- group: SHAPE2HEIGHT
miru_6 = PythonScript(Code=file_15, Run=Toggle(False))

# ----
move = Move(Geometry=geo, Motion=subtraction)  # -> Geometry, Transform; disabled
geo_2 = Geometry(move.Geometry)  # disabled
geo_3 = Geometry(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)
geo_4 = Geometry([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])
geo_5 = Geometry([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])
geo_6 = Geometry([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])
geo_7 = Geometry(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)
list_4 = ValueList({"divide by depth": "subdivide_depth", "divide by same depth": "subdivide_depth_same", "divide by dim": "subdivide_dim"}, selected="divide by depth")
list_5 = ValueList({"YZ": "NS", "XZ": "EW", "XY": "Z"}, selected="XZ")
# LOW-COMMERCIAL
number_slider = Slider(1, range=0..10)
panel = Panel("""7.5:3.0
10.5:4.5
19.5:6.0""")

# ---- group: DIVIDE
# LOW-RESIDENTIAL
miru_7 = PythonScript(
    Code=file_7,
    Divide_num=Slider(1, range=0..10),
    Divide_cut=Slider(15, range=0..100),
    Divide_type=list_4,
    Divide_ratio=Slider(0.65, range=0..1),
    Axis=list_5,
    Run=Toggle(True))

# ----
list_6 = ValueList({"divide by depth": "subdivide_depth", "divide by same depth": "subdivide_depth_same", "divide by dim": "subdivide_dim"}, selected="divide by depth")
list_7 = ValueList({"divide by depth": "subdivide_depth", "divide by same depth": "subdivide_depth_same", "divide by dim": "subdivide_dim"}, selected="divide by depth")
geo_8 = Geometry(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)
# MID-RESIDENTIAL
number_slider_2 = Slider(24, range=0..100)
# HI-COMMERCIAL
number_slider_3 = Slider(1, range=0..10)
number_slider_4 = Slider(31.5, range=0..100)
geo_9 = Geometry([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])
# HI-RESIDENTIAL
number_slider_5 = Slider(1, range=0..10)
panel_2 = Panel("""7.5:1.5
25.5:6.0""")
list_8 = ValueList({"YZ": "NS", "XZ": "EW", "XY": "Z"}, selected="XZ")
list_9 = ValueList({"YZ": "NS", "XZ": "EW", "XY": "Z"}, selected="XZ")
list_10 = ValueList({"divide by depth": "subdivide_depth", "divide by same depth": "subdivide_depth_same", "divide by dim": "subdivide_dim"}, selected="divide by depth")
list_11 = ValueList({"divide by depth": "subdivide_depth", "divide by same depth": "subdivide_depth_same", "divide by dim": "subdivide_dim"}, selected="divide by depth")
geo_10 = Geometry(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)
panel_3 = Panel("0")
geo_11 = Geometry(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)
list_12 = ValueList({"YZ": "NS", "XZ": "EW", "XY": "Z"}, selected="XZ")
list_13 = ValueList({"YZ": "NS", "XZ": "EW", "XY": "Z"}, selected="XZ")

# ---- group: DIVIDE
miru_8 = PythonScript(
    Code=file_7,
    Divide_num=Slider(3, range=0..10),
    Divide_cut=Slider(10, range=0..100),
    Divide_type=list_6,
    Divide_ratio=Slider(0.5, range=0..1),
    Axis=list_8,
    Run=Toggle(True))

miru_9 = PythonScript(
    Code=file_7,
    Divide_num=number_slider,
    Divide_cut=Slider(0, range=0..100),
    Divide_type=list_7,
    Divide_ratio=Slider(0.5, range=0..1),
    Axis=list_9,
    Run=Toggle(True))

# ---- group: SETBACK
miru_10 = PythonScript(Code=file_10, Height_stepback="7.5:1.5", Stepback_ref="2", Run=Toggle(True))

# ---- group: PERIMETER
miru_11 = PythonScript(Code=file_8, Width=Slider(12.5, range=0..100), Cut_width=Slider(0, range=0..100), Court_ref="2", Run=Toggle(True))

# ---- group: SETBACK
miru_12 = PythonScript(Code=file_10, Height_stepback=panel, Stepback_ref=geo_8, Run=Toggle(True))

# ---- group: HEIGHT
miru_13 = PythonScript(Code=file_11, Height=Slider(19.5, range=0..100), Randomize="-6.0>6", Run=Toggle(True))

# ----
list_14 = ValueList({"divide by depth": "subdivide_depth", "divide by same depth": "subdivide_depth_same", "divide by dim": "subdivide_dim"}, selected="divide by dim")

# ---- group: SETBACK
miru_14 = PythonScript(Code=file_10, Height_stepback="13.5:2.5", Stepback_ref=geo_10, Run=Toggle(True))

# ---- group: SHAPENODE
bibil_7 = PythonScript(Code=file_6, Rule_in=flatten(miru_7), Node_in=flatten(geo_9), Label_="root", Run=Toggle(True))  # -> Node_out, Debug

# ---- group: SETBACK
miru_15 = PythonScript(Code=file_10, Height_stepback=panel_2, Stepback_ref="-1", Run=Toggle(True))

# ---- group: DIVIDE
miru_16 = PythonScript(
    Code=file_7,
    Divide_num=number_slider_3,
    Divide_cut=Slider(15, range=0..100),
    Divide_type=list_10,
    Divide_ratio=Slider(0.25, range=0..1),
    Axis=list_12,
    Run=Toggle(True))

# ---- group: PERIMETER
miru_17 = PythonScript(Code=file_8, Width=number_slider_2, Cut_width=Slider(7, range=0..100), Court_ref="-1", Run=Toggle(True))

# ---- group: DIVIDE
miru_18 = PythonScript(
    Code=file_7,
    Divide_num=number_slider_5,
    Divide_cut=Slider(10, range=0..100),
    Divide_type=list_11,
    Divide_ratio=Slider(0.5, range=0..1),
    Axis=list_13,
    Run=Toggle(True))

# ---- group: PERIMETER
miru_19 = PythonScript(Code=file_8, Width=Slider(36, range=0..100), Cut_width=Slider(0, range=0..100), Court_ref="0", Run=Toggle(True))

# ---- group: SETBACK
miru_20 = PythonScript(Code=file_10, Height_stepback="25.5:6.0", Stepback_ref="2", Run=Toggle(True))

miru_21 = PythonScript(Code=file_10, Height_stepback="13.5:3.0", Stepback_ref=geo_11, Run=Toggle(True))

# ---- group: HEIGHT
miru_22 = PythonScript(Code=file_11, Height=Slider(16.5, range=0..100), Randomize="-3.0>6", Run=Toggle(True))

miru_23 = PythonScript(Code=file_11, Height=Slider(28.5, range=0..100), Randomize="-6.0>6", Run=Toggle(True))

miru_24 = PythonScript(Code=file_11, Height=Slider(31.5, range=0..100), Run=Toggle(True))

# ----
list_15 = ValueList({"YZ": "NS", "XZ": "EW", "XY": "Z"}, selected="YZ")

# ---- group: HEIGHT
miru_25 = PythonScript(Code=file_11, Height=Slider(27, range=0..100), Run=Toggle(False))

# ---- group: DIVIDE
miru_26 = PythonScript(
    Code=file_7,
    Divide_num=["50", "100"],
    Divide_cut=Slider(0, range=0..100),
    Divide_type=list_14,
    Divide_ratio=Slider(0.5, range=0..1),
    Axis=list_15,
    Run=Toggle(False))

# ----
python = PythonScript(L=bibil_7.Node_out)  # -> res, com; inputs L: list
# ---------- python: Python ----------
res = []
com = []

com = [L[0],L[2]]
res = [L[1],L[3]]
# ---------- end python ----------

# ---- group: SHAPENODE
bibil_8 = PythonScript(Code=file_6, Rule_in=flatten(miru_9), Node_in=flatten(geo_6), Label_="comm-low", Run=Toggle(False))  # -> Node_out, Debug

# ----
geo_12 = Geometry([<curve referenced from the Rhino model> x116])
geo_13 = Geometry([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])
g = PythonScript(node=bibil_8.Node_out)  # -> geom; inputs node: list
# ---------- g: Python ----------
node = filter(lambda n: n!=None,node)
if node and node != []:
    geom = []
    for n in node:
        if n.shape.z_dist < 1.2:
            geom.append(n.shape.bottom_crv)
        else:
            geom.append(n.shape.geom)
    print geom
# ---------- end g ----------
list_16 = ValueList({"divide by depth": "subdivide_depth", "divide by same depth": "subdivide_depth_same", "divide by dim": "subdivide_dim"}, selected="divide by dim")
g_2 = PythonScript(node=bibil_8.Node_out)  # -> label; inputs node: list
# ---------- g_2: Python ----------
node = filter(lambda n: n!=None,node)
if node and node != []:
    label = []
    if True:#for i,n in enumerate(node):
        #print i
        root = node[0].get_root()
        L = root.traverse_tree(lambda n:n,internal=True) 
        for i in L:
            print i
            label.append(i)
        #label.append('--')
        #print '---'
# ---------- end g_2 ----------
python_2 = PythonScript(L=bibil_8.Node_out)  # -> L1, L2; inputs L: list
# ---------- python_2: Python ----------
import random

L1,L2 = [],[]
for n in L:
    rand = random.randrange(0,2)
    if rand==0:
        L1.append(n)
    else:
        L2.append(n)
# ---------- end python_2 ----------
python_3 = PythonScript(x=geo_13)  # -> a; inputs x: list
# ---------- python_3: Python ----------
import rhinoscriptsyntax as rs

L = []
for n in x:
    #chkcrv = rs.IsCurveClosed(n)
    #if chkcrv:
    #    L.append(n)
    area = rs.Area(n)
    if area > 750.:
        L.append(n)
a = L
# ---------- end python_3 ----------

# ---- group: SHAPENODE
bibil_9 = PythonScript(Code=file_6, Rule_in=flatten([miru_26, miru_25]), Node_in=flatten(geo_12), Run=Toggle(False))  # -> Node_out, Debug

bibil_10 = PythonScript(
    Code=file_6,
    Rule_in=flatten([miru_8, miru_11, miru_13, miru_10, miru_12]),
    Node_in=flatten(geo_4),
    Label_="base",
    Run=Toggle(False))  # -> Node_out, Debug

# ----
list_17 = ValueList({"YZ": "NS", "XZ": "EW", "XY": "Z"}, selected="XZ")

# ---- group: SHAPENODE
bibil_11 = PythonScript(Code=file_6, Rule_in=flatten([miru_17, miru_23, miru_15]), Node_in=flatten(geo_5), Label_="base", Run=Toggle(False))  # -> Node_out, Debug

bibil_12 = PythonScript(
    Code=file_6,
    Rule_in=flatten([miru_18, miru_19, miru_24, miru_21, miru_20]),
    Node_in=flatten(geo_7),
    Label_="comm-hi",
    Run=Toggle(False))  # -> Node_out, Debug

bibil_13 = PythonScript(Code=file_6, Rule_in=flatten([miru_16, miru_22, miru_14]), Node_in=flatten(geo_3), Label_="comm-hi", Run=Toggle(False))  # -> Node_out, Debug

# ----
geo_14 = Geometry(python_3)

# ---- group: DIVIDE
miru_27 = PythonScript(
    Code=file_7,
    Divide_num=["21", "11"],
    Divide_cut=Slider(3, range=0..100),
    Divide_type=list_16,
    Divide_ratio=Slider(0.5, range=0..1),
    Axis=list_17,
    Run=Toggle(True))

# ---- group: HEIGHT
miru_28 = PythonScript(Code=file_11, Height=Slider(9, range=0..100), Randomize="-3.0>3", Run=Toggle(True))

# ---- group: PERIMETER
miru_29 = PythonScript(Code=file_8, Width=Slider(15, range=0..100), Court_ref="0", Run=Toggle(True))

# ----
g_3 = PythonScript(node=bibil_12.Node_out)  # -> label; inputs node: list; same code as g_2
panel_4 = Panel("""13.5:1.5
25.5:6.0""")
geo_15 = Geometry(bibil_12.Debug)
g_4 = PythonScript(node=bibil_10.Node_out)  # -> geom; inputs node: list; same code as g
g_5 = PythonScript(node=bibil_10.Node_out)  # -> label; inputs node: list; same code as g_2
g_6 = PythonScript(node=bibil_10.Node_out)  # -> gfa; inputs node: list
# ---------- g_6: Python ----------
node = filter(lambda n: n!=None,node)
if node and node != []:
    gfa = []
    for n in node:
        gfa_ = n.shape.get_area() * n.shape.ht
        gfa.append(gfa_)
    gfa = sum(gfa)
    print gfa
# ---------- end g_6 ----------
g_7 = PythonScript(node=bibil_12.Node_out)  # -> geom; inputs node: list; same code as g
geo_16 = Geometry(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)
g_8 = PythonScript(node=bibil_11.Node_out)  # -> geom; inputs node: list; same code as g
g_9 = PythonScript(node=bibil_11.Node_out)  # -> label; inputs node: list; same code as g_2
g_10 = PythonScript(node=bibil_11.Node_out)  # -> gfa; inputs node: list; same code as g_6
list_18 = ValueList({"divide by depth": "subdivide_depth", "divide by same depth": "subdivide_depth_same", "divide by dim": "subdivide_dim"}, selected="divide by dim")
python_4 = PythonScript(L=bibil_13.Node_out)  # -> L1, L2; inputs L: list
# ---------- python_4: Python ----------
#import random

L1,L2 = [],[]
for i,n in enumerate(L):
    #rand = random.randrange(0,2)
    if i==0:
        L1.append(n)
    else:
        L2.append(n)
# ---------- end python_4 ----------
g_11 = PythonScript(node=bibil_9.Node_out)  # -> geom; inputs node: list
# ---------- g_11: Python ----------
node = filter(lambda n: n!=None,node)
if node and node != []:
    geom = []
    area = 0
    for n in node:
        if n.shape.z_dist < 1.2:
            geom.append(n.shape.bottom_crv)
        else:
            geom.append(n.shape.geom)
        area += n.shape.get_area()
    print area
# ---------- end g_11 ----------
g_12 = PythonScript(node=bibil_9.Node_out)  # -> label; inputs node: list; same code as g_2
list_19 = ValueList({"YZ": "NS", "XZ": "EW", "XY": "Z"}, selected="XZ")
panel_5 = Panel(g_5)
g_13 = PythonScript(node=python_4.L2)  # -> geom; inputs node: list; same code as g
panel_6 = Panel(g_9)
list_20 = ValueList({"divide by depth": "subdivide_depth", "divide by same depth": "subdivide_depth_same", "divide by dim": "subdivide_dim"}, selected="divide by dim")
fmerge = MergeFaces(Brep=g_4)  # -> Breps, Before, After

# ---- group: SETBACK
miru_30 = PythonScript(Code=file_10, Height_stepback=panel_4, Stepback_ref=geo_16, Run=Toggle(True))

# ----
fmerge_2 = MergeFaces(Brep=g_8)  # -> Breps, Before, After

# ---- group: HEIGHT
miru_31 = PythonScript(Code=file_11, Height=Slider(28.5, range=0..100), Randomize="-6.0>6", Run=Toggle(True))

# ----
toggle = BooleanToggle(False)

# ---- group: DIVIDE
miru_32 = PythonScript(
    Code=file_7,
    Divide_num=["100", "20"],
    Divide_cut=Slider(0, range=0..100),
    Divide_type=list_18,
    Divide_ratio=Slider(0.5, range=0..1),
    Axis=list_19,
    Run=Toggle(True))

# ----
list_21 = ValueList({"YZ": "NS", "XZ": "EW", "XY": "Z"}, selected="XZ")
geo_17 = Geometry(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)

# ---- group: DIVIDE
miru_33 = PythonScript(
    Code=file_7,
    Divide_num=["100", "10"],
    Divide_cut=Slider(0, range=0..100),
    Divide_type=list_20,
    Divide_ratio=Slider(0.5, range=0..1),
    Axis=list_21,
    Run=Toggle(True))

# ---- group: EXTRACT_SLICE
miru_34 = PythonScript(Code=file_16, Run=Toggle(True))

# ---- group: PACKING
separatedata_2 = Ladybug_SeparateData(Code=file_9, X_keep_omit="27.0,35.0", Y_keep_omit="27.0,35.0", Seperation_ref="-1", Run=Toggle(True))

# ---- group: SHAPENODE
bibil_14 = PythonScript(Code=file_6, Rule_in=flatten([miru_29, miru_27, miru_28]), Node_in=flatten(geo_17), Run=toggle)  # -> Node_out, Debug

bibil_15 = PythonScript(Code=file_6, Rule_in=flatten([miru_29, miru_27, miru_28]), Node_in=flatten(python.res), Run=toggle)  # -> Node_out, Debug

# ---- group: PACKING
separatedata_3 = Ladybug_SeparateData(Code=file_9, X_keep_omit="27.0,70.0", Y_keep_omit="27.0,70.0", Seperation_ref="-1", Run=Toggle(True))

# ---- group: HEIGHT
miru_35 = PythonScript(Code=file_11, Height=Slider(150, range=0..1000), Run=Toggle(True))

# ----
geo_18 = Geometry([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])

# ---- group: EXTRACT_SLICE
miru_36 = PythonScript(Code=file_16, Run=Toggle(False))

# ----
geo_19 = Geometry([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])

# ---- group: PACKING
separatedata_4 = Ladybug_SeparateData(Code=file_9, X_keep_omit="40.0,35.0", Y_keep_omit="40.0,35.0", Seperation_ref="-1", Run=Toggle(True))

# ---- group: SETBACK
miru_37 = PythonScript(Code=file_10, Height_stepback="0.0:6.0", Randomize="0.0>0.0:-6.0>6.0", Stepback_ref=geo_18, Run=Toggle(True))

# ---- group: EXTRACT_SLICE
miru_38 = PythonScript(Code=file_16, Run=Toggle(True))

# ----
g_14 = PythonScript(node=[bibil_15.Node_out, bibil_14.Node_out])  # -> geom; inputs node: list; same code as g

# ---- group: SETBACK
miru_39 = PythonScript(Code=file_10, Height_stepback="0.0:6.0", Randomize="0.0>0.0:-6.0>6.0", Stepback_ref=geo_19, Run=Toggle(True))

# ---- group: SHAPENODE
bibil_16 = PythonScript(Code=file_6, Rule_in=flatten([miru_36, separatedata_3, miru_35]), Node_in=flatten(bibil_9.Node_out), Run=Toggle(False))  # -> Node_out, Debug

bibil_17 = PythonScript(Code=file_6, Rule_in=flatten([miru_34, separatedata_2]), Node_in=flatten(bibil_12.Node_out), Run=Toggle(False))  # -> Node_out, Debug

bibil_18 = PythonScript(
    Code=file_6,
    Rule_in=flatten([miru_32, miru_31, miru_30, miru_39]),
    Node_in=flatten(python_2.L1),
    Label_="comm-low",
    Run=Toggle(True))  # -> Node_out, Debug

bibil_19 = PythonScript(
    Code=file_6,
    Rule_in=flatten([miru_33, miru_31, miru_30, miru_37]),
    Node_in=flatten(python_2.L2),
    Label_="comm-low",
    Run=Toggle(True))  # -> Node_out, Debug

# ----
g_15 = PythonScript(node=[null x400])  # -> geom; inputs node: list
# ---------- g_15: Python ----------
node = filter(lambda n: n!=None,node)
if node and node != []:
    geom = []
    for n in node:
        area = n.shape.get_area()
        if area < 755.:
            geom.append(n.shape.geom)
    #print geom
# ---------- end g_15 ----------
number_slider_6 = Slider(150, range=0..1000)
g_16 = PythonScript(node=bibil_17.Node_out)  # -> label; inputs node: list; same code as g_2

# ---- group: SHAPENODE
bibil_20 = PythonScript(Code=file_6, Rule_in=flatten([miru_38, separatedata_4]), Node_in=flatten(python_4.L2), Run=Toggle(True))  # -> Node_out, Debug

# ----
g_17 = PythonScript(node=bibil_16.Node_out)  # -> geom; inputs node: list
# ---------- g_17: Python ----------
node = filter(lambda n: n!=None,node)
if node and node != []:
    pop = 0.
    population_target = 180000.#225k * 0.8
    numtow = 0
    for n in node:
        area = n.shape.get_area()
        if area < 755.:
            pop += 500.
            numtow += 1
    print pop
    print numtow
    frac = pop/population_target
    percent = round(frac * 100,2)
    print percent
# ---------- end g_17 ----------
g_18 = PythonScript(node=bibil_16.Node_out)  # -> geom; inputs node: list; same code as g_15
g_19 = PythonScript(node=bibil_18.Node_out)  # -> label; inputs node: list; same code as g_2
list_22 = ValueList({"divide by depth": "subdivide_depth", "divide by same depth": "subdivide_depth_same", "divide by dim": "subdivide_dim"}, selected="divide by same depth")
g_20 = PythonScript(node=bibil_18.Node_out)  # -> geom; inputs node: list; same code as g
g_21 = PythonScript(node=bibil_19.Node_out)  # -> geom; inputs node: list; same code as g
g_22 = PythonScript(node=bibil_19.Node_out)  # -> label; inputs node: list; same code as g_2
geo_20 = Geometry([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])
g_23 = PythonScript(node=bibil_17.Node_out)  # -> geom; inputs node: list
# ---------- g_23: Python ----------
node = filter(lambda n: n!=None,node)
if node and node != []:
    geom = []
    for n in node:
        if n.shape.z_dist < 1.2:
            geom.append(n.shape.bottom_crv)
        else:
            geom.append(n.shape.geom)
        print n
        print n.grammar.type['top'] 
        print '---'
# ---------- end g_23 ----------
list_23 = ValueList({"YZ": "NS", "XZ": "EW", "XY": "Z"}, selected="XZ")
material = CreateMaterial(
    Diffuse=ColourSwatch(SwatchColor=RGB(0, 255, 255)),
    Specular=RGB(255, 255, 255),
    Emission=RGB(0, 0, 0),
    Transparency=0,
    Shine=0)
mesh = Mesh(geo_20)

# ---- group: HEIGHT
miru_40 = PythonScript(Code=file_11, Height=Slider(150, range=0..1000), Run=Toggle(True))

# ---- group: SHAPE2HEIGHT
miru_41 = PythonScript(Code=file_15, Run=Toggle(True))

# ----
preview = CustomPreview(Geometry=mesh, Shader=material)
preview_2 = CustomPreview(
    Geometry=g_23,
    Shader={ambient=RGB(0, 0, 0), diffuse=RGB(255, 105, 180), emission=RGB(76, 32, 54), shine=0.5, specular=RGB(255, 255, 255), transparency=0})

# ---- group: SETBACK
miru_42 = PythonScript(Code=file_10, Height_stepback="31.5:11.5", Stepback_ref="0", Run=Toggle(True))

# ---- group: DIVIDE
miru_43 = PythonScript(
    Code=file_7,
    Divide_num=Slider(1, range=0..10),
    Divide_cut=Slider(0, range=0..100),
    Divide_type=list_22,
    Divide_ratio=Slider(0.5, range=0..1),
    Axis=list_23,
    Run=Toggle(True))

# ---- group: HEIGHT
miru_44 = PythonScript(Code=file_11, Height=Slider(6, range=0..100), Randomize="-3.0>6.0", Run=Toggle(True))

# ----
item = ListItem(List=bibil_20.Node_out, Index=0, Wrap=True)

# ---- group: SHAPENODE
bibil_21 = PythonScript(Code=file_6, Rule_in=flatten([miru_40, miru_41]), Node_in=flatten(item), Label_="shape4example", Run=Toggle(True))  # -> Node_out, Debug

bibil_22 = PythonScript(Code=file_6, Rule_in=flatten([miru_43, miru_44, miru_42]), Node_in=flatten(bibil_17.Debug), Run=Toggle(False))  # -> Node_out, Debug

# ----
g_24 = PythonScript(node=bibil_21.Node_out)  # -> geom; inputs node: list; same code as g
g_25 = PythonScript(node=bibil_21.Node_out)  # -> label; inputs node: list; same code as g_2
item_2 = ListItem(List=g_24, Index="-1", Wrap=True)
g_26 = PythonScript(node=bibil_22.Node_out)  # -> geom; inputs node: list; same code as g
Z = UnitZ(Factor=Slider(3, range=0..10))

# ---- group: HEIGHT
miru_45 = PythonScript(Code=file_11, Height=Slider(55, range=0..100), Randomize="-30.0>30.0", Run=Toggle(True))

# ----
move_2 = Move(Geometry=item_2, Motion=Z)  # -> Geometry, Transform

# ---- group: SHAPE2HEIGHT
miru_46 = PythonScript(Code=file_15, Run=Toggle(True))

# ----
extr = Extrude(Base=g_24, Direction=Z)
boundary = BoundarySurfaces(Edges=move_2.Geometry)
mesh_2 = Mesh([extr, boundary, g_13])

# ---- group: SHAPENODE
bibil_23 = PythonScript(
    Code=file_6,
    Rule_in=flatten([miru_45, miru_46]),
    Node_in=flatten(bibil_17.Node_out),
    Label_="shape4example",
    Run=Toggle(True))  # -> Node_out, Debug

# ----
g_27 = PythonScript(node=bibil_23.Node_out)  # -> geom; inputs node: list; same code as g
g_28 = PythonScript(node=bibil_23.Node_out)  # -> label; inputs node: list; same code as g_2
item_3 = ListItem(List=g_27, Index="-1", Wrap=True)
Z_2 = UnitZ(Factor=Slider(3, range=0..10))
move_3 = Move(Geometry=item_3, Motion=Z_2)  # -> Geometry, Transform
extr_2 = Extrude(Base=g_27, Direction=Z_2)
boundary_2 = BoundarySurfaces(Edges=move_3.Geometry)
mesh_3 = Mesh([g_7, g_26])
mesh_4 = Mesh([extr_2, boundary_2])
material_2 = CreateMaterial(
    Diffuse=ColourSwatch(SwatchColor=RGB(0, 255, 255)),
    Specular=RGB(255, 255, 255),
    Emission=RGB(0, 0, 0),
    Transparency=Slider(0, range=0..1),
    Shine=0)
geo_21 = Geometry([g_14, fmerge_2.Breps, fmerge.Breps, g_20, g_21])

# ---- group: HEIGHT
miru_47 = PythonScript(Code=file_11, Height=Slider(55, range=0..100), Randomize="-30.0>30.0", Run=Toggle(True))

# ---- group: SHAPENODE
bibil_24 = PythonScript(Code=file_6, Rule_in=flatten(miru_47), Run=Toggle(True))  # -> Node_out, Debug

# ----
g_29 = PythonScript(node=[bibil_21.Node_out, bibil_24.Node_out])  # -> gfa; inputs node: list; same code as g_6

g_30 = PythonScript(node=bibil_24.Node_out)  # -> geom; inputs node: list; same code as g

mesh_5 = Mesh([g_7, g_30, g_26, mesh_4])
mesh_6 = Mesh([geo_21, mesh_5])
preview_3 = CustomPreview(Geometry=[mesh_6, mesh_2], Shader=material_2)
