# Grasshopper definition Energy_Shade_Benefit_editing.gh (Grasshopper 0.9.76)
# plug-ins: Python Interpreter

honeybee = Honeybee_Honeybee()  # -> Vviiiiiiiiiizzz; plug-in component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
# Set Up An Energy Simulation
ladybug = Ladybug_Ladybug()  # -> Vviiiiiiiiiizzz; plug-in component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
# Set Building Geometry
brep = Brep(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)
panel = Panel("C:\Users\user\AppData\Roaming\Grasshopper\UserObjects\ladybug_honeybee")
splitmass = Honeybee_SplitBuildingMass(bldgMasses=brep, bldgsFlr2FloorHeights="@3", perimeterZoneDepth="@3", runIt=Toggle(True))  # -> readMe, splitBldgMasses; plug-in component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
updatehoneybee = Honeybee_UpdateHoneybee(sourceDirectory=panel, updateThisFile=Toggle(False), updateAllUObjects=Toggle(False))  # -> out; plug-in component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
mass2zone = Honeybee_Masses2Zones(zoneMasses=flatten(splitmass.splitBldgMasses), isConditioned=True, maxRoofAngle=30, createHBZones=Toggle(True))  # -> readMe, HBZones; plug-in component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
solveadjc = Honeybee_SolveAdjacencies(HBZones=flatten(mass2zone.HBZones), removeCurrentAdjc=False, findAdjc=Toggle(True))  # -> readMe, HBZonesWADJ; plug-in component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
glazingcreator = Honeybee_GlazingBasedOnRatio(HBObjects=solveadjc.HBZonesWADJ, glzRatio=".9", breakUpWindow=Toggle(False), runIt=Toggle(True))  # -> readMe, HBObjWGLZ; plug-in component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
number_slider = Slider(19, range=16..20)
number_slider_2 = Slider(24, range=22..28)
toggle = BooleanToggle(True)
epoutput = Honeybee_GenerateEPOutput(
    zoneEnergyUse=toggle,
    zoneGainsAndLosses="False",
    zoneComfortMetrics=toggle,
    surfaceTempAnalysis="False",
    surfaceEnergyAnalysis=toggle,
    glazingSolarAnalysis=toggle,
    timestep="hourly")  # -> report, flatten(simulationOutputs); plug-in component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
setepzonethresholds = Honeybee_SetEnergyPlusZoneThresholds(
    HBZones=glazingcreator.HBObjWGLZ,
    coolingSetPt=number_slider_2,
    coolingSetback=number_slider_2,
    heatingSetPt=number_slider,
    heatingSetback=number_slider)  # -> readMe, HBZones; plug-in component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
data = Data(setepzonethresholds.HBZones)

# ----
# Visualize the Zones
decomposebytype = Honeybee_DecomposeBasedOnType(HBZone=data)  # -> walls, interiorWalls, airWalls, windows, interiorWindows, skylights, roofs, ceilings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; plug-in component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
preview = CustomPreview(Geometry=decomposebytype.windows, Shader=ColourSwatch(SwatchColor=RGBA(178, 232, 255, 108)))
preview_2 = CustomPreview(Geometry=decomposebytype.walls, Shader=ColourSwatch(SwatchColor=RGB(255, 252, 178)))
preview_3 = CustomPreview(Geometry=[decomposebytype.groundFloors, decomposebytype.floors], Shader=ColourSwatch(SwatchColor=RGB(214, 131, 131)))
preview_4 = CustomPreview(Geometry=decomposebytype.roofs, Shader=ColourSwatch(SwatchColor=RGB(128, 128, 128)))

# ----
# Run the Simulation
# 1
toggle_2 = BooleanToggle(True)
number_slider_3 = Slider(0.5, range=0..1)
# 2
toggle_3 = BooleanToggle(True)
geo = Geometry([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])

panel_2 = Panel("C:\\Users\\vasanthakumars\\Documents\\GitHub\\bibil\\src\\reference\\CAN_ON_Toronto.716240_CWEC\\CAN_ON_Toronto.716240_CWEC.epw")
panel_3 = Panel("C:\saeran\master\git\bibil\src\reference\CAN_ON_Toronto.716240_CWEC\CAN_ON_Toronto.716240_CWEC.epw")
list = ValueList({"dir", "file"}, selected="file")

# ---- group: find directory
bibil = PythonScript(dir=[panel_3, panel_2], type=list, run=Toggle(True))  # -> file; inputs dir: list
# ---------- bibil: Python ----------
import os

ghenv.Component.Params.Output[0].Name = "null"
ghenv.Component.Params.Output[0].NickName = "null"

if run:
    confirm_dir = None
    for d in dir:
        try:
            if type == "file":
                file_ = open(d)
                file_.close()
            else:
                print os.listdir(d)
            confirm_dir = d
            break
        except Exception as e:
            #print str(e)
            continue
    if confirm_dir != None:
        ghenv.Component.Params.Output[0].Name = type
        ghenv.Component.Params.Output[0].NickName = type
        dir = confirm_dir
        file = confirm_dir
null = None
# ---------- end bibil ----------

# ----
data_2 = Data(bibil)

# ----
# Run the Energy Simulation + Get Results
exporttoopenstudio = Honeybee_ExportToOpenStudio(
    epwWeatherFile=data_2,
    HBZones=flatten(data),
    simulationOutputs=flatten(epoutput.simulationOutputs),
    writeOSM=toggle_2,
    runSimulation=toggle_2,
    fileName="Test_IDF")  # -> readMe, osmFileAddress, idfFileAddress, resultsFileAddress, rddFileAddress, studyFolder; plug-in component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
readepsrfresult = Honeybee_ReadEPSurfaceResult(resultFileAddress=exporttoopenstudio.resultsFileAddress)  # -> port, port_2, surfaceEnergyFlow, opaqueEnergyFlow, glazEnergyFlow, windowTotalSolarEnergy, windowBeamEnergy, windowDiffEnergy, port_3, port_4; plug-in component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
readepresult = Honeybee_ReadEPResult(resultFileAddress=exporttoopenstudio.resultsFileAddress)  # -> totalThermalLoad, thermalLoadBalance, cooling, heating, electricLight, electricEquip, port, port_2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; plug-in component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
importlocation = Ladybug_ImportLocation(epwFile=data_2)  # -> location; plug-in component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
# Create Shades
epwindowshades = Honeybee_EnergyPlusWindowShadeGenerator(
    HBObjects=data,
    depth=Slider(3, range=0..10),
    numOfShds="1",
    horOrVertical=Toggle(True),
    runIt=toggle_3,
    writeEPObjs=readepresult.cooling,
    zoneData1=readepresult.heating,
    zoneData2=readepsrfresult.windowBeamEnergy)  # -> readMe, port, HBObjWShades, port_2, windowBreps, shadeBreps, port_3, shadeMatName, shadeMatIDFStr, shadeCntrlIDFStr; plug-in component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
geo_2 = Geometry(epwindowshades.shadeBreps)

panel_4 = Panel(".25")
# 3
toggle_4 = BooleanToggle(False)
# Shade Benefit Analysis
energyshadebenefit = Honeybee_EnergyShadeBenefitEvaluator(
    location=importlocation,
    coolingLoad=epwindowshades.shadeMatName,
    heatingLoad=epwindowshades.shadeMatIDFStr,
    beamGain=epwindowshades.shadeCntrlIDFStr,
    testShades=epwindowshades.shadeBreps,
    testWindow=epwindowshades.windowBreps,
    gridSize=Slider(2, range=0..10),
    delNonIntersect=False,
    parallel=Toggle(True),
    runIt=toggle_4)  # -> readMe, port, sunVectors, windowTestPts, shadeMesh, legend, legendBasePoint, port_2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; plug-in component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
preview_5 = CustomPreview(Geometry=[energyshadebenefit.legend, energyshadebenefit.shadeMesh], Shader=ColourSwatch(SwatchColor=RGB(0, 0, 0)))

# ----
# Select Out The Parts of Shades To Keep
number_slider_4 = Slider(21, range=0..100)
shadecreator = Honeybee_OptimalShadeCreator(shadeMesh=energyshadebenefit.shadeMesh, shadeNetEffect=energyshadebenefit.shadeNetEffect, levelOfPerform=number_slider_4)  # -> readMe, energySavedByShade, areaOfShade, newColoredMesh, newShadeBrep; plug-in component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
edges = BrepEdges(Brep=shadecreator.newShadeBrep)  # -> Naked, Interior, NonManifold
data_3 = Data(flatten(shadecreator.areaOfShade))
data_4 = Data(flatten(shadecreator.energySavedByShade))
ma = MassAddition(Input=data_3)  # -> Result, PartialResults
ma_2 = MassAddition(Input=data_4)  # -> Result, PartialResults
preview_6 = CustomPreview(Geometry=edges.Naked, Shader=ColourSwatch(SwatchColor=RGB(0, 0, 0)))
panel_5 = Panel(ma.Result)
panel_6 = Panel(ma_2.Result)
