# Grasshopper definition Energy_Shade_Benefit_site_14_geom_003_orientation.gh (Grasshopper 0.9.76)
# plug-ins: Python Interpreter

panel = Panel("C:\\Users\\vasanthakumars\\Documents\\GitHub\\bibil\\src")  # disabled
panel_2 = Panel("C:\\saeran\\master\\git\\bibil\\src")  # disabled
toggle = BooleanToggle(True)  # disabled
list = ValueList({"dir", "file"}, selected="dir")  # disabled

# ---- group: find directory
bibil = PythonScript(dir=[panel, panel_2], type=list, run=toggle)  # -> dir; inputs dir: list; disabled
# ---------- bibil: Python ----------
import os

ghenv.Component.Params.Output[0].Name = "null"
ghenv.Component.Params.Output[0].NickName = "null"

if run:
    confirm_dir = None
    for d in dir:
        try:
            if type == "file":
                file_ = open(d)
                file_.close()
            else:
                print os.listdir(d)
            confirm_dir = d
            break
        except Exception as e:
            #print str(e)
            continue
    if confirm_dir != None:
        ghenv.Component.Params.Output[0].Name = type
        ghenv.Component.Params.Output[0].NickName = type
        dir = confirm_dir
        file = confirm_dir
null = None
# ---------- end bibil ----------

# ---- group: miru
# BIBIL_CLASSES
python_script = PythonScript(i=bibil)  # -> o; disabled
# ---------- python_script: Python ----------
import os

if i:
    o = os.path.join(str(i),"miru\\miru_miru.py")
# ---------- end python_script ----------
file = ReadFile(File=python_script, PerLineParse=False)  # disabled
bibil_2 = PythonScript(Code=file)  # disabled

# ---- group: grammar
python_script_2 = PythonScript(i=bibil)  # -> o; disabled
# ---------- python_script_2: Python ----------
import os

if i:
    o = os.path.join(str(i),"bibil\\bibil_rule.py")
# ---------- end python_script_2 ----------
file_2 = ReadFile(File=python_script_2, PerLineParse=False)  # disabled
bibil_3 = PythonScript(Code=file_2)  # disabled

# ---- group: pattern
python_script_3 = PythonScript(i=bibil)  # -> o; disabled
# ---------- python_script_3: Python ----------
import os

if i:
    o = os.path.join(str(i),"bibil\\bibil_pattern.py")
# ---------- end python_script_3 ----------
file_3 = ReadFile(File=python_script_3, PerLineParse=False)  # disabled
bibil_4 = PythonScript(Code=file_3)  # disabled

# ---- group: shape
python_script_4 = PythonScript(i=bibil)  # -> o; disabled
# ---------- python_script_4: Python ----------
import os

if i:
    o = os.path.join(str(i),"bibil\\bibil_shape.py")
#o = os.path.join(str(i),"research\\bibil_shape_shape_3d_2d.py")
# ---------- end python_script_4 ----------
file_4 = ReadFile(File=python_script_4, PerLineParse=False)  # disabled
bibil_5 = PythonScript(Code=file_4)  # disabled

# ---- group: tree
python_script_5 = PythonScript(i=bibil)  # -> o; disabled
# ---------- python_script_5: Python ----------
import os

if i:
    o = os.path.join(str(i),"bibil\\bibil_tree.py")
# ---------- end python_script_5 ----------
file_5 = ReadFile(File=python_script_5, PerLineParse=False)  # disabled
bibil_6 = PythonScript(Code=file_5)  # disabled

# ---- group: bula
python_script_6 = PythonScript(i=bibil)  # -> o; disabled
# ---------- python_script_6: Python ----------
import os

if i:
    o = os.path.join(str(i),"bula\\bula_minimal.py")
# ---------- end python_script_6 ----------
file_6 = ReadFile(File=python_script_6, PerLineParse=False)  # disabled

# ---- group: node_comp
python_script_7 = PythonScript(i=bibil)  # -> o; disabled
# ---------- python_script_7: Python ----------
import os

if i:
    o = os.path.join(str(i),"bibil\\bibil_UI.py")
# ---------- end python_script_7 ----------
file_7 = ReadFile(File=python_script_7, PerLineParse=False)  # disabled

# ---- group: grammar_divide
python_script_8 = PythonScript(i=bibil)  # -> o; disabled
# ---------- python_script_8: Python ----------
import os

if i:
    o = os.path.join(str(i),"miru\\miru_divide.py")
# ---------- end python_script_8 ----------
file_8 = ReadFile(File=python_script_8, PerLineParse=False)  # disabled

# ---- group: grammar_courtyard
python_script_9 = PythonScript(i=bibil)  # -> o; disabled
# ---------- python_script_9: Python ----------
import os

if i:
    o = os.path.join(str(i),"miru\\miru_court.py")
# ---------- end python_script_9 ----------
file_9 = ReadFile(File=python_script_9, PerLineParse=False)  # disabled

# ---- group: grammar_tower
python_script_10 = PythonScript(i=bibil)  # -> o; disabled
# ---------- python_script_10: Python ----------
import os

if i:
    o = os.path.join(str(i),"miru\\miru_packing.py")
# ---------- end python_script_10 ----------
file_10 = ReadFile(File=python_script_10, PerLineParse=False)  # disabled

python_script_11 = PythonScript(i=bibil)  # -> o; disabled
# ---------- python_script_11: Python ----------
import os

if i:
    o = os.path.join(str(i),"miru\\miru_stepback.py")
# ---------- end python_script_11 ----------
file_11 = ReadFile(File=python_script_11, PerLineParse=False)  # disabled

# ---- group: grammar_height
python_script_12 = PythonScript(i=bibil)  # -> o; disabled
# ---------- python_script_12: Python ----------
import os

if i:
    o = os.path.join(str(i),"miru\\miru_height.py")
# ---------- end python_script_12 ----------
file_12 = ReadFile(File=python_script_12, PerLineParse=False)  # disabled

# ----
bldgprograms = Honeybee_bldgPrograms({"Office": 0, "Retail": 1, "MidriseApartment": 2, "PrimarySchool": 3, "SecondarySchool": 4, "SmallHotel": 5, "LargeHotel": 6, "Hospital": 7, "Outpatient": 8, "Warehouse": 9, "SuperMarket": 10, "FullServiceRestaurant": 11, "QuickServiceRestaurant": 12}, selected="Office")
listzoneprograms = Honeybee_ListZonePrograms(bldgProgram=bldgprograms)  # -> OfficeZonePrograms; plug-in component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
panel_3 = Panel(listzoneprograms)
item = ListItem(List=listzoneprograms, Index="3", Wrap=True)
item_2 = ListItem(List=listzoneprograms, Index="3", Wrap=True)
item_3 = ListItem(List=listzoneprograms, Index="5", Wrap=True)
item_4 = ListItem(List=listzoneprograms, Index="11", Wrap=True)
item_5 = ListItem(List=listzoneprograms, Index="5", Wrap=True)
geo = Geometry([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])
geo_2 = Geometry([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])
geo_3 = Geometry(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)
geo_4 = Geometry(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)
geo_5 = Geometry([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])
ladybug = Ladybug_Ladybug()  # -> Vviiiiiiiiiizzz; plug-in component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

# ---- group: East
mass2zone = Honeybee_Masses2Zones(zoneMasses=flatten(geo_2), zonePrograms=item_2, isConditioned=Toggle(True), maxRoofAngle=30, createHBZones=Toggle(True))  # -> readMe, HBZones; plug-in component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

# ----
mass2zone_2 = Honeybee_Masses2Zones(zoneMasses=flatten(geo_3), zonePrograms=item_3, isConditioned=Toggle(True), maxRoofAngle=30, createHBZones=Toggle(True))  # -> readMe, HBZones; plug-in component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
honeybee = Honeybee_Honeybee()  # -> Vviiiiiiiiiizzz; plug-in component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

# ---- group: West
mass2zone_3 = Honeybee_Masses2Zones(zoneMasses=flatten(geo), zonePrograms=item, isConditioned=Toggle(True), maxRoofAngle=30, createHBZones=Toggle(True))  # -> readMe, HBZones; plug-in component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

# ----
mass2zone_4 = Honeybee_Masses2Zones(zoneMasses=flatten(geo_4), zonePrograms=item_4, isConditioned=Toggle(True), maxRoofAngle=30, createHBZones=Toggle(True))  # -> readMe, HBZones; plug-in component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
mass2zone_5 = Honeybee_Masses2Zones(zoneMasses=flatten(geo_5), zonePrograms=item_5, isConditioned=Toggle(True), maxRoofAngle=30, createHBZones=Toggle(True))  # -> readMe, HBZones; plug-in component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
geo_6 = Geometry(mass2zone_4.HBZones)
geo_7 = Geometry(mass2zone_2.HBZones)
geo_8 = Geometry(mass2zone_3.HBZones)
geo_9 = Geometry(mass2zone.HBZones)
geo_10 = Geometry(mass2zone_5.HBZones)
setepzonecnstr = Honeybee_SetEPZoneConstruction(HBZone=[mass2zone_3.HBZones, mass2zone_5.HBZones])  # -> simplify(modifiedHBZone); plug-in component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
setepzonecnstr_2 = Honeybee_SetEPZoneConstruction(HBZone=[mass2zone_2.HBZones, mass2zone_4.HBZones, mass2zone.HBZones])  # -> simplify(modifiedHBZone); plug-in component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
solveadjc = Honeybee_SolveAdjacencies(
    HBZones=flatten([setepzonecnstr, setepzonecnstr_2]),
    altConstruction="Air wall",
    removeCurrentAdjc=False,
    findAdjc=Toggle(True))  # -> readMe, HBZonesWADJ; plug-in component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
toggle_2 = BooleanToggle(False)
toggle_3 = BooleanToggle(True)
glzparamlist = Honeybee_GlazingParametersList(northGlzParam="0.9", westGlzParam="0.5", southGlzParam="0.9", eastGlzParam="0.5")  # -> glzParamList; plug-in component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
glzparamlist_2 = Honeybee_GlazingParametersList(northGlzParam=toggle_2, westGlzParam=toggle_3, southGlzParam=toggle_2, eastGlzParam=toggle_3)  # -> glzParamList; plug-in component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
glazingcreator = Honeybee_GlazingBasedOnRatio(HBObjects=solveadjc.HBZonesWADJ, glzRatio=glzparamlist, breakUpWindow=glzparamlist_2, runIt=Toggle(False))  # -> readMe, HBObjWGLZ; plug-in component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
number_slider = Slider(24, range=22..28)
number_slider_2 = Slider(19, range=16..20)
toggle_4 = BooleanToggle(True)
setepzonethresholds = Honeybee_SetEnergyPlusZoneThresholds(
    HBZones=glazingcreator.HBObjWGLZ,
    coolingSetPt=number_slider,
    coolingSetback=number_slider,
    heatingSetPt=number_slider_2,
    heatingSetback=number_slider_2)  # -> readMe, HBZones; plug-in component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
setepzonecnstr_3 = Honeybee_SetEPZoneConstruction(HBZone=setepzonethresholds.HBZones)  # -> simplify(modifiedHBZone); plug-in component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

decomposebytype = Honeybee_DecomposeBasedOnType(HBZone=setepzonethresholds.HBZones)  # -> walls, interiorWalls, airWalls, windows, interiorWindows, skylights, roofs, ceilings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; plug-in component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
preview = CustomPreview(Geometry=decomposebytype.windows, Shader=ColourSwatch(SwatchColor=RGBA(178, 232, 255, 108)))
preview_2 = CustomPreview(Geometry=decomposebytype.walls, Shader=ColourSwatch(SwatchColor=RGB(255, 252, 178)))
preview_3 = CustomPreview(Geometry=[decomposebytype.groundFloors, decomposebytype.floors], Shader=ColourSwatch(SwatchColor=RGB(214, 131, 131)))
preview_4 = CustomPreview(
    Geometry=[decomposebytype.roofs, decomposebytype.floors, decomposebytype.exposedFloors],
    Shader=ColourSwatch(SwatchColor=RGB(128, 128, 128)))

epoutput = Honeybee_GenerateEPOutput(
    zoneEnergyUse=toggle_4,
    zoneGainsAndLosses="False",
    zoneComfortMetrics="False",
    surfaceTempAnalysis="False",
    surfaceEnergyAnalysis=toggle_4,
    glazingSolarAnalysis=toggle_4,
    timestep="hourly")  # -> report, flatten(simulationOutputs); plug-in component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
separatezonesbyorientation = Honeybee_SeparateZonesByOrientation(HBZones=flatten(setepzonethresholds.HBZones), onlyWGlz=Toggle(False))  # -> orientations, HBZones; plug-in component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
python = PythonScript(tree=separatezonesbyorientation.HBZones, index=Slider(0, range=0..10))  # -> L; inputs tree: tree, index: Int32
# ---------- python: Python ----------
nested_lst = []
for i in range(tree.BranchCount):
    branchList = tree.Branch(i)
    nested_lst.append(branchList)

L = []
for i,i_ in enumerate(nested_lst):
    #print len(i_)
    #print ''
    if i==index:
        L.extend(i_)
print L
# ---------- end python ----------
panel_4 = Panel(separatezonesbyorientation.orientations)
panel_5 = Panel(separatezonesbyorientation.HBZones)
setloadsandschedules = Honeybee_SetLoadsAndSchedules()  # -> currentSchedules, currentLoads, HBZones; plug-in component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
panel_6 = Panel(".25")
data = Data("0.5")
edges = BrepEdges()  # -> Naked, Interior, NonManifold
preview_5 = CustomPreview(Geometry=edges.Naked, Shader=ColourSwatch(SwatchColor=RGB(0, 0, 0)))

panel_7 = Panel("C:\\Users\\vasanthakumars\\Documents\\GitHub\\bibil\\src\\reference\\CAN_ON_Toronto.716240_CWEC\\CAN_ON_Toronto.716240_CWEC.epw")
panel_8 = Panel("C:\saeran\master\git\bibil\src\reference\CAN_ON_Toronto.716240_CWEC\CAN_ON_Toronto.716240_CWEC.epw")
# Run the Energy Simulation + Get Results
toggle_5 = BooleanToggle(True)
list_2 = ValueList({"dir", "file"}, selected="file")

# ---- group: find directory
bibil_7 = PythonScript(dir=[panel_8, panel_7], type=list_2, run=toggle_5)  # -> file; inputs dir: list; same code as bibil

# ----
data_2 = Data(bibil_7)

importlocation = Ladybug_ImportLocation(epwFile=data_2)  # -> location; plug-in component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

# ----
# Run the Simulation
toggle_6 = BooleanToggle(False)

runenergysimulation = Honeybee_RunEnergySimulation(
    epwFile=data_2,
    HBZones=flatten(setepzonecnstr_3),
    simulationOutputs=flatten(epoutput.simulationOutputs),
    writeIdf=toggle_6,
    runEnergyPlus=toggle_6,
    idfFileName="test_idf_3")  # -> report, idfFileAddress, resultFileAddress; plug-in component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

readepsrfresult = Honeybee_ReadEPSurfaceResult(resultFileAddress=runenergysimulation.resultFileAddress)  # -> surfaceIndoorTemp, surfaceOutdoorTemp, surfaceEnergyFlow, opaqueEnergyFlow, glazEnergyFlow, windowTotalSolarEnergy, windowBeamEnergy, windowDiffEnergy, windowTransmissivity, otherSurfaceData; plug-in component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
readepresult = Honeybee_ReadEPResult(resultFileAddress=runenergysimulation.resultFileAddress)  # -> totalThermalEnergy, thermalEnergyBalance, cooling, heating, electricLight, electricEquip, fanElectric, pumpElectric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; plug-in component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

# ----
# Create Shades
epwindowshades = Honeybee_EnergyPlusWindowShadeGenerator(
    HBObjects=setepzonethresholds.HBZones,
    distToGlass=Slider(0, range=0..1),
    depth=Slider(2, range=0..10),
    numOfShds="1",
    horOrVertical=Toggle(True),
    runIt=Toggle(False),
    zoneData1=readepresult.cooling,
    zoneData2=readepresult.heating,
    zoneData3=readepsrfresult.windowBeamEnergy)  # -> readMe, debug, HBObjWShades, port, windowBreps, shadeBreps, port_2, zoneData1Tree, zoneData2Tree, zoneData3Tree; plug-in component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
geo_11 = Geometry(epwindowshades.shadeBreps)
geo_12 = Geometry(epwindowshades.debug)
# Shade Benefit Analysis
energyshadebenefit = Honeybee_EnergyShadeBenefitEvaluator(
    location=importlocation,
    coolingLoad=epwindowshades.zoneData1Tree,
    heatingLoad=epwindowshades.zoneData2Tree,
    beamGain=epwindowshades.zoneData3Tree,
    testShades=epwindowshades.shadeBreps,
    testWindow=epwindowshades.windowBreps,
    gridSize=data,
    delNonIntersect=False,
    parallel=Toggle(True),
    runIt=Toggle(True))  # -> readMe, port, sunVectors, windowTestPts, shadeMesh, legend, legendBasePoint, port_2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; plug-in component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
preview_6 = CustomPreview(Geometry=[energyshadebenefit.legend, energyshadebenefit.shadeMesh], Shader=ColourSwatch(SwatchColor=RGB(0, 0, 0)))
# Select Out The Parts of Shades To Keep
shadecreator = Honeybee_OptimalShadeCreator(
    shadeMesh=energyshadebenefit.shadeMesh,
    shadeNetEffect=energyshadebenefit.shadeNetEffect,
    levelOfPerform=Slider(10, range=0..100))  # -> readMe, energySavedByShade, areaOfShade, newColoredMesh, newShadeBrep; plug-in component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
geo_13 = Geometry(shadecreator.newShadeBrep)
edges_2 = BrepEdges(Brep=shadecreator.newShadeBrep)  # -> Naked, Interior, NonManifold
data_3 = Data(flatten(shadecreator.areaOfShade))
data_4 = Data(flatten(shadecreator.energySavedByShade))
ma = MassAddition(Input=data_3)  # -> Result, PartialResults
ma_2 = MassAddition(Input=data_4)  # -> Result, PartialResults
preview_7 = CustomPreview(Geometry=edges_2.Naked, Shader=ColourSwatch(SwatchColor=RGB(0, 0, 0)))
panel_9 = Panel(ma.Result)
panel_10 = Panel(ma_2.Result)
