# Grasshopper definition 10_ArchsimMultiZone_test.gh (Grasshopper 0.9.76)
# plug-ins: Python Interpreter, ArchsimGH

brep = Brep([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])
brep_2 = Brep([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])
brep_3 = Brep(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)
toggle = BooleanToggle(True)
geo = Geometry(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)
honeybee = Honeybee_Honeybee()  # -> Vviiiiiiiiiizzz; plug-in component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
ladybug = Ladybug_Ladybug()  # -> Vviiiiiiiiiizzz; plug-in component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
splitmass = Honeybee_SplitBuildingMass(bldgMasses=geo, perimeterZoneDepth=Slider(3, range=0..10), runIt=toggle)  # -> readMe, splitBldgMasses; plug-in component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
zone = ThermalZone(
    ThermalZoneGeometry=brep,
    Name="Perimeter",
    SettingsAsFormatedString="-NoSelection-",
    Library="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",
    Settings="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")  # -> ThermalZones, SettingsAsFormatedString
zone_2 = ThermalZone(
    ThermalZoneGeometry=brep_3,
    Name="Core",
    SettingsAsFormatedString="-NoSelection-",
    Library="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",
    Settings="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")  # -> ThermalZones, SettingsAsFormatedString
window = Window(
    WindowGeometry=brep_2,
    Library="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",
    Settings="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")  # -> Window, SettingsAsFormatedString
mass2zone = Honeybee_Masses2Zones(zoneMasses=flatten(splitmass.splitBldgMasses), isConditioned=True, maxRoofAngle=30, createHBZones=toggle)  # -> readMe, HBZones; plug-in component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
networker = ZoneConnectivityNetwork(ThermalZoneCollection=[zone.ThermalZones, zone_2.ThermalZones], Windows=window.Window)
surfaceanalysis = SurfaceAnalysis(ThermalModel=networker)  # -> Facade, Partition, Ceiling, Roof, ExternalFloor, Floor, Window, FaceID, IDLocation
glazingcreator = Honeybee_GlazingBasedOnRatio(HBObjects=mass2zone.HBZones, glzRatio=Slider(0.5, range=0..1), runIt=toggle)  # -> readMe, HBObjWGLZ; plug-in component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
brep_4 = Brep(surfaceanalysis.Window)
run_e = TakesThermalModelAndRunsEnergyPlus(
    ThermalModel=networker,
    ProjectName="MultiZone",
    WorkingDirectory="C:\ArchsimResults\MultiZone",
    WeatherFile="USA_MA_Boston-Logan.Intl.AP.725090_TMY3",
    StartsTheSimulation=Button(),
    settings="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")  # -> ThermalModel, SettingsAsFormatedString
load_zone_results = LoadZoneResults(ThermalModel=run_e.ThermalModel, Toggle=Toggle(True), settings="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")  # -> flatten(ZoneGeometry), ResultsPerZone, Labels, Guid, Name
ma = MassAddition(Input=load_zone_results.ResultsPerZone)  # -> flatten(Result), PartialResults
bnd = Bounds(Numbers=ma.Result)
dedomain = DeconstructDomain(Domain=bnd)  # -> Start, End
gradient = Gradient(
    LowerLimit=dedomain.End,
    UpperLimit=dedomain.Start,
    Parameter=ma.Result,
    stops=[0: RGB(234, 38, 0), 0.25: RGB(234, 126, 0), 0.5: RGB(254, 244, 84), 0.75: RGB(173, 203, 249), 1: RGB(75, 107, 169)])
panel = Panel(load_zone_results.ZoneGeometry)
panel_2 = Panel(ma.Result)
preview = CustomPreview(Geometry=load_zone_results.ZoneGeometry, Shader=gradient)
