# Grasshopper definition bibil_trial_066.gh (Grasshopper 0.9.76)
# plug-ins: Python Interpreter

# ---- group: find directory
bibil = PythonScript(run=Toggle(True))  # -> dir
# ---------- bibil: Python ----------
import os

ghenv.Component.Params.Output[0].Name = "null"
ghenv.Component.Params.Output[0].NickName = "null"

if run:
    try:
        directory = "C:\\Users\\vasanthakumars\\Documents\\GitHub\\bibil\\src"
        print os.listdir(directory)
    except:
        directory = "C:\\saeran\\master\\git\\bibil\\src"
        print os.listdir(directory)
    ghenv.Component.Params.Output[0].Name = "dir"
    ghenv.Component.Params.Output[0].NickName = "dir"
    dir = directory
null = None
# ---------- end bibil ----------

# ---- group: miru
# BIBIL_CLASSES
python_script = PythonScript(i=bibil)  # -> o
# ---------- python_script: Python ----------
import os

if i:
    o = os.path.join(str(i),"miru\\miru_miru.py")
# ---------- end python_script ----------
file = ReadFile(File=python_script, PerLineParse=False)
# FORM GENERATION
bibil_2 = PythonScript(Code=file)

# ---- group: grammar
python_script_2 = PythonScript(i=bibil)  # -> o
# ---------- python_script_2: Python ----------
import os

if i:
    o = os.path.join(str(i),"bibil\\bibil_rule.py")
# ---------- end python_script_2 ----------
file_2 = ReadFile(File=python_script_2, PerLineParse=False)
bibil_3 = PythonScript(Code=file_2)

# ---- group: pattern
python_script_3 = PythonScript(i=bibil)  # -> o
# ---------- python_script_3: Python ----------
import os

if i:
    o = os.path.join(str(i),"bibil\\bibil_pattern.py")
# ---------- end python_script_3 ----------
file_3 = ReadFile(File=python_script_3, PerLineParse=False)
bibil_4 = PythonScript(Code=file_3)

# ---- group: shape
python_script_4 = PythonScript(i=bibil)  # -> o
# ---------- python_script_4: Python ----------
import os

if i:
    o = os.path.join(str(i),"bibil\\bibil_shape.py")
#o = os.path.join(str(i),"research\\bibil_shape_shape_3d_2d.py")
# ---------- end python_script_4 ----------
file_4 = ReadFile(File=python_script_4, PerLineParse=False)
bibil_5 = PythonScript(Code=file_4)

# ---- group: tree
python_script_5 = PythonScript(i=bibil)  # -> o
# ---------- python_script_5: Python ----------
import os

if i:
    o = os.path.join(str(i),"bibil\\bibil_tree.py")
# ---------- end python_script_5 ----------
file_5 = ReadFile(File=python_script_5, PerLineParse=False)
bibil_6 = PythonScript(Code=file_5)

# ---- group: node_comp
python_script_6 = PythonScript(i=bibil)  # -> o
# ---------- python_script_6: Python ----------
import os

if i:
    o = os.path.join(str(i),"bibil\\bibil_plain.py")
# ---------- end python_script_6 ----------
file_6 = ReadFile(File=python_script_6, PerLineParse=False)

# ---- group: grammar_divide
python_script_7 = PythonScript(i=bibil)  # -> o
# ---------- python_script_7: Python ----------
import os

if i:
    o = os.path.join(str(i),"miru\\miru_divide.py")
# ---------- end python_script_7 ----------
file_7 = ReadFile(File=python_script_7, PerLineParse=False)

# ---- group: grammar_tower
python_script_8 = PythonScript(i=bibil)  # -> o
# ---------- python_script_8: Python ----------
import os

if i:
    o = os.path.join(str(i),"miru\\miru_packing.py")
# ---------- end python_script_8 ----------
file_8 = ReadFile(File=python_script_8, PerLineParse=False)

# ---- group: grammar_courtyard
python_script_9 = PythonScript(i=bibil)  # -> o
# ---------- python_script_9: Python ----------
import os

if i:
    o = os.path.join(str(i),"miru\\miru_court.py")
# ---------- end python_script_9 ----------
file_9 = ReadFile(File=python_script_9, PerLineParse=False)

# ---- group: grammar_tower
python_script_10 = PythonScript(i=bibil)  # -> o
# ---------- python_script_10: Python ----------
import os

if i:
    o = os.path.join(str(i),"miru\\miru_stepback.py")
# ---------- end python_script_10 ----------
file_10 = ReadFile(File=python_script_10, PerLineParse=False)

# ---- group: grammar_height
python_script_11 = PythonScript(i=bibil)  # -> o
# ---------- python_script_11: Python ----------
import os

if i:
    o = os.path.join(str(i),"miru\\miru_height.py")
# ---------- end python_script_11 ----------
file_11 = ReadFile(File=python_script_11, PerLineParse=False)

# ----
list = ValueList({"divide by depth": "subdivide_depth", "divide by same depth": "subdivide_depth_same", "divide by dim": "subdivide_dim"}, selected="divide by depth")
list_2 = ValueList({"YZ": "NS", "XZ": "EW", "XY": "Z"}, selected="XZ")
bibil_7 = PythonScript(
    Code=file_7,
    Divide_num=Slider(0, range=0..10),
    Divide_cut=Slider(10, range=0..100),
    Divide_type=list,
    Divide_ratio=Slider(0.5, range=0..1),
    Axis=list_2,
    Run=Toggle(True))
geo = Geometry(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)
geo_2 = Geometry(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)
geo_3 = Geometry(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)
trinco_park = PythonScript(Code=file_6, Rule_in=bibil_7, Node_in=geo_3, Label_="street", Run=Toggle(True))  # -> Node_out, Debug
g = PythonScript(node=trinco_park.Node_out)  # -> geom; inputs node: list
# ---------- g: Python ----------
if node and node != []:
    geom = []
    #lot_lst = node.traverse_tree(lambda n:n,internal=False)
    for n in node:
        geom.append(n.data.shape.bottom_crv)
    print geom
# ---------- end g ----------
# PODIUM GRAMMAR
number_slider = Slider(20, range=0..100)
geo_4 = Geometry(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)

# ---- group: COURTYARD
miru = PythonScript(Code=file_9, Podium_depth=Slider(30, range=0..100), Node_depth=Slider(1, range=-1..1), Run=Toggle(True))

# ---- group: SETBACK/STEPBACK
miru_2 = PythonScript(
    Code=file_10,
    Height=Slider(7, range=0..100),
    Distance=Slider(9, range=0..10),
    Geom_ref=geo_4,
    Node_ref="-1",
    Run=Toggle(False))

# ----
# TOWER GRAMMAR
toggle = BooleanToggle(False)

# ---- group: HEIGHT
miru_3 = PythonScript(Code=file_11, Height=number_slider, Run=Toggle(True))

# ---- group: COURTYARD
miru_4 = PythonScript(Code=file_9, Podium_depth=Slider(5, range=0..100), Node_depth=Slider(1, range=-1..1), Run=Toggle(True))

# ---- group: PACKING
bibil_8 = PythonScript(Code=file_8, Run=toggle)

# ----
toggle_2 = BooleanToggle(True)
trinco_park_2 = PythonScript(rule_in=bibil_8, node_in=trinco_park.Node_out, label="tower", run=Toggle(False))  # -> node_out, debug; inputs rule_in: list, node_in: list, run: Boolean
# ---------- trinco_park_2: Python ----------
"""
Bibil plain
"""

import rhinoscriptsyntax as rs
import Rhino as rc
from Rhino import RhinoApp
import scriptcontext as sc
import copy

## Import classes
Pattern = sc.sticky["Pattern"]
Shape_3D = sc.sticky["Shape_3D"]
Tree = sc.sticky["Tree"] 
Grammar = sc.sticky["Grammar"]

def copy_node_lst(nlst):
    L = []
    for n in nlst:
        L.append(copy.deepcopy(n))
    return L

def make_node_lst(copy_node_in_): 
    L = []
    P = Pattern()
    ref_geom = rs.coercebrep(rs.AddBox([[0,0,0],[0,1,0],[-1,1,0],[-1,0,0],\
                                        [0,0,1],[0,1,1],[-1,1,1],[-1,0,1]]))
    ref_shape = Shape_3D(ref_geom,cplane=None)
    ref_grammar = Grammar(ref_shape)
    ref_node = Tree(ref_grammar,parent=None,depth=0)
    
    for node_geom in copy_node_in_:
        if type(ref_node) == type(node_geom):
            n_ = node_geom
        else:
            n_ = P.helper_geom2node(node_geom,None,label=label_)
        L.append(n_)
    return L

def node2pattern(lst_node_,rule_in_):
    def type2node(copy_node_,type_):
        #type: list of (dictionary of typology parameters)
        copytype = copy.deepcopy(type_)
        copy_node_.data.type.update(copytype)
        return copy_node_
    ## Purpose: Input list of nodes, applies type
    ## Applies pattern based on types
    ## outputs node    
    P = Pattern()
    NL = []
    for node_ in lst_node_:
        ## Apply type to node
        node_ = type2node(node_,rule_in_)
        ## Apply pattern
        if True:#try:
            node_out_ = P.main_pattern(node_)
            nlst = node_out_.traverse_tree(lambda n:n,internal=False)
            NL.extend(nlst)
            #NL.append(node_out)
            print nlst
            RhinoApp.Wait()
        #except Exception as e:
        #    print "Error @ Pattern.main_pattern"
    return NL

def main(node_in_,rule_in):
    ### Grid_Subdivide: (listof node) int int -> (listof node))
    node_in_ = copy_node_lst(node_in_)     
    lst_node = make_node_lst(node_in_)
    lst_node = node2pattern(lst_node,rule_in)
    return lst_node

node_in = filter(lambda n: n!=None,node_in)
if run and node_in != []:
    sc.sticky["debug"] = []
    debug = sc.sticky["debug"]
    rule_in = rule_in[0]
    node_out = main(node_in,rule_in)
else:
    print 'Add inputs!'
# ---------- end trinco_park_2 ----------
bibil_9 = PythonScript(Code=file_6, Rule_in=[miru_3, miru, miru_2, miru_4], Node_in=trinco_park.Node_out, Label_="podium", Run=toggle_2)  # -> Node_out, Debug
g_2 = PythonScript(node=trinco_park_2.node_out)  # -> geom
# ---------- g_2: Python ----------
if node:
    geom = []
    lot_lst = node.traverse_tree(lambda n:n,internal=False)
    for n in lot_lst:
        if n.data.shape.x_dist < 23. or n.data.shape.y_dist < 23. or n.data.shape.get_area() < 615.:
            pass
        else:
            n.data.shape.op_extrude(90.)
            geom.append(n.data.shape.geom)
    print geom
# ---------- end g_2 ----------
g_3 = PythonScript(node=bibil_9.Node_out)  # -> geom
# ---------- g_3: Python ----------
if node:
    geom = []
    lot_lst = node.traverse_tree(lambda n:n,internal=False)
    for n in lot_lst:
        geom.append(n.data.shape.geom)
    print geom
# ---------- end g_3 ----------
number_slider_2 = Slider(0.5, range=0..1)  # disabled
number_slider_3 = Slider(3, range=0..10)  # disabled
number_slider_4 = Slider(0.5, range=0..1)  # disabled
number_slider_5 = Slider(0, range=0..100)  # disabled
number_slider_6 = Slider(0, range=0..100)  # disabled
number_slider_7 = Slider(10, range=0..10)  # disabled
number_slider_8 = Slider(1000, range=0..1000)  # disabled
list_3 = ValueList({"divide by depth": "subdivide_depth", "divide by same depth": "subdivide_depth_same", "divide by dim": "subdivide_dim"}, selected="divide by dim")  # disabled
list_4 = ValueList({"divide by depth": "subdivide_depth", "divide by same depth": "subdivide_depth_same", "divide by dim": "subdivide_dim"}, selected="divide by same depth")  # disabled
toggle_3 = BooleanToggle(False)  # disabled
toggle_4 = BooleanToggle(False)  # disabled
list_5 = ValueList({"YZ": "NS", "XZ": "EW", "XY": "Z"}, selected="XZ")  # disabled
list_6 = ValueList({"YZ": "NS", "XZ": "EW", "XY": "Z"}, selected="XY")  # disabled
bibil_10 = PythonScript(
    Code=file_7,
    Divide_num=number_slider_3,
    Divide_cut=number_slider_6,
    Divide_type=list_4,
    Divide_ratio=number_slider_4,
    Axis=list_6,
    Run=toggle_4)  # disabled
bibil_11 = PythonScript(
    Code=file_7,
    Divide_num=[number_slider_8, number_slider_7],
    Divide_cut=number_slider_5,
    Divide_type=list_3,
    Divide_ratio=number_slider_2,
    Axis=list_5,
    Run=toggle_3)  # disabled
panel = Panel("floors")  # disabled
bibil_12 = PythonScript(Code=file_6, Rule_in=[bibil_10, bibil_11], Node_in=bibil_9.Node_out, Label_=panel, Run=toggle_2)  # -> Node_out, Debug; disabled
g_4 = PythonScript(node=bibil_12.Node_out)  # -> geom; disabled; same code as g_3
wires = BrepWireframe(Brep=g_4, Density=-1)  # disabled
