# Grasshopper definition bibil_trial_069.gh (Grasshopper 0.9.76)
# plug-ins: Python Interpreter, Human, Mosquito

list = ValueList({"dir", "file"}, selected="dir")

# ---- group: find directory
bibil = PythonScript(
    dir=["C:\\Users\\vasanthakumars\\Documents\\GitHub\\bibil\\src", "C:\\saeran\\master\\git\\bibil\\src"],
    type=list,
    run=Toggle(True))  # -> dir; inputs dir: list
# ---------- bibil: Python ----------
import os

ghenv.Component.Params.Output[0].Name = "null"
ghenv.Component.Params.Output[0].NickName = "null"

if run:
    confirm_dir = None
    for d in dir:
        try:
            if type == "file":
                file_ = open(d)
                file_.close()
            else:
                print os.listdir(d)
            confirm_dir = d
            break
        except Exception as e:
            #print str(e)
            continue
    if confirm_dir != None:
        ghenv.Component.Params.Output[0].Name = type
        ghenv.Component.Params.Output[0].NickName = type
        dir = confirm_dir
        file = confirm_dir
null = None
# ---------- end bibil ----------

# ---- group: miru
# BIBIL_CLASSES
python_script = PythonScript(i=bibil)  # -> o
# ---------- python_script: Python ----------
import os

if i:
    o = os.path.join(str(i),"miru\\miru_miru.py")
# ---------- end python_script ----------
file = ReadFile(File=python_script, PerLineParse=False)
bibil_2 = PythonScript(Code=file)

# ---- group: grammar
python_script_2 = PythonScript(i=bibil)  # -> o
# ---------- python_script_2: Python ----------
import os

if i:
    o = os.path.join(str(i),"bibil\\bibil_rule.py")
# ---------- end python_script_2 ----------
file_2 = ReadFile(File=python_script_2, PerLineParse=False)
bibil_3 = PythonScript(Code=file_2)

# ---- group: pattern
python_script_3 = PythonScript(i=bibil)  # -> o
# ---------- python_script_3: Python ----------
import os

if i:
    o = os.path.join(str(i),"bibil\\bibil_pattern.py")
# ---------- end python_script_3 ----------
file_3 = ReadFile(File=python_script_3, PerLineParse=False)
bibil_4 = PythonScript(Code=file_3)

# ---- group: shape
python_script_4 = PythonScript(i=bibil)  # -> o
# ---------- python_script_4: Python ----------
import os

if i:
    o = os.path.join(str(i),"bibil\\bibil_shape.py")
#o = os.path.join(str(i),"research\\bibil_shape_shape_3d_2d.py")
# ---------- end python_script_4 ----------
file_4 = ReadFile(File=python_script_4, PerLineParse=False)
bibil_5 = PythonScript(Code=file_4)

# ---- group: tree
python_script_5 = PythonScript(i=bibil)  # -> o
# ---------- python_script_5: Python ----------
import os

if i:
    o = os.path.join(str(i),"bibil\\bibil_tree.py")
# ---------- end python_script_5 ----------
file_5 = ReadFile(File=python_script_5, PerLineParse=False)
bibil_6 = PythonScript(Code=file_5)

# ---- group: bula
python_script_6 = PythonScript(i=bibil)  # -> o
# ---------- python_script_6: Python ----------
import os

if i:
    o = os.path.join(str(i),"bula\\bula_minimal.py")
# ---------- end python_script_6 ----------
file_6 = ReadFile(File=python_script_6, PerLineParse=False)

# ---- group: node_comp
python_script_7 = PythonScript(i=bibil)  # -> o
# ---------- python_script_7: Python ----------
import os

if i:
    o = os.path.join(str(i),"bibil\\bibil_UI.py")
# ---------- end python_script_7 ----------
file_7 = ReadFile(File=python_script_7, PerLineParse=False)

# ---- group: grammar_divide
python_script_8 = PythonScript(i=bibil)  # -> o
# ---------- python_script_8: Python ----------
import os

if i:
    o = os.path.join(str(i),"miru\\miru_divide.py")
# ---------- end python_script_8 ----------
file_8 = ReadFile(File=python_script_8, PerLineParse=False)

# ---- group: grammar_courtyard
python_script_9 = PythonScript(i=bibil)  # -> o
# ---------- python_script_9: Python ----------
import os

if i:
    o = os.path.join(str(i),"miru\\miru_court.py")
# ---------- end python_script_9 ----------
file_9 = ReadFile(File=python_script_9, PerLineParse=False)

# ---- group: grammar_tower
python_script_10 = PythonScript(i=bibil)  # -> o
# ---------- python_script_10: Python ----------
import os

if i:
    o = os.path.join(str(i),"miru\\miru_packing.py")
# ---------- end python_script_10 ----------
file_10 = ReadFile(File=python_script_10, PerLineParse=False)

python_script_11 = PythonScript(i=bibil)  # -> o
# ---------- python_script_11: Python ----------
import os

if i:
    o = os.path.join(str(i),"miru\\miru_stepback.py")
# ---------- end python_script_11 ----------
file_11 = ReadFile(File=python_script_11, PerLineParse=False)

# ---- group: grammar_height
python_script_12 = PythonScript(i=bibil)  # -> o
# ---------- python_script_12: Python ----------
import os

if i:
    o = os.path.join(str(i),"miru\\miru_height.py")
# ---------- end python_script_12 ----------
file_12 = ReadFile(File=python_script_12, PerLineParse=False)

# ----
# Note: Change this number with caution,
# Increase bounds iterratively.
panel = Panel("0.004")  # disabled

panel_2 = Panel("Yonge and Eglinton")  # disabled
panel_3 = Panel("Redpath Avenue and Roehampton Avenue")  # disabled
location = MosquitoLocation(Location=panel_3)  # -> Address, Points, Type; disabled
item = ListItem(List=location.Points, Index=0, Wrap=True)  # disabled
toggle = BooleanToggle(True)  # disabled
toggle_2 = BooleanToggle(True)  # disabled
toggle_3 = BooleanToggle(True)  # disabled
toggle_4 = BooleanToggle(True)  # disabled
circle = CircleCNR(Center=item, Normal=Vector(0, 0, 1), Radius=panel)  # disabled
vector_maps = VectorMaps(Area=circle, AllRoads=toggle, Buildings=toggle_2, ReProject=toggle_3, CenterToWorld=toggle_4)  # -> RoadLines, RoadInfo, BuildingLines, BuildingInfo, BuildingHeights, AmenityLines, AmenityInfo, AmenityPoints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; disabled
swatch = ColourSwatch(SwatchColor=RGB(0, 0, 0))  # disabled
geo = Geometry([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])  # disabled
geo_2 = Geometry([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])  # disabled
geo_3 = Geometry(Tree({0}: [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], {1}: [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], {2}: [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], {3}: [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], {4}: [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], {5}: [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]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))  # disabled
geo_4 = Geometry([vector_maps.BuildingLines, vector_maps.RoadLines, vector_maps.AmenityLines])  # disabled
preview = CustomPreview(Geometry=[geo_3, geo_2, geo], Shader=swatch)  # disabled

geo_5 = Geometry([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])
geo_6 = Geometry([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])
geo_7 = Geometry([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])
preview_2 = CustomPreview(
    Geometry=geo_7,
    Shader={ambient=RGB(0, 0, 0), diffuse=RGB(255, 105, 180), emission=RGB(76, 32, 54), shine=0.5, specular=RGB(255, 255, 255), transparency=0})
preview_3 = CustomPreview(Geometry=[geo_6, geo_5], Shader=ColourSwatch(SwatchColor=RGB(0, 0, 0)))

geo_8 = Geometry([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])
bibil_7 = PythonScript(Code=file_7, Child_node_in=geo_8, Label_="floor", Run=Toggle(True))  # -> Node_out, Debug
g = PythonScript(node=bibil_7.Node_out)  # -> geom
# ---------- g: Python ----------
if node:
    geom = []
    lot_lst = node.traverse_tree(lambda n:n,internal=False)
    for n in lot_lst:
        geom.append(n.data.shape.bottom_crv)
    #print geom
# ---------- end g ----------
g_2 = PythonScript(node=bibil_7.Node_out)  # -> ht
# ---------- g_2: Python ----------
if node:
    ht = []
    lot_lst = node.traverse_tree(lambda n:n,internal=False)
    for n in lot_lst:
        ht.append(n.data.shape.ht)
    print ht
# ---------- end g_2 ----------
Z = UnitZ(Factor=g_2)
boundary = BoundarySurfaces(Edges=g)
list_2 = ValueList({"divide by depth": "subdivide_depth", "divide by same depth": "subdivide_depth_same", "divide by dim": "subdivide_dim"}, selected="divide by depth")
extr = Extrude(Base=boundary, Direction=Z)  # -> flatten(Extrusion)
list_3 = ValueList({"YZ": "NS", "XZ": "EW", "XY": "Z"}, selected="XZ")

# ---- group: DIVIDE
bibil_8 = PythonScript(
    Code=file_8,
    Divide_num=Slider(1, range=0..10),
    Divide_cut=Slider(0, range=0..100),
    Divide_type=list_2,
    Divide_ratio=Slider(0.5, range=0..1),
    Axis=list_3,
    Run=Toggle(False))

# ----
geo_9 = Geometry([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])
ladybug = Ladybug_Ladybug()  # -> Vviiiiiiiiiizzz; plug-in component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
number_slider = Slider(0, range=0..100)  # disabled
honeybee = Honeybee_Honeybee()  # -> Vviiiiiiiiiizzz; plug-in component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

# ---- group: Office
geo_10 = Geometry([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])  # disabled

# ----
createhbsrfs = Honeybee_createHBSrfs()  # -> readMe, simplify(HBSurface); disabled; plug-in component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
panel_4 = Panel("Ground")  # disabled
toggle_5 = BooleanToggle(False)  # disabled
hb_epcontextsrf = HoneybeeEPContextSurfaces()  # -> HBContext; inputs shdSurfaces: list of Brep, justBoundingBox: Boolean; disabled
# ---------- hb_epcontextsrf: Python ----------
"""
prepare shading/context geometries

    Args:
        northVectorOrRotation: A vector that shows North or a number that shows
                               the rotation of the North from the Y axis
        bldgMasses: List of closed Breps as thermal zones.
    Returns:
        report: ...
        thermalZones: Thermal zone's geometries for visualiza
"""

ghenv.Component.Name = 'Honeybee EP context Surfaces'
ghenv.Component.NickName = 'HB_EPContextSrf'
ghenv.Component.Message = 'VER 0.0.60\nAUG_10_2016'
ghenv.Component.IconDisplayMode = ghenv.Component.IconDisplayMode.application
ghenv.Component.Category = "Honeybee"
ghenv.Component.SubCategory = "10 | Energy | Energy"
#compatibleHBVersion = VER 0.0.57\nNOV_01_2015
#compatibleLBVersion = VER 0.0.59\nFEB_01_2015
ghenv.Component.AdditionalHelpFromDocStrings = "2"

import rhinoscriptsyntax as rs
import Rhino as rc
import scriptcontext as sc
import os
import System
import Grasshopper.Kernel as gh
import uuid

tolerance = sc.doc.ModelAbsoluteTolerance
import math


def main(shdSurfaces, EPTransSchedule, meshingSettings, justBoundingBox):
    
    # import the classes
    if sc.sticky.has_key('honeybee_release'):

        try:
            if not sc.sticky['honeybee_release'].isCompatible(ghenv.Component): return -1
            if sc.sticky['honeybee_release'].isInputMissing(ghenv.Component): return -1
        except:
            warning = "You need a newer version of Honeybee to use this compoent." + \
            " Use updateHoneybee component to update userObjects.\n" + \
            "If you have already updated userObjects drag Honeybee_Honeybee component " + \
            "into canvas and try again."
            w = gh.GH_RuntimeMessageLevel.Warning
            ghenv.Component.AddRuntimeMessage(w, warning)
            return -1
        
        # don't customize this part
        hb_EPSrf = sc.sticky["honeybee_EPSurface"]
        hb_EPSHDSurface = sc.sticky["honeybee_EPShdSurface"]
        hb_RADMaterialAUX = sc.sticky["honeybee_RADMaterialAUX"]
        hb_EPObjectsAux = sc.sticky["honeybee_EPObjectsAUX"]()
        HBScheduleList = sc.sticky["honeybee_ScheduleLib"].keys()

        ########################################################################
        #----------------------------------------------------------------------#
        shdBreps = []
        # create bounding box of shading geometries
        if justBoundingBox:
            for brep in shdSurfaces:
                if brep.Faces.Count>1 or not brep.Faces[0].IsPlanar(sc.doc.ModelAbsoluteTolerance):
                    shdBreps.append(brep.GetBoundingBox(True).ToBrep())
                else:
                    shdBreps.append(brep)
        else:
            shdBreps = shdSurfaces
        
        shadingClasses = []
        shadingMeshPreview = []
        
        if meshingSettings == None:
            mp = rc.Geometry.MeshingParameters.Minimal
            mp.SimplePlanes = True
        else:
            mp = meshingSettings
        
        def getRadMaterialName(radMaterial):
            nameStr = radMaterial.split(" ")[2]
            name =  nameStr.split("\n")[0]
            return name
        
        for brepCount, brep in enumerate(shdBreps):
            if brep != None:
                isPlanar = True
                # check planarity
                for face in brep.Faces:
                    if not face.IsPlanar(tolerance):
                        isPlanar = False
                        break
                
                shadingBreps = []
                if not isPlanar:
                    meshArray = rc.Geometry.Mesh.CreateFromBrep(brep, mp)
                    for mesh in meshArray:
                        for meshFace in range(mesh.Faces.Count):
                            vertices = list(mesh.Faces.GetFaceVertices(meshFace))[1:]
                            vertices = vertices + [sc.doc.ModelAbsoluteTolerance]
                            # create the brep from mesh
                            shdBrep = rc.Geometry.Brep.CreateFromCornerPoints(*vertices)
                            shadingBreps.append(shdBrep)
                else:
                    for face in brep.Faces:
                        shadingBreps.append(face.DuplicateFace(False))
                
                for faceCount, shdBrep in enumerate(shadingBreps):
                        thisShading = hb_EPSHDSurface(shdBrep, 1000*brepCount + faceCount, 'shdSrf_' + `brepCount` + '_' + `faceCount` + "_" + str(uuid.uuid4()))
                        
                        # add transmittance schedule if any
                        if EPTransSchedule!=None:
                            schedule= EPTransSchedule.upper()
                            if schedule!=None and not schedule.lower().endswith(".csv") and schedule not in HBScheduleList:
                                msg = "Cannot find " + schedule + " in Honeybee schedule library."
                                print msg
                                ghenv.Component.AddRuntimeMessage(gh.GH_RuntimeMessageLevel.Warning, msg)
                                return -1
                            elif schedule!=None and schedule.lower().endswith(".csv"):
                                # check if csv file is existed
                                if not os.path.isfile(schedule):
                                    msg = "Cannot find the shchedule file: " + schedule
                                    print msg
                                    ghenv.Component.AddRuntimeMessage(gh.GH_RuntimeMessageLevel.Warning, msg)
                                    return -1
                            
                            thisShading.TransmittanceSCH = schedule
                        
                        # add the Rad Material if any
                        if RADMaterial!=None:
                            # if it is just the name of the material make sure it is already defined
                            if len(RADMaterial.split(" ")) == 1:
                                # if the material is not in the library add it to the library
                                if not hb_RADMaterialAUX.isMatrialExistInLibrary(RADMaterial):
                                    warningMsg = "Can't find " + RADMaterial + " in RAD Material Library.\n" + \
                                                "Add the material to the library and try again."
                                    ghenv.Component.AddRuntimeMessage(gh.GH_RuntimeMessageLevel.Warning, warningMsg)
                                    return
                                
                                try:
                                    thisShading.setRADMaterial(RADMaterial)
                                except Exception, e:
                                    print e
                                    warningMsg = "You are using an old version of Honeybee_Honeybee! Update your files and try again."
                                    print warningMsg
                                    ghenv.Component.AddRuntimeMessage(gh.GH_RuntimeMessageLevel.Warning, warningMsg)
                                    return
                                
                                addedToLib = True
                            else:
                                
                                # try to add the material to the library
                                addedToLib, thisShading.RadMaterial = hb_RADMaterialAUX.analyseRadMaterials(RADMaterial, True)
                                
                            if addedToLib==False:
                                warningMsg = "Failed to add " + RADMaterial + " to the Library."
                                ghenv.Component.AddRuntimeMessage(gh.GH_RuntimeMessageLevel.Warning, warningMsg)
                                return
                        
                        # add shading to the list
                        shadingClasses.append(thisShading)
                
        # add to the hive
        hb_hive = sc.sticky["honeybee_Hive"]()
        HBContext  = hb_hive.addToHoneybeeHive(shadingClasses, ghenv.Component.InstanceGuid.ToString())
        return HBContext
        ################################################################################################
    else:
        print "You should first let Honeybee to fly..."
        w = gh.GH_RuntimeMessageLevel.Warning
        ghenv.Component.AddRuntimeMessage(w, "You should first let Honeybee to fly...")
        return -1
        

if _shdSurfaces and _shdSurfaces[0]!=None:
    # add cleaning function
    result= main(_shdSurfaces, EPTransSchedule_, meshingSettings_, justBoundingBox_)
    
    if result != -1: HBContext = result
# ---------- end hb_epcontextsrf ----------
hb_epcontextsrf_2 = HoneybeeEPContextSurfaces()  # -> HBContext; inputs shdSurfaces: list of Brep, justBoundingBox: Boolean; disabled; same code as hb_epcontextsrf
createhbzones = Honeybee_createHBZones(name=panel_4, HBSurfaces=flatten(createhbsrfs.HBSurface), isConditioned=toggle_5)  # -> readMe, HBZone; disabled; plug-in component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
panel_5 = Panel("4")  # disabled
createepground = Honeybee_CreateEPGround(HBZones=createhbzones.HBZone, soilTypeOrMat=panel_5)  # -> HBGrndZones; disabled; plug-in component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

listzoneprograms = Honeybee_ListZonePrograms(bldgProgram=Slider(1, range=0..100))  # -> RetailZonePrograms; plug-in component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
number_slider_2 = Slider(3, range=0..10)
listzoneprograms_2 = Honeybee_ListZonePrograms(bldgProgram=number_slider)  # -> OfficeZonePrograms; disabled; plug-in component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

# ---- group: Residential
geo_11 = Geometry([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])

# ----
num = Number(3)
listzoneprograms_3 = Honeybee_ListZonePrograms(bldgProgram=Slider(2, range=0..100))  # -> MidriseApartmentZonePrograms; plug-in component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
splitmass = Honeybee_SplitBuildingMass(bldgMasses=extr, bldgsFlr2FloorHeights="@3", runIt=Toggle(True))  # -> readMe, splitBldgMasses; plug-in component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
num_2 = Number(4)  # disabled
item_2 = ListItem(List=listzoneprograms, Index=num, Wrap=True)

# ---- group: Retail
data = Data()

# ----
item_3 = ListItem(List=listzoneprograms_2, Index=num_2, Wrap=True)  # disabled

# ---- group: Office
data_2 = Data()  # disabled

# ----
num_3 = Number(9)
geo_12 = Geometry(splitmass.splitBldgMasses)
item_4 = ListItem(List=listzoneprograms_3, Index=num_3, Wrap=True)
toggle_6 = BooleanToggle(True)
mass2zone = Honeybee_Masses2Zones(
    zoneMasses=flatten(splitmass.splitBldgMasses),
    zonePrograms=item_4,
    isConditioned=True,
    maxRoofAngle=30,
    createHBZones=toggle_6)  # -> readMe, HBZones; plug-in component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
concat = Concatenate(FragmentA="2", FragmentB="window", JoinSeparator=" ")
concat_2 = Concatenate(FragmentA="2")
callfromepconstrlibrary = Honeybee_CallFromEPConstructionLibrary(keywords=concat_2)  # -> ThermMaterials, EPMaterials, EPWindowMaterials, EPConstructions; plug-in component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
callfromepconstrlibrary_2 = Honeybee_CallFromEPConstructionLibrary(keywords=concat)  # -> ThermMaterials, EPMaterials, EPWindowMaterials, EPConstructions; plug-in component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
solveadjc = Honeybee_SolveAdjacencies(HBZones=flatten(mass2zone.HBZones), removeCurrentAdjc=False, findAdjc=Toggle(True))  # -> readMe, HBZonesWADJ; plug-in component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
glzparamlist = Honeybee_GlazingParametersList(northGlzParam="0.3", westGlzParam="0.3", southGlzParam="0.3", eastGlzParam="0.3")  # -> glzParamList; plug-in component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
item_5 = ListItem(List=callfromepconstrlibrary.EPConstructions, Index=198, Wrap=True)
item_6 = ListItem(List=callfromepconstrlibrary_2.EPConstructions, Index=44, Wrap=True)
panel_6 = Panel(item_6)
panel_7 = Panel(item_5)
glazingcreator = Honeybee_GlazingBasedOnRatio(HBObjects=solveadjc.HBZonesWADJ, glzRatio=glzparamlist, breakUpWindow=Toggle(False), runIt=toggle_6)  # -> readMe, HBObjWGLZ; plug-in component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
setepzonecnstr = Honeybee_SetEPZoneConstruction(HBZone=glazingcreator.HBObjWGLZ, wallEPConstruction=item_5, windowEPConstruction=item_6)  # -> simplify(modifiedHBZone); plug-in component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
geo_13 = Geometry(setepzonecnstr)
toggle_7 = BooleanToggle(True)
epoutput = Honeybee_GenerateEPOutput(
    zoneEnergyUse=toggle_7,
    zoneGainsAndLosses=toggle_7,
    zoneComfortMetrics="False",
    comfortMapVariables=toggle_7,
    zoneHVACParams=toggle_7,
    surfaceTempAnalysis=toggle_7,
    surfaceEnergyAnalysis=toggle_7,
    glazingSolarAnalysis=toggle_7,
    timestep="annual")  # -> report, flatten(simulationOutputs); plug-in component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
panel_8 = Panel("C:\Users\vasanthakumars\Desktop\temp_folder")
toggle_8 = BooleanToggle(False)
path = FilePath("C:\Users\vasanthakumars\AppData\Roaming\Ladybug\section_test\OpenStudio\section_test\ModelToIdf\in.csv")
readepsrfresult = Honeybee_ReadEPSurfaceResult(resultFileAddress=path)  # -> surfaceIndoorTemp, surfaceOutdoorTemp, surfaceEnergyFlow, opaqueEnergyFlow, glazEnergyFlow, windowTotalSolarEnergy, windowBeamEnergy, windowDiffEnergy, windowTransmissivity, port; plug-in component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
readepresult = Honeybee_ReadEPResult(resultFileAddress=path)  # -> totalThermalLoad, thermalLoadBalance, cooling, heating, electricLight, electricEquip, port, port_2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; plug-in component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
data_3 = Data(flatten(setepzonecnstr))
colorzones = Honeybee_ColorZonesByEPResult(zoneData=readepresult.thermalLoadBalance, HBZones=flatten(data_3), normalizeByFloorArea=Toggle(True), runIt=Toggle(True))  # -> readMe, zoneColoredMesh, zoneWireFrame, legend, legendBasePt, analysisTitle, zoneBreps, zoneColors, zoneValues, floorNormZoneData; plug-in component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
colorzones_2 = Honeybee_ColorZonesByEPResult(zoneData=readepresult.totalSolarGain, HBZones=flatten(data_3), normalizeByFloorArea=Toggle(True), runIt=Toggle(True))  # -> readMe, zoneColoredMesh, zoneWireFrame, legend, legendBasePt, analysisTitle, zoneBreps, zoneColors, zoneValues, floorNormZoneData; plug-in component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
decomposebytype = Honeybee_DecomposeBasedOnType(HBZone=data_3)  # -> walls, interiorWalls, airWalls, flatten(windows), interiorWindows, skylights, roofs, ceilings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; plug-in component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
wires = BrepWireframe(Brep=[decomposebytype.walls, decomposebytype.floors, decomposebytype.ceilings], Density=-1)
geo_14 = Geometry(decomposebytype.floors)
panel_9 = Panel(colorzones.floorNormZoneData)
panel_10 = Panel(colorzones_2.floorNormZoneData)
preview_4 = CustomPreview(Geometry=decomposebytype.windows, Shader=ColourSwatch(SwatchColor=RGB(158, 255, 255)))
preview_5 = CustomPreview(Geometry=wires, Shader=ColourSwatch(SwatchColor=RGBA(0, 0, 0, 122)))
preview_6 = CustomPreview(Geometry=geo_14, Shader=ColourSwatch(SwatchColor=RGBA(181, 181, 181, 122)))
geo_15 = Geometry(colorzones_2.zoneColoredMesh)
preview_7 = CustomPreview(Geometry=colorzones_2.zoneWireFrame, Shader=ColourSwatch(SwatchColor=RGB(0, 0, 0)))
geo_16 = Geometry([colorzones_2.analysisTitle, colorzones_2.legend])
geo_17 = Geometry(colorzones.zoneColoredMesh)
geo_18 = Geometry([colorzones.analysisTitle, colorzones.legend])
preview_8 = CustomPreview(Geometry=colorzones.zoneWireFrame, Shader=ColourSwatch(SwatchColor=RGB(0, 0, 0)))
list_4 = ValueList({"divide by depth": "subdivide_depth", "divide by same depth": "subdivide_depth_same", "divide by dim": "subdivide_dim"}, selected="divide by dim")
list_5 = ValueList({"YZ": "NS", "XZ": "EW", "XY": "Z"}, selected="YZ")

# ---- group: DIVIDE
bibil_9 = PythonScript(
    Code=file_8,
    Divide_num=[Slider(30, range=0..100000), Slider(100000, range=0..100000)],
    Divide_cut=Slider(0, range=0..100),
    Divide_type=list_4,
    Divide_ratio=Slider(0.5, range=0..1),
    Axis=list_5,
    Run=Toggle(True))

# ---- group: thermal_balance
data_4 = Data(colorzones.floorNormZoneData)

# ---- group: solar_gain
data_5 = Data(colorzones_2.floorNormZoneData)

# ----
geo_19 = Geometry(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)
trinco_park = PythonScript(Code=file_7, Rule_in=bibil_9, Child_node_in=geo_19, Label_="root", Run=Toggle(True))  # -> Node_out, Debug
g_3 = PythonScript(node=trinco_park.Node_out)  # -> geom; inputs node: list
# ---------- g_3: Python ----------
if node and node != []:
    geom = []
    #lot_lst = node.traverse_tree(lambda n:n,internal=False)
    for n in node:
        geom.append(n.data.shape.bottom_crv)
    print geom
# ---------- end g_3 ----------
g_4 = PythonScript(node=trinco_park.Node_out)  # -> geom; inputs node: list
# ---------- g_4: Python ----------
if node and node != []:
    geom = []
    #lot_lst = node.traverse_tree(lambda n:n,internal=False)
    for n in node:
        geom.append(n.data.shape.cpt)
    print len(geom)
    #print type(geom[0])
# ---------- end g_4 ----------
g_5 = PythonScript(node=trinco_park.Node_out)  # -> lst; inputs node: list
# ---------- g_5: Python ----------
if node and node != []:
    lst = []
    #lot_lst = node.traverse_tree(lambda n:n,internal=False)
    for n in node:
        lst.append([n])
    print len(lst)
    #print type(geom[0])
# ---------- end g_5 ----------
list_6 = ValueList({"divide by depth": "subdivide_depth", "divide by same depth": "subdivide_depth_same", "divide by dim": "subdivide_dim"}, selected="divide by dim")
list_7 = ValueList({"YZ": "NS", "XZ": "EW", "XY": "Z"}, selected="YZ")

# ---- group: DIVIDE
bibil_10 = PythonScript(
    Code=file_8,
    Divide_num=[Slider(100, range=0..100), Slider(6, range=0..100)],
    Divide_cut=Slider(0, range=0..100),
    Divide_type=list_6,
    Divide_ratio=Slider(0.5, range=0..1),
    Axis=list_7,
    Run=Toggle(True))

# ----
trinco_park_2 = PythonScript(Code=file_7, Rule_in=bibil_10, Child_node_in=g_3, Label_="bula", Run=Toggle(True))  # -> Node_out, Debug
g_6 = PythonScript(node=trinco_park_2.Node_out)  # -> geom; inputs node: list; same code as g_3

# ---- group: Section_List
sectionlst = PythonScript(node=trinco_park_2.Node_out)  # -> analysis_pts; inputs node: list
# ---------- sectionlst: Python ----------
import rhinoscriptsyntax as rs
import Rhino as rc
from Rhino import RhinoApp
import scriptcontext as sc
import copy

## Import classes
Pattern = sc.sticky["Pattern"]
Shape_3D = sc.sticky["Shape_3D"]
Tree = sc.sticky["Tree"] 
Grammar = sc.sticky["Grammar"]

chk_dic = {}
for n in node:
    root = n.get_root()
    cp = root.data.shape.cpt
    chk_str = str(int(cp[0])) + str(int(cp[1]))
    if not chk_dic.has_key(chk_str):
        chk_dic[chk_str] = [n.data.shape.cpt]
    else:
        chk_dic[chk_str].append(n.data.shape.cpt)

sectionlst = chk_dic.values()
analysis_pts = sectionlst
# ---------- end sectionlst ----------

# ----
bibil_11 = PythonScript(Code=file_7, Child_node_in=data_3, Label_="zones", Run=Toggle(True))  # -> Node_out, Debug
bibil_12 = PythonScript(Code=file_7, Child_node_in=extr, Label_="mass", Run=Toggle(True))  # -> Node_out, Debug
g_7 = PythonScript(node=bibil_12.Node_out)  # -> geom
# ---------- g_7: Python ----------
import rhinoscriptsyntax as rs
if node:
    geom = []
    lot_lst = node.traverse_tree(lambda n:n,internal=False)
    for n in lot_lst:
        geom.append(n.data.shape.geom)
    print geom
# ---------- end g_7 ----------
panel_11 = Panel(bibil_12.Node_out)
g_8 = PythonScript(node=bibil_11.Node_out)  # -> geom
# ---------- g_8: Python ----------
if node:
    geom = []
    lot_lst = node.traverse_tree(lambda n:n,internal=False)
    for n in lot_lst:
        geom.append(n.data.shape.geom)
    print geom
# ---------- end g_8 ----------
panel_12 = Panel(bibil_11.Node_out)
number_slider_3 = Slider(10, range=0..100)

# ---- group: unnest
python = PythonScript(val=data_4)  # -> val; inputs val: tree
# ---------- python: Python ----------
import scriptcontext as sc

Bula_Data = sc.sticky['BulaData']

if val:
    Bula = Bula_Data()
    val = Bula.ghtree2nestlist(val)
    val = map(lambda v: v[7],val)

print val
# ---------- end python ----------

python_2 = PythonScript(val=data_5)  # -> val; inputs val: tree; same code as python

# ----
panel_13 = Panel(data_4)
panel_14 = Panel(python)

# ---- group: Norm_Thermal
python_3 = PythonScript(
    Code=file_6,
    Analysis_pts=sectionlst,
    Values=python,
    Child_node_in=bibil_11.Node_out,
    Scale_=number_slider_3,
    Run=Toggle(True))  # -> Line, Debug

# ---- group: Solar_Gain
python_4 = PythonScript(
    Code=file_6,
    Analysis_pts=sectionlst,
    Values=python_2,
    Child_node_in=bibil_11.Node_out,
    Scale_=number_slider_3,
    Run=Toggle(True))  # -> Line, Debug

# ----
geo_20 = Geometry(python_3.Line)
geo_21 = Geometry(python_4.Line)
number_slider_4 = Slider(3, range=0..10)
Z_2 = UnitZ(Factor=Slider(3, range=0..10))
move = Move(Geometry=python_4.Line, Motion=Z_2)  # -> Geometry, Transform
previewlw = CustomPreviewLineweights(Geometry=python_3.Line, Shader=ColourSwatch(SwatchColor=RGB(255, 0, 255)), Thickness=number_slider_4, Absolute=False)
previewlw_2 = CustomPreviewLineweights(Geometry=move.Geometry, Shader=ColourSwatch(SwatchColor=RGB(0, 255, 255)), Thickness=number_slider_4, Absolute=False)

# ----
# LOT GRAMMAR
# TOWER GRAMMAR
# BUILDING GRAMMAR
number_slider_5 = Slider(1, range=0..10)  # disabled
number_slider_6 = Slider(0.5, range=0..1)  # disabled
number_slider_7 = Slider(9, range=0..100)  # disabled
list_8 = ValueList({"divide by depth": "subdivide_depth", "divide by same depth": "subdivide_depth_same", "divide by dim": "subdivide_dim"}, selected="divide by same depth")  # disabled
toggle_9 = BooleanToggle(False)  # disabled
list_9 = ValueList({"YZ": "NS", "XZ": "EW", "XY": "Z"}, selected="XZ")  # disabled
panel_16 = Panel("street")  # disabled
toggle_10 = BooleanToggle(True)  # disabled
geo_22 = Geometry(<curve referenced from the Rhino model>)  # disabled
explode = Explode(Curve=geo_22, Recursive=True)  # -> Segments, Vertices; disabled
geo_23 = Geometry(explode.Segments)  # disabled
number_slider_8 = Slider(21, range=0..100)  # disabled
number_slider_9 = Slider(1, range=-1..1)  # disabled
number_slider_10 = Slider(24, range=0..100)  # disabled
number_slider_11 = Slider(3, range=0..10)  # disabled
number_slider_12 = Slider(6, range=0..10)  # disabled
number_slider_13 = Slider(9, range=0..10)  # disabled
number_slider_14 = Slider(15, range=0..100)  # disabled
toggle_11 = BooleanToggle(True)  # disabled
toggle_12 = BooleanToggle(False)  # disabled
toggle_13 = BooleanToggle(True)  # disabled
toggle_14 = BooleanToggle(True)  # disabled
toggle_15 = BooleanToggle(False)  # disabled
panel_17 = Panel("-1")  # disabled
panel_18 = Panel("-1")  # disabled
panel_19 = Panel("podium")  # disabled
toggle_16 = BooleanToggle(False)  # disabled

# ---- group: DIVIDE
bibil_13 = PythonScript(
    Code=file_8,
    Divide_num=number_slider_5,
    Divide_cut=number_slider_7,
    Divide_type=list_8,
    Divide_ratio=number_slider_6,
    Axis=list_9,
    Run=toggle_9)  # disabled

# ---- group: COURTYARD
miru = PythonScript(Code=file_9, Podium_depth=number_slider_8, Node_depth=number_slider_9, Run=toggle_12)  # disabled

# ---- group: PACKING
bibil_14 = PythonScript(Code=file_10, Run=toggle_15)  # disabled

# ---- group: SETBACK/STEPBACK
miru_2 = PythonScript(Code=file_11, Height=number_slider_14, Distance=number_slider_12, Geom_ref=geo_23, Node_ref=panel_18, Run=toggle_14)  # disabled

# ---- group: HEIGHT
miru_3 = PythonScript(Code=file_12, Height=number_slider_10, Run=toggle_11)  # disabled

# ---- group: SETBACK/STEPBACK
miru_4 = PythonScript(Code=file_11, Height=number_slider_13, Distance=number_slider_11, Geom_ref=geo_23, Node_ref=panel_17, Run=toggle_13)  # disabled

# ----
trinco_park_3 = PythonScript(Code=file_7, Rule_in=bibil_13, Child_node_in=geo_22, Label_=panel_16, Run=toggle_10)  # -> Node_out, Debug; disabled
g_9 = PythonScript(node=trinco_park_3.Node_out)  # -> geom; inputs node: list; disabled; same code as g_3
bibil_15 = PythonScript(
    Code=file_7,
    Rule_in=[miru_3, miru, miru_4, miru_2],
    Child_node_in=trinco_park_3.Node_out,
    Label_=panel_19,
    Run=toggle_16)  # -> Node_out, Debug; disabled
g_10 = PythonScript(node=bibil_15.Node_out)  # -> geom; disabled; same code as g_8

panel_20 = Panel("C:\\Users\\vasanthakumars\\Documents\\GitHub\\bibil\\src\\reference\\CAN_ON_Toronto.716240_CWEC\\CAN_ON_Toronto.716240_CWEC.epw")
panel_21 = Panel("C:\saeran\master\git\bibil\src\reference\CAN_ON_Toronto.716240_CWEC\CAN_ON_Toronto.716240_CWEC.epw")
list_10 = ValueList({"dir", "file"}, selected="file")

# ---- group: find directory
bibil_16 = PythonScript(dir=[panel_21, panel_20], type=list_10, run=Toggle(True))  # -> file; inputs dir: list; same code as bibil

# ----
data_6 = Data(bibil_16)

exporttoopenstudio = Honeybee_ExportToOpenStudio(
    epwWeatherFile=bibil_16,
    HBZones=flatten(data_3),
    simulationOutputs=flatten(epoutput.simulationOutputs),
    writeOSM=toggle_8,
    runSimulation=toggle_8,
    fileName="section_test")  # -> readMe, osmFileAddress, idfFileAddress, resultsFileAddress, rddFileAddress, studyFolder; plug-in component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
