# Grasshopper definition bibil_trial_088_node_duplication_problem.gh (Grasshopper 0.9.76)
# plug-ins: Python Interpreter, Mosquito

list = ValueList({"dir", "file"}, selected="dir")

# ---- group: find directory
bibil = PythonScript(
    dir=["C:\\Users\\vasanthakumars\\Documents\\GitHub\\bibil\\src", "C:\\saeran\\master\\git\\bibil\\src"],
    type=list,
    run=Toggle(True))  # -> dir; inputs dir: list
# ---------- bibil: Python ----------
import os

ghenv.Component.Params.Output[0].Name = "null"
ghenv.Component.Params.Output[0].NickName = "null"

if run:
    confirm_dir = None
    for d in dir:
        try:
            if type == "file":
                file_ = open(d)
                file_.close()
            else:
                print os.listdir(d)
            confirm_dir = d
            break
        except Exception as e:
            #print str(e)
            continue
    if confirm_dir != None:
        ghenv.Component.Params.Output[0].Name = type
        ghenv.Component.Params.Output[0].NickName = type
        dir = confirm_dir
        file = confirm_dir
null = None
# ---------- end bibil ----------

# ---- group: tree
python_script = PythonScript(i=bibil)  # -> o
# ---------- python_script: Python ----------
import os

if i:
    o = os.path.join(str(i),"bibil\\bibil_tree.py")
# ---------- end python_script ----------
file = ReadFile(File=python_script, PerLineParse=False)
bibil_2 = PythonScript(Code=file)

# ---- group: grammar
python_script_2 = PythonScript(i=bibil)  # -> o
# ---------- python_script_2: Python ----------
import os

if i:
    o = os.path.join(str(i),"bibil\\bibil_grammar.py")
# ---------- end python_script_2 ----------
file_2 = ReadFile(File=python_script_2, PerLineParse=False)
bibil_3 = PythonScript(Code=file_2)

# ---- group: shape
python_script_3 = PythonScript(i=bibil)  # -> o
# ---------- python_script_3: Python ----------
import os

if i:
    o = os.path.join(str(i),"bibil\\bibil_shape.py")
#o = os.path.join(str(i),"research\\bibil_shape_shape_3d_2d.py")
# ---------- end python_script_3 ----------
file_3 = ReadFile(File=python_script_3, PerLineParse=False)
bibil_4 = PythonScript(Code=file_3)

# ---- group: miru
python_script_4 = PythonScript(i=bibil)  # -> o
# ---------- python_script_4: Python ----------
import os

if i:
    o = os.path.join(str(i),"miru\\miru_miru.py")
# ---------- end python_script_4 ----------
file_4 = ReadFile(File=python_script_4, PerLineParse=False)
bibil_5 = PythonScript(Code=file_4)

# ---- group: bula
python_script_5 = PythonScript(i=bibil)  # -> o
# ---------- python_script_5: Python ----------
import os

if i:
    o = os.path.join(str(i),"bula\\bula_minimal.py")
# ---------- end python_script_5 ----------
file_5 = ReadFile(File=python_script_5, PerLineParse=False)
bibil_6 = PythonScript(Code=file_5)

# ---- group: UI
python_script_6 = PythonScript(i=bibil)  # -> o
# ---------- python_script_6: Python ----------
import os

if i:
    o = os.path.join(str(i),"bibil\\bibil_UI.py")
# ---------- end python_script_6 ----------
file_6 = ReadFile(File=python_script_6, PerLineParse=False)

# ---- group: grammar_divide
python_script_7 = PythonScript(i=bibil)  # -> o
# ---------- python_script_7: Python ----------
import os

if i:
    o = os.path.join(str(i),"miru\\miru_divide.py")
# ---------- end python_script_7 ----------
file_7 = ReadFile(File=python_script_7, PerLineParse=False)

# ---- group: grammar_courtyard
python_script_8 = PythonScript(i=bibil)  # -> o
# ---------- python_script_8: Python ----------
import os

if i:
    o = os.path.join(str(i),"miru\\miru_court.py")
# ---------- end python_script_8 ----------
file_8 = ReadFile(File=python_script_8, PerLineParse=False)

# ---- group: grammar_tower
python_script_9 = PythonScript(i=bibil)  # -> o
# ---------- python_script_9: Python ----------
import os

if i:
    o = os.path.join(str(i),"miru\\miru_packing.py")
# ---------- end python_script_9 ----------
file_9 = ReadFile(File=python_script_9, PerLineParse=False)

python_script_10 = PythonScript(i=bibil)  # -> o
# ---------- python_script_10: Python ----------
import os

if i:
    o = os.path.join(str(i),"miru\\miru_stepback.py")
# ---------- end python_script_10 ----------
file_10 = ReadFile(File=python_script_10, PerLineParse=False)

# ---- group: grammar_height
python_script_11 = PythonScript(i=bibil)  # -> o
# ---------- python_script_11: Python ----------
import os

if i:
    o = os.path.join(str(i),"miru\\miru_height.py")
# ---------- end python_script_11 ----------
file_11 = ReadFile(File=python_script_11, PerLineParse=False)

# ---- group: grammar_analysis_pts
python_script_12 = PythonScript(i=bibil)  # -> o
# ---------- python_script_12: Python ----------
import os

if i:
    o = os.path.join(str(i),"miru\\miru_analysis.py")
# ---------- end python_script_12 ----------
file_12 = ReadFile(File=python_script_12, PerLineParse=False)

# ---- group: meta_tree
python_script_13 = PythonScript(i=bibil)  # -> o
# ---------- python_script_13: Python ----------
import os

if i:
    o = os.path.join(str(i),"miru\\miru_meta_tree.py")
# ---------- end python_script_13 ----------
file_13 = ReadFile(File=python_script_13, PerLineParse=False)

# ----
# Note: Change this number with caution,
# Increase bounds iterratively.
panel = Panel("0.004")  # disabled

panel_2 = Panel("Yonge and Eglinton")  # disabled
panel_3 = Panel("Redpath Avenue and Roehampton Avenue")  # disabled
location = MosquitoLocation(Location=panel_3)  # -> Address, Points, Type; disabled
item = ListItem(List=location.Points, Index=0, Wrap=True)  # disabled
toggle = BooleanToggle(True)  # disabled
toggle_2 = BooleanToggle(True)  # disabled
toggle_3 = BooleanToggle(True)  # disabled
toggle_4 = BooleanToggle(True)  # disabled
circle = CircleCNR(Center=item, Normal=Vector(0, 0, 1), Radius=panel)  # disabled
vector_maps = VectorMaps(Area=circle, AllRoads=toggle, Buildings=toggle_2, ReProject=toggle_3, CenterToWorld=toggle_4)  # -> RoadLines, RoadInfo, BuildingLines, BuildingInfo, BuildingHeights, AmenityLines, AmenityInfo, AmenityPoints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; disabled
swatch = ColourSwatch(SwatchColor=RGB(0, 0, 0))  # disabled
geo = Geometry([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])  # disabled
geo_2 = Geometry([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])  # disabled
geo_3 = Geometry(Tree({0}: [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], {1}: [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], {2}: [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], {3}: [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], {4}: [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], {5}: [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]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))  # disabled
geo_4 = Geometry([vector_maps.BuildingLines, vector_maps.RoadLines, vector_maps.AmenityLines])  # disabled
preview = CustomPreview(Geometry=[geo_3, geo_2, geo], Shader=swatch)  # disabled

list_2 = ValueList({"divide by depth": "subdivide_depth", "divide by same depth": "subdivide_depth_same", "divide by dim": "subdivide_dim"}, selected="divide by depth")

# ---- group: cpt
vec = Vector(Vector(-545550.1884, 3982019.542, 0))

# ---- group: refYEvec
vec_2 = Vector(Vector(-545759.5384, 3981844.461, 0))

# ----
list_3 = ValueList({"YZ": "NS", "XZ": "EW", "XY": "Z"}, selected="XZ")

# ---- group: dir2cpt
subtraction = Subtraction(A=vec, B=vec_2)

# ----
toggle_5 = BooleanToggle(False)  # disabled

# ---- group: COURTYARD
miru = PythonScript(Code=file_8, Podium_depth=Slider(21, range=0..100), Node_depth=Slider(1, range=-1..1), Run=Toggle(True))  # disabled

# ---- group: DIVIDE
bibil_7 = PythonScript(
    Code=file_7,
    Divide_num=Slider(1, range=0..10),
    Divide_cut=Slider(10, range=0..100),
    Divide_type=list_2,
    Divide_ratio=Slider(0.5, range=0..1),
    Axis=list_3,
    Run=Toggle(False))  # disabled

# ---- group: PACKING
bibil_8 = PythonScript(Code=file_9, Run=toggle_5)  # disabled

# ----
move = Move(Motion=subtraction)  # -> Geometry, Transform

# ---- group: SITE BOUNDARY
geo_5 = Geometry(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)

# ----
boundary = BoundarySurfaces(Edges=geo_5)
geo_6 = Geometry(boundary)
pt = Point([Point(-546379.6521, 3981843.97, 0), Point(-546034.6363, 3981515.595, 0)])
# SITE ANALYSIS SETUP
panel_4 = Panel("20")
number_slider = Slider(2, range=0..10)  # disabled
number_slider_2 = Slider(0.5, range=0..1)  # disabled
number_slider_3 = Slider(10, range=0..100)  # disabled
list_4 = ValueList({"divide by depth": "subdivide_depth", "divide by same depth": "subdivide_depth_same", "divide by dim": "subdivide_dim"}, selected="divide by depth")  # disabled
toggle_6 = BooleanToggle(True)  # disabled
gentestpts = Honeybee_GenerateTestPoints(testGeometry=geo_6, gridSize=panel_4, distBaseSrf="1", moveTestMesh=True)  # -> readMe, simplify(testPoints), simplify(ptsVectors), simplify(facesArea), simplify(mesh); plug-in component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
list_5 = ValueList({"YZ": "NS", "XZ": "EW", "XY": "Z"}, selected="YZ")  # disabled

# ---- group: FORMULA
python = PythonScript(formula="1 / math.exp(0.1813*dist)", focal_ref=pt, height_ref="200.0,100.0", smooth=Slider(1.5, range=0..5))  # -> value_ref; inputs focal_ref: list
# ---------- python: Python ----------
"""
Bula Formula
"""
import rhinoscriptsyntax as rs

#Formula handling
#dist = 10.
#val = eval(formula)

focal_ref = map(lambda fr: rs.coerce3dpoint(fr),focal_ref)
focal_heights = map(lambda fw: float(fw), height_ref.split(','))
smooth_factor = smooth 
value_ref = [formula,focal_ref,focal_heights,smooth_factor]
# ---------- end python ----------

# ---- group: DIVIDE
bibil_9 = PythonScript(
    Code=file_7,
    Divide_num=number_slider,
    Divide_cut=number_slider_3,
    Divide_type=list_4,
    Divide_ratio=number_slider_2,
    Axis=list_5,
    Run=toggle_6)  # disabled

# ----
toggle_7 = BooleanToggle(True)  # disabled
panel_5 = Panel("roottest")  # disabled
geo_7 = Geometry(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)  # disabled
bula = PythonScript(Code=file_12, Analysis_ref=gentestpts.testPoints, Value_ref=python, Run=Toggle(True))
trinco_park = PythonScript(Code=file_6, Rule_in=bibil_9, Node_in=geo_7, Label_=panel_5, Run=toggle_7)  # -> Node_out, Debug; disabled
g = PythonScript(node=trinco_park.Node_out)  # -> geom; inputs node: list; disabled
# ---------- g: Python ----------
if node and node != []:
    geom = []
    for n in node:
        #lot_lst = n.traverse_tree(lambda n:n.shape.geom,internal=False)
        geom.append(n.shape.geom)#lot_lst)
    print geom
# ---------- end g ----------

# ---- group: root test
g_2 = PythonScript(node=trinco_park.Node_out)  # -> geom; inputs node: list; disabled
# ---------- g_2: Python ----------
if node and node != []:
    geom = []
    for n in node:
        #print 'label: ', n.parent.grammar.type['label']
        geom.append(n.shape.geom)
    
    node[0].grammar.type['label'] = 'leaftest'
    
    print '----'
    root = node[0].get_root()
    #print root.grammar.type['label']
    lstleaf = root.traverse_tree(lambda n: n,internal=False)
    for leaf in lstleaf:
        print leaf.grammar.type['label']
    print '----'
    
    
    node[0].grammar.type['label'] = 'revisedleaftest'
    node[1].grammar.type['label'] = 'revisedtest'
    
    lstleaf = root.traverse_tree(lambda n: n,internal=False)
    for leaf in lstleaf:
        print leaf.grammar.type['label']
    print '----'
# ---------- end g_2 ----------

# ----
number_slider_4 = Slider(-45, range=-100..100)
rad = Radians(Degrees=number_slider_4)
rad_2 = Radians(Degrees=number_slider_4)
geo_8 = Geometry(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)
geo_9 = Geometry(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)
geo_10 = Geometry(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)
geo_11 = Geometry(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)
rotax = RotateAxis(Geometry=geo_8, Angle=rad, Axis=geo_9)  # -> Geometry, Transform
rotax_2 = RotateAxis(Geometry=geo_10, Angle=rad_2, Axis=geo_11)  # -> Geometry, Transform
# BUILDING TYPOLOGY
python_2 = PythonScript(pts=gentestpts.testPoints, brep=[rotax.Geometry, rotax_2.Geometry], run=Toggle(True))  # -> flatten(project); inputs pts: list
# ---------- python_2: Python ----------
import rhinoscriptsyntax as rs
import Rhino as rc
import scriptcontext as sc

if run:
    debug = []
    dir = rc.Geometry.Vector3d(0,0,1) 
    tol = sc.doc.ModelAbsoluteTolerance
    env = [rs.coercebrep(brep)]
    ptlst = map(lambda p: rs.coerce3dpoint(p),pts)
    
    projlst = rc.Geometry.Intersect.Intersection.ProjectPointsToBreps(env,ptlst,dir,tol)
    #print projlst
    #projlst = filter(lambda pt:abs(pt[2]-200.)>0.5,projlst)
    projlst = filter(lambda p: abs(p[2]-0)>1.,projlst)
    
    if projlst:
        debug.extend(projlst)
        #min_index = projlst.index(min(projlst,key=lambda p:p[2]))
        #min_pt = projlst[min_index]
        #envht = min_pt[2]
    project = debug
# ---------- end python_2 ----------
wires = BrepWireframe(Brep=[rotax.Geometry, rotax_2.Geometry], Density=-1)
devec = DeconstructVector(Vector=flatten(python_2))  # -> XComponent, YComponent, ZComponent
geo_12 = Geometry(python_2)

trinco_park_2 = PythonScript(Code=file_6, Rule_in=flatten(bula), Node_in=flatten(geo_6), Label_="bulaRoot", Run=Toggle(True))  # -> Node_out, Debug
g_3 = PythonScript(node=trinco_park_2.Node_out)  # -> geom; inputs node: list
# ---------- g_3: Python ----------
if node and node != []:
    geom = []
    #lot_lst = node.traverse_tree(lambda n:n,internal=False)
    for n in node:
        #print n.grammar.type.has_key('bula')
        print n
        print n.parent
        #print n.grammar.type['bula']
        geom.append(n.shape.bottom_crv)
    #print geom
# ---------- end g_3 ----------
g_4 = PythonScript(node=trinco_park_2.Node_out)  # -> bula; inputs node: list
# ---------- g_4: Python ----------
if node and node != []:
    geom = []
    #lot_lst = node.traverse_tree(lambda n:n,internal=False)
    #n = node[0].get_root()
    for n in node:
        
        print n.grammar.type['label']
        print n.grammar.type['bula']
        if n.grammar.type['bula'] == True:
            geom.extend(n.grammar.type['bula_data'].bpt_viz_lst)
    bula = geom
# ---------- end g_4 ----------
g_5 = PythonScript(node=trinco_park_2.Node_out)  # -> data; inputs node: list
# ---------- g_5: Python ----------
if node and node != []:
    L = []
    #lot_lst = node.traverse_tree(lambda n:n,internal=False)
    #n = node[0].get_root()
    for n in node:
        print n.grammar.type['label']
        if n.grammar.type['bula']:
            L.extend(n.grammar.type['bula_data'].value_lst)
    data = map(lambda d: str(round(d,2))+'%',L)
   
    print data
# ---------- end g_5 ----------
geometry = Geometry(g_4)
tag = TextTag(Location=g_4, Text=g_5)
bula_2 = PythonScript(Code=file_12, Analysis_ref=flatten(python_2), Value_ref=flatten(devec.ZComponent), Run=Toggle(True))
trinco_park_3 = PythonScript(Code=file_6, Rule_in=flatten(bula_2), Node_in=flatten(trinco_park_2.Node_out), Label_="addBulaPlane", Run=Toggle(True))  # -> Node_out, Debug

# ---- group: Block outlines
geo_13 = Geometry([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])

# ---- group: Soft Sites ref
geo_14 = Geometry([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])

# ---- group: Setbacks
geo_15 = Geometry([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])

# ----
preview_2 = CustomPreview(Geometry=[geo_14, geo_13], Shader=ColourSwatch(SwatchColor=RGB(0, 0, 0)))
g_6 = PythonScript(node=trinco_park_3.Node_out)  # -> geom; inputs node: list
# ---------- g_6: Python ----------
if node and node != []:
    geom = []
    #lot_lst = node.traverse_tree(lambda n:n,internal=False)
    for n in node:
        #print n.grammar.type.has_key('bula')
        print n
        #print n.parent
        #print n.parent.parent
        #print n.parent.parent.parent
        #print n.parent.parent.parent.parent
        #print n.grammar.type['bula']
        geom.append(n.shape.bottom_crv)
        print '--'
# ---------- end g_6 ----------
g_7 = PythonScript(node=trinco_park_3.Node_out)  # -> bula; inputs node: list; same code as g_4
g_8 = PythonScript(node=trinco_park_3.Node_out)  # -> data; inputs node: list; same code as g_5

# ---- group: Soft Sites
geo_16 = Geometry([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])

# ----
geometry_2 = Geometry(g_7)
tag_2 = TextTag(Location=g_7, Text=g_8)
toggle_8 = BooleanToggle(True)
list_6 = ValueList({"root"}, selected="root")
toggle_9 = BooleanToggle(True)
list_7 = ValueList({"root"}, selected="root")

# ---- group: SETBACK
miru_2 = PythonScript(
    Code=file_10,
    Height=Slider(12, range=0..100),
    Distance=Slider(6, range=0..10),
    Geom_ref=geo_15,
    Node_ref="-1",
    Run=Toggle(True))

# ---- group: TREE RULES
miru_3 = PythonScript(Code=file_13, Node=trinco_park_3.Node_out, Relation=list_6, Insert=toggle_8, Run=toggle_8)

# ---- group: HEIGHT
miru_4 = PythonScript(Code=file_11, Height="bula", Run=Toggle(True))

# ----
geo_17 = Geometry([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])

# ---- group: TREE RULES
miru_5 = PythonScript(Code=file_13, Node=trinco_park_2.Node_out, Relation=list_7, Insert=toggle_9, Run=toggle_9)

# ---- group: HEIGHT
miru_6 = PythonScript(Code=file_11, Height=Slider(18, range=0..100), Run=Toggle(True))

# ----
bibil_10 = PythonScript(Code=file_6, Rule_in=flatten([miru_3, miru_4]), Node_in=flatten(geo_17), Label_="hiriseType", Run=Toggle(True))  # -> Node_out, Debug
bibil_11 = PythonScript(
    Code=file_6,
    Rule_in=flatten([miru_5, miru_6, miru_2]),
    Node_in=flatten(geo_16),
    Label_="midrise_podium",
    Run=Toggle(False))  # -> Node_out, Debug

# ---- group: problem_WRONG PARENT
g_9 = PythonScript(node=bibil_10.Node_out)  # -> geom; inputs node: list
# ---------- g_9: Python ----------
node = filter(lambda n: n!=None,node)
if node and node != []:
    geom = []
    for n in node:
        #print n.get_root()
        print n
        print n.parent
        print n.parent.parent
        print n.parent.parent.parent
        print n.parent.parent.parent.parent
        print '---'
        geom.append(n.shape.geom)
    #print geom
# ---------- end g_9 ----------

# ----
g_10 = PythonScript(node=bibil_11.Node_out)  # -> geom; inputs node: list
# ---------- g_10: Python ----------
node = filter(lambda n: n!=None,node)
if node and node != []:
    geom = []
    for n in node:
        print n.get_root()
        print n.parent.parent
        print n
        geom.append(n.shape.geom)
    print geom
# ---------- end g_10 ----------

# ---- group: Type_Commercial_Midrise
geo_18 = Geometry([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])

# ----
geo_19 = Geometry([g_10, geo_18])

# ---- group: Type_Res_low_rise
geo_20 = Geometry([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])

# ---- group: Type_Res_Tower
geo_21 = Geometry([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])

# ----
material = CreateMaterial(
    Diffuse=ColourSwatch(SwatchColor=RGB(79, 79, 79)),
    Specular=RGB(255, 255, 255),
    Emission=RGB(0, 0, 0),
    Transparency=Slider(0.5, range=0..1),
    Shine=Slider(100, range=0..100))
material_2 = CreateMaterial(
    Diffuse=ColourSwatch(SwatchColor=RGB(79, 79, 79)),
    Specular=RGB(255, 255, 255),
    Emission=RGB(0, 0, 0),
    Transparency=Slider(0.5, range=0..1),
    Shine=Slider(100, range=0..100))
preview_3 = CustomPreview(Geometry=geo_19, Shader=material_2)
preview_4 = CustomPreview(Geometry=[g_9, geo_20, geo_21], Shader=material)
