# Grasshopper definition bibil_trial_096_tocore_master_file_minimal.gh (Grasshopper 0.9.76)
# plug-ins: Python Interpreter, DIVA Daylight, ArchsimGH, Mosquito

list = ValueList({"dir", "file"}, selected="dir")

# ---- group: find directory
bibil = PythonScript(
    dir=["C:\\Users\\vasanthakumars\\Documents\\GitHub\\bibil\\src", "C:\\saeran\\master\\git\\bibil\\src"],
    type=list,
    run=Toggle(True))  # -> dir; inputs dir: list
# ---------- bibil: Python ----------
import os

ghenv.Component.Params.Output[0].Name = "null"
ghenv.Component.Params.Output[0].NickName = "null"

if run:
    confirm_dir = None
    for d in dir:
        try:
            if type == "file":
                file_ = open(d)
                file_.close()
            else:
                print os.listdir(d)
            confirm_dir = d
            break
        except Exception as e:
            #print str(e)
            continue
    if confirm_dir != None:
        ghenv.Component.Params.Output[0].Name = type
        ghenv.Component.Params.Output[0].NickName = type
        dir = confirm_dir
        file = confirm_dir
null = None
# ---------- end bibil ----------

# ---- group: tree
python_script = PythonScript(i=bibil)  # -> o
# ---------- python_script: Python ----------
import os

if i:
    o = os.path.join(str(i),"bibil\\bibil_tree.py")
# ---------- end python_script ----------
file = ReadFile(File=python_script, PerLineParse=False)
bibil_2 = PythonScript(Code=file)

# ---- group: grammar
python_script_2 = PythonScript(i=bibil)  # -> o
# ---------- python_script_2: Python ----------
import os

if i:
    o = os.path.join(str(i),"bibil\\bibil_grammar.py")
# ---------- end python_script_2 ----------
file_2 = ReadFile(File=python_script_2, PerLineParse=False)
bibil_3 = PythonScript(Code=file_2)

# ---- group: shape
python_script_3 = PythonScript(i=bibil)  # -> o
# ---------- python_script_3: Python ----------
import os

if i:
    o = os.path.join(str(i),"bibil\\bibil_shape.py")
#o = os.path.join(str(i),"research\\bibil_shape_shape_3d_2d.py")
# ---------- end python_script_3 ----------
file_3 = ReadFile(File=python_script_3, PerLineParse=False)
bibil_4 = PythonScript(Code=file_3)

# ---- group: miru
python_script_4 = PythonScript(i=bibil)  # -> o
# ---------- python_script_4: Python ----------
import os

if i:
    o = os.path.join(str(i),"miru\\miru_miru.py")
# ---------- end python_script_4 ----------
file_4 = ReadFile(File=python_script_4, PerLineParse=False)
bibil_5 = PythonScript(Code=file_4)

# ---- group: bula
python_script_5 = PythonScript(i=bibil)  # -> o
# ---------- python_script_5: Python ----------
import os

if i:
    o = os.path.join(str(i),"bula\\bula_minimal.py")
# ---------- end python_script_5 ----------
file_5 = ReadFile(File=python_script_5, PerLineParse=False)
bibil_6 = PythonScript(Code=file_5)

# ---- group: UI
python_script_6 = PythonScript(i=bibil)  # -> o
# ---------- python_script_6: Python ----------
import os

if i:
    o = os.path.join(str(i),"bibil\\bibil_UI.py")
# ---------- end python_script_6 ----------
file_6 = ReadFile(File=python_script_6, PerLineParse=False)

# ---- group: grammar_divide
python_script_7 = PythonScript(i=bibil)  # -> o
# ---------- python_script_7: Python ----------
import os

if i:
    o = os.path.join(str(i),"miru\\miru_divide.py")
# ---------- end python_script_7 ----------
file_7 = ReadFile(File=python_script_7, PerLineParse=False)

# ---- group: grammar_courtyard
python_script_8 = PythonScript(i=bibil)  # -> o
# ---------- python_script_8: Python ----------
import os

if i:
    o = os.path.join(str(i),"miru\\miru_court.py")
# ---------- end python_script_8 ----------
file_8 = ReadFile(File=python_script_8, PerLineParse=False)

# ---- group: grammar_tower
python_script_9 = PythonScript(i=bibil)  # -> o
# ---------- python_script_9: Python ----------
import os

if i:
    o = os.path.join(str(i),"miru\\miru_packing.py")
# ---------- end python_script_9 ----------
file_9 = ReadFile(File=python_script_9, PerLineParse=False)

python_script_10 = PythonScript(i=bibil)  # -> o
# ---------- python_script_10: Python ----------
import os

if i:
    o = os.path.join(str(i),"miru\\miru_stepback.py")
# ---------- end python_script_10 ----------
file_10 = ReadFile(File=python_script_10, PerLineParse=False)

# ---- group: grammar_height
python_script_11 = PythonScript(i=bibil)  # -> o
# ---------- python_script_11: Python ----------
import os

if i:
    o = os.path.join(str(i),"miru\\miru_height.py")
# ---------- end python_script_11 ----------
file_11 = ReadFile(File=python_script_11, PerLineParse=False)

# ---- group: grammar_analysis_pts
python_script_12 = PythonScript(i=bibil)  # -> o
# ---------- python_script_12: Python ----------
import os

if i:
    o = os.path.join(str(i),"miru\\miru_analysis.py")
# ---------- end python_script_12 ----------
file_12 = ReadFile(File=python_script_12, PerLineParse=False)

# ---- group: meta_tree
python_script_13 = PythonScript(i=bibil)  # -> o
# ---------- python_script_13: Python ----------
import os

if i:
    o = os.path.join(str(i),"miru\\miru_meta_tree.py")
# ---------- end python_script_13 ----------
file_13 = ReadFile(File=python_script_13, PerLineParse=False)

# ---- group: land_use
python_script_14 = PythonScript(i=bibil)  # -> o
# ---------- python_script_14: Python ----------
import os

if i:
    o = os.path.join(str(i),"miru\\miru_landuse.py")
# ---------- end python_script_14 ----------
file_14 = ReadFile(File=python_script_14, PerLineParse=False)

# ----
panel = Panel("0>3:0>0")  # disabled
panel_2 = Panel("""7.5:1.5
19.5:3.0
25.5:6.0""")
list_2 = ValueList({"divide by depth": "subdivide_depth", "divide by same depth": "subdivide_depth_same", "divide by dim": "subdivide_dim"}, selected="divide by same depth")
list_3 = ValueList({"YZ": "NS", "XZ": "EW", "XY": "Z"}, selected="XZ")

# ---- group: SETBACK
miru = PythonScript(Code=file_10, Height_stepback=panel_2, Randomize=panel, Stepback_ref="0", Run=Toggle(True))

# ---- group: DIVIDE
bibil_7 = PythonScript(
    Code=file_7,
    Divide_num=Slider(2, range=0..10),
    Divide_cut=Slider(0, range=0..100),
    Divide_type=list_2,
    Divide_ratio=Slider(0.5, range=0..1),
    Axis=list_3,
    Run=Toggle(True))

# ---- group: HEIGHT
miru_2 = PythonScript(Code=file_11, Height=Slider(25, range=0..100), Randomize="-6>6", Run=Toggle(True))

# ---- group: COURTYARD
miru_3 = PythonScript(Code=file_8, Width=Slider(25, range=0..100), Court_ref="-1", Run=Toggle(True))

# ----
panel_3 = Panel("Montgomery Square and Yonge Street")  # disabled
panel_4 = Panel("Yonge and Eglinton")  # disabled
location = MosquitoLocation(Location=panel_3)  # -> Address, Points, Type; disabled

# ----
# Note: Change this number with caution,
# Increase bounds iterratively.
panel_5 = Panel("0.008")  # disabled

geo = Geometry(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)
panel_6 = Panel(location.Address)  # disabled
item = ListItem(List=location.Points, Index=0, Wrap=True)  # disabled

# ---- group: SHAPENODE
bibil_8 = PythonScript(
    Code=file_6,
    Rule_in=flatten([miru_3, bibil_7, miru_2, miru]),
    Node_in=flatten(geo),
    Label_="shape4example",
    Run=Toggle(True))  # -> Node_out, Debug

# ----
toggle = BooleanToggle(True)  # disabled
toggle_2 = BooleanToggle(True)  # disabled
toggle_3 = BooleanToggle(True)  # disabled
toggle_4 = BooleanToggle(True)  # disabled
circle = CircleCNR(Center=item, Normal=Vector(0, 0, 1), Radius=panel_5)  # disabled

# ---- group: GEOREF
vec = Vector(Vector(-1067.339845, 1063.239109, 0))

# ---- group: CPT
vec_2 = Vector(Vector(-546071.5172, 3981810.795, 0))

# ----
list_4 = ValueList({"divide by depth": "subdivide_depth", "divide by same depth": "subdivide_depth_same", "divide by dim": "subdivide_dim"}, selected="divide by depth")
g = PythonScript(node=bibil_8.Node_out)  # -> geom; inputs node: list
# ---------- g: Python ----------
node = filter(lambda n: n!=None,node)
if node and node != []:
    geom = []
    for n in node:
        geom.append(n.shape.geom)
    print geom
# ---------- end g ----------
g_2 = PythonScript(node=bibil_8.Node_out)  # -> label; inputs node: list
# ---------- g_2: Python ----------
node = filter(lambda n: n!=None,node)
if node and node != []:
    label = []
    if True:#for i,n in enumerate(node):
        #print i
        root = node[0].get_root()
        L = root.traverse_tree(lambda n:n,internal=True) 
        for i in L:
            print i
            label.append(i)
        #label.append('--')
        #print '---'
# ---------- end g_2 ----------

# ---- group: A=pt2move2
subtraction = Subtraction(A=vec_2, B=vec)

# ----
list_5 = ValueList({"YZ": "NS", "XZ": "EW", "XY": "Z"}, selected="XZ")
vector_maps = VectorMaps(Area=circle, AllRoads=toggle, Buildings=toggle_2, ReProject=toggle_3, CenterToWorld=toggle_4)  # -> RoadLines, RoadInfo, BuildingLines, BuildingInfo, BuildingHeights, AmenityLines, AmenityInfo, AmenityPoints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; disabled
geo_2 = Geometry([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])
panel_7 = Panel(g_2)
move = Move(Geometry=geo_2, Motion=subtraction)  # -> Geometry, Transform

# ---- group: COURTYARD
miru_4 = PythonScript(Code=file_8, Podium_depth=Slider(21, range=0..100), Node_depth=Slider(1, range=-1..1), Run=Toggle(True))  # disabled

# ---- group: DIVIDE
bibil_9 = PythonScript(
    Code=file_7,
    Divide_num=Slider(1, range=0..10),
    Divide_cut=Slider(10, range=0..100),
    Divide_type=list_4,
    Divide_ratio=Slider(0.5, range=0..1),
    Axis=list_5,
    Run=Toggle(False))  # disabled

# ----
geo_3 = Geometry(move.Geometry)
swatch = ColourSwatch(SwatchColor=RGB(0, 0, 0))  # disabled
geo_4 = Geometry([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])  # disabled
geo_5 = Geometry([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])  # disabled
geo_6 = Geometry(Tree({0}: [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], {1}: [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], {2}: [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], {3}: [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], {4}: [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], {5}: [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]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))  # disabled
geo_7 = Geometry([vector_maps.BuildingLines, vector_maps.RoadLines, vector_maps.AmenityLines])  # disabled
# SITE ANALYSIS SETUP
preview = CustomPreview(Geometry=[geo_6, geo_5, geo_4], Shader=swatch)  # disabled

# ---- group: SITE BOUNDARY
geo_8 = Geometry(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)  # disabled

# ----
boundary = BoundarySurfaces(Edges=geo_8)  # disabled
panel_8 = Panel("112.5,89.5,20.0")  # disabled
panel_9 = Panel("1 / math.exp(0.1813*dist)")  # disabled
number_slider = Slider(1.5, range=0..5)  # disabled
pt = Point(Point(-546056.4775, 3982009.405, 0))  # disabled
pt_2 = Point(Point(-546214.5571, 3981659.038, 0))  # disabled
panel_10 = Panel("1")  # disabled
panel_11 = Panel("10")  # disabled
gentestpts = Honeybee_GenerateTestPoints(testGeometry=boundary, gridSize=panel_11, distBaseSrf=panel_10, moveTestMesh=True)  # -> readMe, simplify(testPoints), simplify(ptsVectors), simplify(facesArea), simplify(mesh); disabled; plug-in component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

# ---- group: FORMULA
python = PythonScript(formula=panel_9, focal_ref=[pt_2, pt], height_ref=panel_8, smooth=number_slider)  # -> value_ref; inputs focal_ref: list; disabled
# ---------- python: Python ----------
"""
Bula Formula
"""
import rhinoscriptsyntax as rs

#Formula handling
#dist = 10.
#val = eval(formula)

focal_ref = map(lambda fr: rs.coerce3dpoint(fr),focal_ref)
focal_heights = map(lambda fw: float(fw), height_ref.split(','))
smooth_factor = smooth 
value_ref = [formula,focal_ref,focal_heights,smooth_factor]
# ---------- end python ----------

# ----
toggle_5 = BooleanToggle(True)  # disabled
# STREET/BLOCK GENERATOR
bula = PythonScript(Code=file_12, Analysis_ref=gentestpts.testPoints, Value_ref=python, Run=toggle_5)  # disabled
panel_12 = Panel("pedestrianBulaRef")  # disabled
toggle_6 = BooleanToggle(True)  # disabled
trinco_park = PythonScript(Code=file_6, Rule_in=flatten(bula), Node_in=flatten(boundary), Label_=panel_12, Run=toggle_6)  # -> Node_out, Debug; disabled
g_3 = PythonScript(node=trinco_park.Node_out)  # -> geom; inputs node: list; disabled
# ---------- g_3: Python ----------
if node and node != []:
    geom = []
    #lot_lst = node.traverse_tree(lambda n:n,internal=False)
    for n in node:
        #print n.grammar.type.has_key('bula')
        print n
        print n.parent
        #print n.grammar.type['bula']
        geom.append(n.shape.bottom_crv)
    #print geom
# ---------- end g_3 ----------
g_4 = PythonScript(node=trinco_park.Node_out)  # -> data; inputs node: list; disabled
# ---------- g_4: Python ----------
if node and node != []:
    L = []
    #lot_lst = node.traverse_tree(lambda n:n,internal=False)
    #n = node[0].get_root()
    for n in node:
        print n.grammar.type['label']
        if n.grammar.type['bula']:
            for a,v in zip(n.grammar.type['bula_data'].value_actual, n.grammar.type['bula_data'].value_lst):
                pass
                #print a
                #print v
                #print ''
            print '--'
            L.extend(n.grammar.type['bula_data'].value_actual)
    for i in L:
        print i
    data = map(lambda d: str(round(d,2))+'%',L)
   
    #print data
# ---------- end g_4 ----------
g_5 = PythonScript(node=trinco_park.Node_out)  # -> bula; inputs node: list; disabled
# ---------- g_5: Python ----------
if node and node != []:
    geom = []
    #lot_lst = node.traverse_tree(lambda n:n,internal=False)
    #n = node[0].get_root()
    for n in node:
        
        print n.grammar.type['label']
        print n.grammar.type['bula']
        if n.grammar.type['bula'] == True:
            geom.extend(n.grammar.type['bula_data'].bpt_viz_lst)
    bula = geom
# ---------- end g_5 ----------
tag = TextTag(Location=g_5, Text=g_4)  # disabled
toggle_7 = BooleanToggle(True)  # disabled

# ---- group: TREE RULES
miru_5 = PythonScript(Code=file_13, Node=trinco_park.Node_out, Run=toggle_7)  # disabled

# ----
panel_13 = Panel("Parcel")  # disabled
path = FilePath("C:\Users\vasanthakumars\Documents\GitHub\bibil\src\reference\img_files\land-use.JPG")  # disabled
toggle_8 = BooleanToggle(True)  # disabled
geo_9 = Geometry([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])  # disabled
# LAND USE ZONING
image_viewer = ImageViewer(ImagePath=path, Scale=1)  # disabled

# ---- group: SET PARCELS
bibil_10 = PythonScript(Code=file_6, Rule_in=flatten(miru_5), Node_in=flatten(geo_9), Label_=panel_13, Run=toggle_8)  # -> Node_out, Debug; disabled

# ----
panel_14 = Panel("""Midrise,Commercial
Midrise,Residential
Highrise,Residential
Highrise,Commercial""")  # disabled
toggle_9 = BooleanToggle(True)  # disabled
toggle_10 = BooleanToggle(True)  # disabled
geo_10 = Geometry([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])  # disabled

# ---- group: SET LANDUSE
bibil_11 = PythonScript(Code=file_6, Node_in=flatten(geo_10), Label_=panel_14, Run=toggle_9)  # -> Node_out, Debug; disabled

# ---- group: BUCKET_BY_SPACE
miru_6 = PythonScript(Code=file_14, Nodes2bucket=bibil_10.Node_out, Run=toggle_10)  # disabled

# ----
g_6 = PythonScript(node=bibil_11.Node_out)  # -> label; inputs node: list; disabled
# ---------- g_6: Python ----------
node = filter(lambda n: n!=None,node)
if node and node != []:
    label = []
    for i,n in enumerate(node):
        print i
        root = n.get_root()
        L = root.traverse_tree(lambda n:n,internal=True)
        for i in L:
            label.append(i) 
        print '---'
# ---------- end g_6 ----------
panel_15 = Panel("landUse")  # disabled
toggle_11 = BooleanToggle(True)  # disabled
panel_16 = Panel(g_6)  # disabled

# ---- group: LANDUSE
bibil_12 = PythonScript(Code=file_6, Rule_in=flatten(miru_6), Node_in=flatten(bibil_11.Node_out), Label_=panel_15, Run=toggle_11)  # -> Node_out, Debug; disabled

# ----
g_7 = PythonScript(node=bibil_12.Node_out)  # -> geom; inputs node: list; disabled
# ---------- g_7: Python ----------
node = filter(lambda n: n!=None,node)
if node and node != []:
    geom = []
    for n in node:
        #print n.get_root()
        print n
        print n.parent
        #print n.parent.parent
        #print n.parent.parent.parent
        #print n.parent.parent.parent.parent
        #print '---'
        geom.append(n.shape.bottom_crv)
    #print geom
# ---------- end g_7 ----------
g_8 = PythonScript(node=bibil_12.Node_out)  # -> label; inputs node: list; disabled
# ---------- g_8: Python ----------
node = filter(lambda n: n!=None,node)
if node and node != []:
    label = []
    for i,n in enumerate(node):
        print i
        root = n.get_root()
        L = root.traverse_tree(lambda n:n,internal=True)
        for i in L:
            print i
            label.append(i) 
        label.append('--')
        print '---'
# ---------- end g_8 ----------
panel_17 = Panel(g_8)  # disabled
number_slider_2 = Slider(30, range=0..100)  # disabled
panel_18 = Panel("-1")  # disabled
panel_19 = Panel("30.0,30.0")  # disabled
panel_20 = Panel("40.0,40.0")  # disabled
toggle_12 = BooleanToggle(True)  # disabled
toggle_13 = BooleanToggle(True)  # disabled
panel_21 = Panel("2")  # disabled
toggle_14 = BooleanToggle(True)  # disabled

# ---- group: PACKING
bibil_13 = PythonScript(Code=file_9, Dim2keep=panel_19, Dim2delete=panel_20, Seperation_ref=panel_18, Run=toggle_13)  # disabled

# ---- group: COURTYARD
miru_7 = PythonScript(Code=file_8, Width=number_slider_2, Court_ref=panel_21, Run=toggle_12)  # disabled

# ---- group: TREE RULES
miru_8 = PythonScript(Code=file_13, Node=trinco_park.Node_out, Run=toggle_14)  # disabled

# ----
geo_11 = Geometry(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)  # disabled
toggle_15 = BooleanToggle(True)  # disabled
panel_22 = Panel("typetest")  # disabled

# ---- group: MIDRISE
bibil_14 = PythonScript(Code=file_6, Rule_in=flatten([miru_7, bibil_13, miru_8]), Node_in=flatten(geo_11), Label_=panel_22, Run=toggle_15)  # -> Node_out, Debug; disabled

# ----
g_9 = PythonScript(node=bibil_14.Node_out)  # -> geom; inputs node: list; disabled; same code as g
g_10 = PythonScript(node=bibil_14.Node_out)  # -> label; inputs node: list; disabled; same code as g_8
g_11 = PythonScript(node=bibil_14.Debug)  # -> geom; inputs node: list; disabled; same code as g
preview_2 = CustomPreview(
    Geometry=g_9,
    Shader={ambient=RGB(0, 0, 0), diffuse=RGB(255, 105, 180), emission=RGB(76, 32, 54), shine=0.5, specular=RGB(255, 255, 255), transparency=0})  # disabled
panel_23 = Panel("2")  # disabled
number_slider_3 = Slider(0.5, range=0..1)  # disabled
number_slider_4 = Slider(0, range=0..100)  # disabled
panel_24 = Panel("""7.5:1.5
19.5:4.5""")  # disabled
panel_25 = Panel("25.5:6.0")  # disabled
number_slider_5 = Slider(25, range=0..100)  # disabled
panel_26 = Panel("0>3:0>0")  # disabled
panel_27 = Panel("0>3:0>3")  # disabled
panel_28 = Panel("24.5:1.5")  # disabled
list_6 = ValueList({"divide by depth": "subdivide_depth", "divide by same depth": "subdivide_depth_same", "divide by dim": "subdivide_dim"}, selected="divide by dim")  # disabled
panel_29 = Panel("40")  # disabled
panel_30 = Panel("10")  # disabled
toggle_16 = BooleanToggle(True)  # disabled
panel_31 = Panel("-3>6")  # disabled
toggle_17 = BooleanToggle(True)  # disabled
toggle_18 = BooleanToggle(True)  # disabled
toggle_19 = BooleanToggle(True)  # disabled
toggle_20 = BooleanToggle(True)  # disabled
# BUILDING TYPOLOGY
number_slider_6 = Slider(6.5, range=0..100)  # disabled
list_7 = ValueList({"YZ": "NS", "XZ": "EW", "XY": "Z"}, selected="YZ")  # disabled
panel_32 = Panel("-1")  # disabled
toggle_21 = BooleanToggle(True)  # disabled

# ---- group: SETBACK
miru_9 = PythonScript(Code=file_10, Height_stepback=panel_24, Randomize=panel_26, Stepback_ref=panel_23, Run=toggle_18)  # disabled

miru_10 = PythonScript(Code=file_10, Height_stepback=panel_25, Randomize=panel_27, Stepback_ref=panel_23, Run=toggle_19)  # disabled

miru_11 = PythonScript(Code=file_10, Height_stepback=panel_28, Stepback_ref=panel_32, Run=toggle_20)  # disabled

# ---- group: DIVIDE
bibil_15 = PythonScript(
    Code=file_7,
    Divide_num=[panel_29, panel_30],
    Divide_cut=number_slider_4,
    Divide_type=list_6,
    Divide_ratio=number_slider_3,
    Axis=list_7,
    Run=toggle_16)  # disabled

# ---- group: HEIGHT
miru_12 = PythonScript(Code=file_11, Height=number_slider_6, Run=toggle_21)  # disabled

miru_13 = PythonScript(Code=file_11, Height=number_slider_5, Randomize=panel_31, Run=toggle_17)  # disabled

# ----
panel_33 = Panel("towerBase")  # disabled
toggle_22 = BooleanToggle(False)  # disabled
toggle_23 = BooleanToggle(False)  # disabled
panel_34 = Panel("midriseBase")  # disabled

# ---- group: TOWERBASE
bibil_16 = PythonScript(Code=file_6, Rule_in=flatten(miru_12), Node_in=flatten(bibil_14.Node_out), Label_=panel_33, Run=toggle_22)  # -> Node_out, Debug; disabled

# ---- group: MIDRISE
bibil_17 = PythonScript(
    Code=file_6,
    Rule_in=flatten([bibil_15, miru_13, miru_9, miru_10, miru_11]),
    Node_in=flatten(bibil_14.Debug),
    Label_=panel_34,
    Run=toggle_23)  # -> Node_out, Debug; disabled

# ----
g_12 = PythonScript(node=bibil_17.Node_out)  # -> geom; inputs node: list; disabled; same code as g
g_13 = PythonScript(node=bibil_17.Node_out)  # -> label; inputs node: list; disabled; same code as g_8
g_14 = PythonScript(node=bibil_16.Node_out)  # -> label; inputs node: list; disabled; same code as g_8
g_15 = PythonScript(node=bibil_16.Node_out)  # -> geom; inputs node: list; disabled; same code as g
number_slider_7 = Slider(0.67, range=0..1)  # disabled
number_slider_8 = Slider(1, range=0..10)  # disabled
number_slider_9 = Slider(0, range=0..100)  # disabled
panel_35 = Panel("7.5:1.5")  # disabled
panel_36 = Panel("19.5:4.5")  # disabled
panel_37 = Panel("7.5:3.0")  # disabled
number_slider_10 = Slider(100, range=0..100)  # disabled
panel_38 = Panel("-1")  # disabled
panel_39 = Panel("0>3:0>6")  # disabled
panel_40 = Panel("0>6:0>3")  # disabled
panel_41 = Panel("100.0,100.0")  # disabled
panel_42 = Panel("500.0,500.0")  # disabled
list_8 = ValueList({"divide by depth": "subdivide_depth", "divide by same depth": "subdivide_depth_same", "divide by dim": "subdivide_dim"}, selected="divide by depth")  # disabled
panel_43 = Panel("bula")  # disabled
toggle_24 = BooleanToggle(True)  # disabled
toggle_25 = BooleanToggle(True)  # disabled
toggle_26 = BooleanToggle(True)  # disabled
toggle_27 = BooleanToggle(True)  # disabled
toggle_28 = BooleanToggle(True)  # disabled
toggle_29 = BooleanToggle(True)  # disabled
list_9 = ValueList({"YZ": "NS", "XZ": "EW", "XY": "Z"}, selected="XZ")  # disabled
panel_44 = Panel("2")  # disabled
geo_12 = Geometry(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)  # disabled
panel_45 = Panel("2")  # disabled

# ---- group: SETBACK
miru_14 = PythonScript(Code=file_10, Height_stepback=panel_35, Randomize=panel_39, Stepback_ref=panel_44, Run=toggle_27)  # disabled

miru_15 = PythonScript(Code=file_10, Height_stepback=panel_36, Randomize=panel_40, Stepback_ref=panel_45, Run=toggle_28)  # disabled

miru_16 = PythonScript(Code=file_10, Height_stepback=panel_37, Stepback_ref=geo_12, Run=toggle_29)  # disabled

# ---- group: PACKING
bibil_18 = PythonScript(Code=file_9, Dim2keep=panel_41, Dim2delete=panel_42, Seperation_ref=panel_38, Run=toggle_24)  # disabled

# ---- group: DIVIDE
bibil_19 = PythonScript(
    Code=file_7,
    Divide_num=number_slider_8,
    Divide_cut=number_slider_9,
    Divide_type=list_8,
    Divide_ratio=number_slider_7,
    Axis=list_9,
    Run=toggle_25)  # disabled

# ---- group: HEIGHT
miru_17 = PythonScript(Code=file_11, Height=number_slider_10, Run=toggle_26)  # disabled

# ----
toggle_30 = BooleanToggle(True)  # disabled
panel_46 = Panel("towerMain")  # disabled

# ---- group: TOWER
bibil_20 = PythonScript(
    Code=file_6,
    Rule_in=flatten([bibil_18, bibil_19, miru_17, miru_14, miru_15, miru_16]),
    Node_in=flatten(bibil_16.Node_out),
    Label_=panel_46,
    Run=toggle_30)  # -> Node_out, Debug; disabled

# ----
g_16 = PythonScript(node=bibil_20.Node_out)  # -> label; inputs node: list; disabled; same code as g_8
g_17 = PythonScript(node=bibil_20.Node_out)  # -> geom; inputs node: list; disabled; same code as g
swatch_2 = ColourSwatch(SwatchColor=RGB(43, 43, 43))  # disabled
geo_13 = Geometry([g_15, g_12, g_17])  # disabled
material = CreateMaterial(Diffuse=swatch_2, Specular=RGB(255, 255, 255), Emission=RGB(0, 0, 0), Transparency=0, Shine=0)  # disabled
geo_14 = Geometry(Tree({0}: [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], {1}: [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], {2}: [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], {3}: [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], {4}: [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], {5}: [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]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))  # disabled
preview_3 = CustomPreview(Geometry=geo_14, Shader=material)  # disabled
geo_15 = Geometry(<curve referenced from the Rhino model>)  # disabled
boundary_2 = BoundarySurfaces(Edges=geo_15)  # disabled
Z = UnitZ(Factor=1)  # disabled
g_18 = PythonScript()  # -> geom; inputs node: list; disabled
# ---------- g_18: Python ----------
node = filter(lambda n: n!=None,node)
if node and node != []:
    geom = []
    for n in node:
        print n.get_root()
        print n.parent.parent
        print n
        geom.append(n.shape.geom)
    print geom
# ---------- end g_18 ----------
g_19 = PythonScript()  # -> geom; inputs node: list; disabled; same code as g_18
move_2 = Move(Geometry=boundary_2, Motion=Z)  # -> Geometry, Transform; disabled
split = SplitBrep(Brep=g_19, Cutter=move_2.Geometry)  # disabled
geo_16 = Geometry(g_18)  # disabled
boundary_3 = BoundarySurfaces(Edges=geo_15)  # disabled
Z_2 = UnitZ(Factor=1)  # disabled
capex = CapHolesEx(Brep=split)  # -> Brep, Caps, Solid; disabled
move_3 = Move(Geometry=boundary_3, Motion=Z_2)  # -> Geometry, Transform; disabled
python_2 = PythonScript(x=flatten(capex.Brep))  # -> a; inputs x: list; disabled
# ---------- python_2: Python ----------
import rhinoscriptsyntax as rs
import Rhino as rc

L = []
for x_ in x:
    geom = rs.coercegeometry(x_)
    bbBox = geom.GetBoundingBox(rc.Geometry.Plane.WorldXY)
    maxHeights = bbBox.Max.Z
    minHeights = bbBox.Min.Z
    zdist = maxHeights - minHeights
    if zdist >= 2.:
        L.append(geom)
    
a = L
# ---------- end python_2 ----------
geo_17 = Geometry([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])  # disabled
split_2 = SplitBrep(Brep=simplify(flatten(geo_16)), Cutter=move_3.Geometry)  # disabled
capex_2 = CapHolesEx(Brep=split_2)  # -> Brep, Caps, Solid; disabled
Z_3 = UnitZ(Factor=0.25)  # disabled
python_3 = PythonScript(x=flatten(capex_2.Brep))  # -> a; inputs x: list; disabled
# ---------- python_3: Python ----------
import rhinoscriptsyntax as rs
import Rhino as rc

L = []
for x_ in x:
    geom = rs.coercegeometry(x_)
    bbBox = geom.GetBoundingBox(rc.Geometry.Plane.WorldXY)
    maxHeights = bbBox.Max.Z
    minHeights = bbBox.Min.Z
    #zdist = maxHeights - minHeights
    if minHeights >= 2.:
        L.append(geom)
    
a = L
# ---------- end python_3 ----------
move_4 = Move(Geometry=python_3, Motion=Z_3)  # -> Geometry, Transform; disabled
# ARCH2ANALYSIS: ENERGY ARCHETYPE SETUP
honeybee = Honeybee_Honeybee()  # -> Vviiiiiiiiiizzz; plug-in component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
ladybug = Ladybug_Ladybug()  # -> Vviiiiiiiiiizzz; plug-in component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

# ---- group: Commercial
geo_18 = Geometry([python_2, geo_17])  # disabled

# ---- group: Residential
geo_19 = Geometry(move_4.Geometry)  # disabled

# ----
updatehoneybee = Honeybee_UpdateHoneybee(updateThisFile=Toggle(False))  # -> out; plug-in component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
toggle_31 = BooleanToggle(True)  # disabled
toggle_32 = BooleanToggle(True)  # disabled
panel_47 = Panel("@3")  # disabled
capex_3 = CapHolesEx(Brep=geo_19)  # -> Brep, Caps, Solid; disabled
panel_48 = Panel("@3")  # disabled
capex_4 = CapHolesEx(Brep=geo_18)  # -> Brep, Caps, Solid; disabled
panel_49 = Panel(updatehoneybee)
preview_4 = CustomPreview(
    Geometry=[geo_18, geo_19],
    Shader={ambient=RGB(0, 0, 0), diffuse=RGB(255, 105, 180), emission=RGB(76, 32, 54), shine=0.5, specular=RGB(255, 255, 255), transparency=0})  # disabled

# ---- group: shade4res
geo_20 = Geometry(geo_18)  # disabled

# ---- group: shade4com
geo_21 = Geometry(geo_19)  # disabled

# ----
toggle_33 = BooleanToggle(True)  # disabled
toggle_34 = BooleanToggle(True)  # disabled
panel_50 = Panel("hirise_bld")  # disabled
panel_51 = Panel("hirise_bld")  # disabled
number_slider_11 = Slider(3, range=0..10)  # disabled
number_slider_12 = Slider(3, range=0..10)  # disabled
Z_4 = UnitZ(Factor=number_slider_11)  # disabled
Z_5 = UnitZ(Factor=number_slider_12)  # disabled
toggle_35 = BooleanToggle(False)  # disabled
button = Button()  # disabled
panel_52 = Panel("C:\ArchsimResults\MultiZone")  # disabled
panel_53 = Panel("MultiZone2")  # disabled
panel_54 = Panel("C:\ArchsimResults\MultiZone")  # disabled
panel_55 = Panel("MultiZone3")  # disabled
toggle_36 = BooleanToggle(True)  # disabled
toggle_37 = BooleanToggle(True)  # disabled

panel_56 = Panel("C:\\Users\\vasanthakumars\\Documents\\GitHub\\bibil\\src\\reference\\honeybee_work\\Honeybee_SplitZone.py")
panel_57 = Panel("C:\\saeran\\master\\git\\bibil\\src\\reference\\honeybee_work\\Honeybee_SplitZone.py")
panel_58 = Panel("C:\\Users\\vasanthakumars\\Documents\\GitHub\\bibil\\src\\reference\\honeybee_work\\Honeybee_SplitBuildingMass.py")
panel_59 = Panel("C:\\saeran\\master\\git\\bibil\\src\\reference\\honeybee_work\\Honeybee_SplitBuildingMass.py")
list_10 = ValueList({"dir", "file"}, selected="file")
list_11 = ValueList({"dir", "file"}, selected="file")

# ---- group: find directory
bibil_21 = PythonScript(dir=[panel_57, panel_56], type=list_10, run=Toggle(True))  # -> file; inputs dir: list; same code as bibil

bibil_22 = PythonScript(dir=[panel_59, panel_58], type=list_11, run=Toggle(True))  # -> file; inputs dir: list; same code as bibil

# ----
file_15 = ReadFile(File=bibil_22, PerLineParse=False)
file_16 = ReadFile(File=bibil_21, PerLineParse=False)

splitmass = Honeybee_SplitBuildingMass(Code=file_15, _bldgMasses=capex_3.Brep, BldgsFlr2FloorHeights_=panel_47, _runIt=toggle_31)  # -> ReadMe, flatten(SplitBldgMasses); disabled
splitmass_2 = Honeybee_SplitBuildingMass(Code=file_15, _bldgMasses=capex_4.Brep, BldgsFlr2FloorHeights_=panel_48, _runIt=toggle_32)  # -> ReadMe, flatten(SplitBldgMasses); disabled
geo_22 = Geometry(splitmass.SplitBldgMasses)  # disabled
geo_23 = Geometry(splitmass_2.SplitBldgMasses)  # disabled
wires = BrepWireframe(Brep=geo_22, Density=-1)  # disabled
wires_2 = BrepWireframe(Brep=geo_23, Density=-1)  # disabled
preview_5 = CustomPreview(
    Geometry=wires,
    Shader={ambient=RGB(0, 0, 0), diffuse=RGB(255, 105, 180), emission=RGB(76, 32, 54), shine=0.5, specular=RGB(255, 255, 255), transparency=0})  # disabled
bibil_23 = PythonScript(Code=file_6, Node_in=flatten(splitmass.SplitBldgMasses), Label_=panel_50, Run=toggle_33)  # -> Node_out, Debug; disabled
bibil_24 = PythonScript(Code=file_6, Node_in=flatten(splitmass_2.SplitBldgMasses), Label_=panel_51, Run=toggle_34)  # -> Node_out, Debug; disabled
g_20 = PythonScript(node=bibil_23.Node_out)  # -> geom; inputs node: list; disabled
# ---------- g_20: Python ----------
import rhinoscriptsyntax as rs
node = filter(lambda n: n!=None,node)
if node and node != []:
    geom = []
    for n in node:
        geom_ = n.shape.bottom_crv
        print geom_
        geom.append(geom_)
# ---------- end g_20 ----------
g_21 = PythonScript(node=bibil_24.Node_out)  # -> geom; inputs node: list; disabled; same code as g_20
explode = Explode(Curve=g_20, Recursive=True)  # -> Segments, Vertices; disabled
explode_2 = Explode(Curve=g_21, Recursive=True)  # -> Segments, Vertices; disabled
extr = Extrude(Base=explode.Segments, Direction=Z_4)  # disabled
area = Area(Geometry=g_20)  # -> Area, Centroid; disabled
extr_2 = Extrude(Base=explode_2.Segments, Direction=Z_5)  # disabled
wires_3 = BrepWireframe(Brep=extr, Density=-1)  # disabled
edges = BrepEdges(Brep=extr)  # -> Naked, Interior, NonManifold; disabled
wires_4 = BrepWireframe(Brep=extr_2, Density=-1)  # disabled
edges_2 = BrepEdges(Brep=extr_2)  # -> Naked, Interior, NonManifold; disabled
area_2 = Area(Geometry=extr)  # -> Area, Centroid; disabled
python_4 = PythonScript(base=g_20, ptlst=area.Centroid, run=toggle_35)  # -> P, C; inputs zones: tree, zones_crv: list, base: list, ptlst: list; disabled
# ---------- python_4: Python ----------
import rhinoscriptsyntax as rs

P = []
C = []


if run:
    zonecount = 0
    for i in range(zones.BranchCount):
        zonelst = zones.Branch(i)
        offset = rs.OffsetCurve(base[i],ptlst[i],3.)[0]
        for j,zone in enumerate(zonelst):
            zonecrv = zones_crv[int(zonecount)]
            zonecount+=1
            IsCore = rs.PointInPlanarClosedCurve(ptlst[i],zonecrv)
            if IsCore:
                C.append(zone)
            else:
                P.append(zone)
        print '---'
        #L.append(offset)
# ---------- end python_4 ----------
area_3 = Area(Geometry=extr_2)  # -> Area, Centroid; disabled
python_5 = PythonScript(x=edges_2.Naked, pt=flatten(area_3.Centroid))  # -> flatten(a); inputs x: tree, pt: list; disabled
# ---------- python_5: Python ----------
import rhinoscriptsyntax as rs
L = []

for i in range(x.BranchCount):
    edgelst = x.Branch(i)
    edge = rs.JoinCurves(edgelst,delete_input=True)
    edge = rs.coercecurve(edge)
    offset = rs.OffsetCurve(edge,pt[i],1.)[0]
    offset = rs.AddPlanarSrf(offset)[0]
    L.append(offset)
    
a = L
# ---------- end python_5 ----------
python_6 = PythonScript(x=edges.Naked, pt=flatten(area_2.Centroid))  # -> a; inputs x: tree, pt: list; disabled; same code as python_5
geo_24 = Geometry(python_4.P)  # disabled
geo_25 = Geometry(python_4.C)  # disabled

# ---- group: OFFICE
panel_60 = Panel("Perimeter")  # disabled
zone = ThermalZone(
    ThermalZoneGeometry=splitmass_2.SplitBldgMasses,
    Name=panel_60,
    SettingsAsFormatedString="-NoSelection-",
    Library="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",
    Settings="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")  # -> ThermalZones, SettingsAsFormatedString; disabled
window = Window(
    WindowGeometry=python_5,
    Library="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",
    Settings="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")  # -> Window, SettingsAsFormatedString; disabled

# ----
# ENERGY SIMULATION
zone_2 = ThermalZone(
    ThermalZoneGeometry=splitmass.SplitBldgMasses,
    SettingsAsFormatedString="-NoSelection-",
    Library="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",
    Settings="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")  # -> ThermalZones, SettingsAsFormatedString; disabled
window_2 = Window(
    WindowGeometry=python_6,
    Library="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",
    Settings="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")  # -> Window, SettingsAsFormatedString; disabled

networker = ZoneConnectivityNetwork(ThermalZoneCollection=zone.ThermalZones, Windows=window.Window, ShadingGeometryCollection=geo_21)  # disabled
surfaceanalysis = SurfaceAnalysis(ThermalModel=networker)  # -> Facade, Partition, Ceiling, Roof, ExternalFloor, Floor, Window, FaceID, IDLocation; disabled
networker_2 = ZoneConnectivityNetwork(ThermalZoneCollection=zone_2.ThermalZones, Windows=window_2.Window, ShadingGeometryCollection=geo_20)  # disabled
surfaceanalysis_2 = SurfaceAnalysis(ThermalModel=networker_2)  # -> Facade, Partition, Ceiling, Roof, ExternalFloor, Floor, Window, FaceID, IDLocation; disabled
brep = Brep([surfaceanalysis.Window, surfaceanalysis.Facade, surfaceanalysis.Floor, surfaceanalysis.ExternalFloor])  # disabled
brep_2 = Brep([surfaceanalysis_2.Window, surfaceanalysis_2.Facade, surfaceanalysis_2.Floor, surfaceanalysis_2.ExternalFloor])  # disabled
run_e = TakesThermalModelAndRunsEnergyPlus(
    ThermalModel=networker_2,
    ProjectName=panel_53,
    WorkingDirectory=panel_52,
    WeatherFile="USA_NY_New.York-LaGuardia.AP.725030_TMY3",
    StartsTheSimulation=button,
    settings="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")  # -> ThermalModel, SettingsAsFormatedString; disabled
run_e_2 = TakesThermalModelAndRunsEnergyPlus(
    ThermalModel=networker,
    ProjectName=panel_55,
    WorkingDirectory=panel_54,
    WeatherFile="USA_NY_New.York-LaGuardia.AP.725030_TMY3",
    StartsTheSimulation=button,
    settings="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")  # -> ThermalModel, SettingsAsFormatedString; disabled
load_zone_results = LoadZoneResults(ThermalModel=run_e.ThermalModel, Toggle=toggle_37, settings="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")  # -> flatten(ZoneGeometry), ResultsPerZone, Labels, Guid, Name; disabled
load_zone_results_2 = LoadZoneResults(ThermalModel=run_e_2.ThermalModel, Toggle=toggle_36, settings="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")  # -> flatten(ZoneGeometry), ResultsPerZone, Labels, Guid, Name; disabled
panel_61 = Panel(load_zone_results.ResultsPerZone)  # disabled
ma = MassAddition(Input=load_zone_results_2.ResultsPerZone)  # -> flatten(Result), PartialResults; disabled
ma_2 = MassAddition(Input=load_zone_results.ResultsPerZone)  # -> flatten(Result), PartialResults; disabled
bnd = Bounds(Numbers=ma_2.Result)  # disabled
dedomain = DeconstructDomain(Domain=bnd)  # -> Start, End; disabled
bnd_2 = Bounds(Numbers=ma.Result)  # disabled
dedomain_2 = DeconstructDomain(Domain=bnd_2)  # -> Start, End; disabled
panel_62 = Panel(load_zone_results.ZoneGeometry)  # disabled
panel_63 = Panel(ma_2.Result)  # disabled
gradient = Gradient(
    LowerLimit=dedomain.End,
    UpperLimit=dedomain.Start,
    Parameter=ma_2.Result,
    stops=[0: RGB(234, 38, 0), 0.25: RGB(234, 126, 0), 0.5: RGB(254, 244, 84), 0.75: RGB(173, 203, 249), 1: RGB(75, 107, 169)])  # disabled
gradient_2 = Gradient(
    LowerLimit=dedomain_2.End,
    UpperLimit=dedomain_2.Start,
    Parameter=ma.Result,
    stops=[0: RGB(234, 38, 0), 0.25: RGB(234, 126, 0), 0.5: RGB(254, 244, 84), 0.75: RGB(173, 203, 249), 1: RGB(75, 107, 169)])  # disabled
sort = SortList(Keys=ma.Result)  # -> Keys, ValuesA; disabled
sort_2 = SortList(Keys=ma_2.Result)  # -> Keys, ValuesA; disabled
preview_6 = CustomPreview(Geometry=load_zone_results.ZoneGeometry, Shader=gradient)  # disabled
preview_7 = CustomPreview(Geometry=load_zone_results_2.ZoneGeometry, Shader=gradient_2)  # disabled
panel_64 = Panel(sort_2.Keys)  # disabled
panel_65 = Panel(sort.Keys)  # disabled
