# Grasshopper definition bibil_trial_099_Davisville_Station_planefromrearlot.gh (Grasshopper 0.9.76)
# plug-ins: Python Interpreter, Human, LunchBox, Archsim

list = ValueList({"dir", "file"}, selected="dir")

# ---- group: find directory
bibil = PythonScript(
    dir=["C:\\Users\\vasanthakumars\\Documents\\GitHub\\bibil\\src", "C:\\saeran\\master\\git\\bibil\\src"],
    type=list,
    run=Toggle(True))  # -> dir; inputs dir: list
# ---------- bibil: Python ----------
import os

ghenv.Component.Params.Output[0].Name = "null"
ghenv.Component.Params.Output[0].NickName = "null"

if run:
    confirm_dir = None
    for d in dir:
        try:
            if type == "file":
                file_ = open(d)
                file_.close()
            else:
                print os.listdir(d)
            confirm_dir = d
            break
        except Exception as e:
            #print str(e)
            continue
    if confirm_dir != None:
        ghenv.Component.Params.Output[0].Name = type
        ghenv.Component.Params.Output[0].NickName = type
        dir = confirm_dir
        file = confirm_dir
null = None
# ---------- end bibil ----------

# ---- group: tree
python_script = PythonScript(i=bibil)  # -> o
# ---------- python_script: Python ----------
import os

if i:
    o = os.path.join(str(i),"bibil\\bibil_tree.py")
# ---------- end python_script ----------
file = ReadFile(File=python_script, PerLineParse=False)
bibil_2 = PythonScript(Code=file)

# ---- group: grammar
python_script_2 = PythonScript(i=bibil)  # -> o
# ---------- python_script_2: Python ----------
import os

if i:
    o = os.path.join(str(i),"bibil\\bibil_grammar.py")
# ---------- end python_script_2 ----------
file_2 = ReadFile(File=python_script_2, PerLineParse=False)
bibil_3 = PythonScript(Code=file_2)

# ---- group: shape
python_script_3 = PythonScript(i=bibil)  # -> o
# ---------- python_script_3: Python ----------
import os

if i:
    o = os.path.join(str(i),"bibil\\bibil_shape.py")
#o = os.path.join(str(i),"research\\bibil_shape_shape_3d_2d.py")
# ---------- end python_script_3 ----------
file_3 = ReadFile(File=python_script_3, PerLineParse=False)
bibil_4 = PythonScript(Code=file_3)

# ---- group: bula
python_script_4 = PythonScript(i=bibil)  # -> o
# ---------- python_script_4: Python ----------
import os

if i:
    o = os.path.join(str(i),"bula\\bula_minimal.py")
# ---------- end python_script_4 ----------
file_4 = ReadFile(File=python_script_4, PerLineParse=False)
bibil_5 = PythonScript(Code=file_4)

# ---- group: UI
python_script_5 = PythonScript(i=bibil)  # -> o
# ---------- python_script_5: Python ----------
import os

if i:
    o = os.path.join(str(i),"bibil\\bibil_UI.py")
# ---------- end python_script_5 ----------
file_5 = ReadFile(File=python_script_5, PerLineParse=False)

# ---- group: grammar_divide
python_script_6 = PythonScript(i=bibil)  # -> o
# ---------- python_script_6: Python ----------
import os

if i:
    o = os.path.join(str(i),"miru\\miru_divide.py")
# ---------- end python_script_6 ----------
file_6 = ReadFile(File=python_script_6, PerLineParse=False)

# ---- group: grammar_courtyard
python_script_7 = PythonScript(i=bibil)  # -> o
# ---------- python_script_7: Python ----------
import os

if i:
    o = os.path.join(str(i),"miru\\miru_court.py")
# ---------- end python_script_7 ----------
file_7 = ReadFile(File=python_script_7, PerLineParse=False)

# ---- group: grammar_tower
python_script_8 = PythonScript(i=bibil)  # -> o
# ---------- python_script_8: Python ----------
import os

if i:
    o = os.path.join(str(i),"miru\\miru_packing.py")
# ---------- end python_script_8 ----------
file_8 = ReadFile(File=python_script_8, PerLineParse=False)

python_script_9 = PythonScript(i=bibil)  # -> o
# ---------- python_script_9: Python ----------
import os

if i:
    o = os.path.join(str(i),"miru\\miru_stepback.py")
# ---------- end python_script_9 ----------
file_9 = ReadFile(File=python_script_9, PerLineParse=False)

# ---- group: grammar_height
python_script_10 = PythonScript(i=bibil)  # -> o
# ---------- python_script_10: Python ----------
import os

if i:
    o = os.path.join(str(i),"miru\\miru_height.py")
# ---------- end python_script_10 ----------
file_10 = ReadFile(File=python_script_10, PerLineParse=False)

# ---- group: grammar_analysis_pts
python_script_11 = PythonScript(i=bibil)  # -> o
# ---------- python_script_11: Python ----------
import os

if i:
    o = os.path.join(str(i),"miru\\miru_analysis.py")
# ---------- end python_script_11 ----------
file_11 = ReadFile(File=python_script_11, PerLineParse=False)

# ---- group: meta_tree
python_script_12 = PythonScript(i=bibil)  # -> o
# ---------- python_script_12: Python ----------
import os

if i:
    o = os.path.join(str(i),"miru\\miru_meta_tree.py")
# ---------- end python_script_12 ----------
file_12 = ReadFile(File=python_script_12, PerLineParse=False)

# ---- group: land_use
python_script_13 = PythonScript(i=bibil)  # -> o
# ---------- python_script_13: Python ----------
import os

if i:
    o = os.path.join(str(i),"miru\\miru_landuse.py")
# ---------- end python_script_13 ----------
file_13 = ReadFile(File=python_script_13, PerLineParse=False)

# ---- group: shape2height
python_script_14 = PythonScript(i=bibil)  # -> o
# ---------- python_script_14: Python ----------
import os

if i:
    o = os.path.join(str(i),"miru\\miru_shape2height.py")
# ---------- end python_script_14 ----------
file_14 = ReadFile(File=python_script_14, PerLineParse=False)

# ---- group: extract_slice
python_script_15 = PythonScript(i=bibil)  # -> o
# ---------- python_script_15: Python ----------
import os

if i:
    o = os.path.join(str(i),"miru\\miru_extract_slice.py")
# ---------- end python_script_15 ----------
file_15 = ReadFile(File=python_script_15, PerLineParse=False)

# ----
list_2 = ValueList({"divide by depth": "subdivide_depth", "divide by same depth": "subdivide_depth_same", "divide by dim": "subdivide_dim"}, selected="divide by same depth")

# ---- group: GEOREF
# Note: Change this number with caution,
vec = Vector(Vector(-545901.6391, 3981870.516, 0))  # disabled

# ---- group: CPT
# Increase bounds iterratively.
vec_2 = Vector(Vector(0, 3981920.861, 0))  # disabled

# ----
list_3 = ValueList({"YZ": "NS", "XZ": "EW", "XY": "Z"}, selected="XZ")

# ---- group: A=pt2move2
subtraction = Subtraction(A=vec, B=vec_2)  # disabled

# ---- group: PACKING
separatedata = Ladybug_SeparateData(Code=file_8, X_keep_omit="27.0,25.0", Y_keep_omit="27.0,25.0", Seperation_ref="-1", Run=Toggle(True))

# ---- group: HEIGHT
miru = PythonScript(Code=file_10, Height=Slider(16.5, range=0..100), Run=Toggle(True))

# ---- group: EXTRACT_SLICE
miru_2 = PythonScript(Code=file_15, Run=Toggle(False))

# ---- group: DIVIDE
miru_3 = PythonScript(
    Code=file_6,
    Divide_num=Slider(2, range=0..10),
    Divide_cut=Slider(0, range=0..100),
    Divide_type=list_2,
    Divide_ratio=Slider(0.5, range=0..1),
    Axis=list_3,
    Run=Toggle(False))

# ---- group: PERIMETER
miru_4 = PythonScript(Code=file_7, Width=Slider(20, range=0..100), Cut_width=Slider(0, range=0..100), Court_ref="0", Run=Toggle(False))

# ---- group: TREE RULES
miru_5 = PythonScript(Code=file_12, Run=Toggle(False))

# ---- group: SHAPE2HEIGHT
miru_6 = PythonScript(Code=file_14, Run=Toggle(False))

# ----
geo = Geometry([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])  # disabled
move = Move(Geometry=geo, Motion=subtraction)  # -> Geometry, Transform; disabled
geo_2 = Geometry(move.Geometry)  # disabled
number_slider = Slider(13.5, range=0..100)
geo_3 = Geometry(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)
panel = Panel("""0.0:7.5
10.5:10.5
13.5:13.5
16.5:16.5
19.5:19.5""")
geo_4 = Geometry([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])
# WEST
number_slider_2 = Slider(25.5, range=0..100)
panel_2 = Panel("""7.5:3.0
22.5:6.0
25.5:9.0
28.5:12.0""")
panel_3 = Panel("""0.0:7.5
7.5:10.5
10.5:13.5
13.5:16.5
16.5:19.5
19.5:22.5
22.5:25.5""")
# EAST
geo_5 = Geometry([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])
number_slider_3 = Slider(25.5, range=0..100)
panel_4 = Panel("""7.5:3.0
22.5:6.0
25.5:9.0
28.5:12.0""")
panel_5 = Panel("""0.0:7.5
7.5:10.5
10.5:13.5
13.5:16.5
16.5:19.5
19.5:22.5
22.5:25.5""")
# WEST
toggle = BooleanToggle(True)
geo_6 = Geometry(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)

# ---- group: FRONT SETBACK
miru_7 = PythonScript(Code=file_9, Height_stepback=panel_2, Stepback_ref=geo_5, Run=Toggle(True))

# ---- group: REAR SETBACK
miru_8 = PythonScript(Code=file_9, Height_stepback=panel_3, Stepback_ref=geo_3, Run=toggle)

# ---- group: FRONT SETBACK
miru_9 = PythonScript(Code=file_9, Height_stepback="7.5:3.0", Stepback_ref=geo_5, Run=Toggle(True))

# ---- group: REAR SETBACK
miru_10 = PythonScript(Code=file_9, Height_stepback=panel, Stepback_ref=geo_4, Run=Toggle(True))

# ---- group: HEIGHT
miru_11 = PythonScript(Code=file_10, Height=number_slider, Run=Toggle(True))

# ---- group: FRONT SETBACK
miru_12 = PythonScript(Code=file_9, Height_stepback=panel_4, Stepback_ref=geo_5, Run=Toggle(True))

# ---- group: REAR SETBACK
miru_13 = PythonScript(Code=file_9, Height_stepback=panel_5, Stepback_ref=geo_4, Run=Toggle(True))

# ---- group: HEIGHT
miru_14 = PythonScript(Code=file_10, Height=number_slider, Run=Toggle(True))

miru_15 = PythonScript(Code=file_10, Height=Slider(25.5, range=0..100), Run=Toggle(True))

# ----
number_slider_4 = Slider(-45, range=-45..100)
geo_7 = Geometry(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)
geo_8 = Geometry(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)
geo_9 = Geometry(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)
geo_10 = Geometry(geo_6)
Z = UnitZ(Factor=Slider(40, range=0..100))
Z_2 = UnitZ(Factor=Slider(40, range=0..100))
Z_3 = UnitZ(Factor=Slider(80, range=0..100))
geo_11 = Geometry(geo_5)
geo_12 = Geometry(geo_4)
rad = Radians(Degrees=number_slider_4)
extr = Extrude(Base=geo_11, Direction=Z_2)
rad_2 = Radians(Degrees=Slider(-45, range=-45..100))
rad_3 = Radians(Degrees=number_slider_4)
extr_2 = Extrude(Base=geo_10, Direction=Z)
previewlw = CustomPreviewLineweights(Geometry=geo_4, Shader=ColourSwatch(SwatchColor=RGB(255, 0, 255)), Thickness=Slider(5, range=0..10), Absolute=False)
extr_3 = Extrude(Base=geo_12, Direction=Z_3)
rotax = RotateAxis(Geometry=extr_2, Angle=rad, Axis=geo_10)  # -> Geometry, Transform
rotax_2 = RotateAxis(Geometry=extr, Angle=rad_2, Axis=geo_11)  # -> Geometry, Transform
rotax_3 = RotateAxis(Geometry=extr_3, Angle=rad_3, Axis=geo_12)  # -> Geometry, Transform
Z_4 = UnitZ(Factor=Slider(0, range=0..100))

# ---- group: SHAPENODE
# volume of west office:
# 124911 m3
bibil_6 = PythonScript(Code=file_5, Rule_in=flatten([miru_11, miru_7, miru_8]), Node_in=flatten(geo_7), Run=Toggle(True))  # -> Node_out, Debug

# ----
Z_5 = UnitZ(Factor=Slider(19.5, range=0..100))
Z_6 = UnitZ(Factor=Slider(10.5, range=0..100))

# ---- group: SHAPENODE
# volume of east office:
# 7068 m3
bibil_7 = PythonScript(Code=file_5, Rule_in=flatten([miru_14, miru_9, miru_10]), Node_in=flatten(geo_8), Run=Toggle(True))  # -> Node_out, Debug

# volume of west office:
# 124911 m3
bibil_8 = PythonScript(Code=file_5, Rule_in=flatten([miru_15, miru_12, miru_13]), Node_in=flatten(geo_9), Run=Toggle(True))  # -> Node_out, Debug

# ----
number_slider_5 = Slider(82, range=0..100)
geo_13 = Geometry([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])
move_2 = Move(Geometry=rotax.Geometry, Motion=Z_4)  # -> Geometry, Transform
move_3 = Move(Geometry=rotax_3.Geometry, Motion=Z_6)  # -> Geometry, Transform
move_4 = Move(Geometry=rotax_2.Geometry, Motion=Z_5)  # -> Geometry, Transform
g = PythonScript(node=bibil_6.Node_out)  # -> geom; inputs node: list
# ---------- g: Python ----------
node = filter(lambda n: n!=None,node)
if node and node != []:
    geom = []
    for n in node:
        if n.shape.z_dist < 1.2:
            geom.append(n.shape.bottom_crv)
        else:
            geom.append(n.shape.geom)
    print geom
# ---------- end g ----------
offset = Offset(Curve=geo_13, Distance=Slider(25, range=0..100), Plane=PlaneXY(0, 0, 0), Corners=Slider(3, range=0..10))
g_2 = PythonScript(node=bibil_7.Node_out)  # -> geom; inputs node: list; same code as g
g_3 = PythonScript(node=bibil_8.Node_out)  # -> geom; inputs node: list; same code as g

# ---- group: HEIGHT
miru_16 = PythonScript(Code=file_10, Height=Slider(61.5, range=0..100), Run=Toggle(True))

# ----
bibil_9 = PythonScript(Code=file_5, Rule_in=flatten(miru_16), Node_in=flatten(geo_13), Run=Toggle(True))  # -> Node_out, Debug
path = FilePath("C:\Users\vasanthakumars\Documents\GitHub\bibil\src\reference\CAN_ON_Toronto.716240_CWEC\CAN_ON_Toronto.716240_CWEC.epw")
g_4 = PythonScript(node=bibil_9.Node_out)  # -> geom; inputs node: list; same code as g
sdiff = SolidDifference(BrepsA=g_4, BrepsB=g_3)
geo_14 = Geometry([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])
geo_15 = Geometry([g_2, sdiff, g_3, g])
importepw = Ladybug_ImportEpw(epwFile=path)  # -> readMe, latitude, location, dryBulbTemperature, dewPointTemperature, relativeHumidity, windSpeed, windDirection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; plug-in component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
ladybug = Ladybug_Ladybug()  # -> Vviiiiiiiiiizzz; plug-in component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
wires = BrepWireframe(Brep=geo_14, Density=-1)
floor_cutter = FloorCutter(BuildingVolume=geo_14, FloorHeights=Slider(7.3, range=0..10))
wires_2 = BrepWireframe(Brep=geo_15, Density=-1)
number_slider_6 = Slider(9, range=0..10)
number_slider_7 = Slider(21, range=0..100)
material = CreateMaterial(
    Diffuse=ColourSwatch(SwatchColor=RGB(0, 255, 255)),
    Specular=RGB(255, 255, 255),
    Emission=RGB(0, 0, 0),
    Transparency=Slider(0.5, range=0..1),
    Shine=0)
mesh = Mesh()

# ---- group: SHAPENODE
bibil_10 = PythonScript(node_in=flatten(floor_cutter), label="buildings4analysis", run=Toggle(False))  # -> node_out, debug; inputs rule_in: tree, node_in: list, label: list, run: Boolean
# ---------- bibil_10: Python ----------
"""
Trinco UI
"""

import scriptcontext as sc
import clr

Grammar = sc.sticky["Grammar"]
clr.AddReference("Grasshopper")
from Grasshopper.Kernel.Data import GH_Path
from Grasshopper import DataTree

if run and node_in != []:
    node_in = filter(lambda n: n!=None,node_in)
    if rule_in.BranchCount < 0.5:
        rule_in = DataTree[object]()
        rule_ = []
        for i, r in enumerate(rule_):
            rule_in.Add(r)
        
    G = Grammar()
    sc.sticky["debug"] = []
    debug = sc.sticky["debug"]
    node_out = G.main_UI(node_in,rule_in,label_)
else:
    print 'Add inputs!'
# ---------- end bibil_10 ----------

# ----
preview = CustomPreview(Geometry=mesh, Shader=material)
geo_16 = Geometry(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)
analysisperiod = Ladybug_AnalysisPeriod(
    fromMonth=number_slider_6,
    fromDay=number_slider_7,
    fromHour=Slider(8.25, range=0..100),
    toMonth=number_slider_6,
    toDay=number_slider_7,
    toHour=Slider(12.25, range=0..100))  # -> readMe, analysisPeriod; plug-in component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
g_5 = PythonScript(node=bibil_10.node_out)  # -> floor_geom, gfa_out, ht_out, pt_out, gfa_ht; inputs node: list
# ---------- g_5: Python ----------
import rhinoscriptsyntax as rs
import Rhino as rc
import random
import scriptcontext as sc
import copy
import math
import ghpythonlib.components as ghcomp

"""import classes"""

Shape = sc.sticky["Shape"]
Grammar = sc.sticky["Grammar"]
Tree = sc.sticky["Tree"]

sc.sticky['debug'] = []
debug = sc.sticky["debug"]

floor_geom = []
ht_out = []
gfa_out = []
pt_out = []
gfa_ht = []

node = filter(lambda n: n!=None,node)
if node and node != []:
    for n in node:
        cpt = n.shape.cpt
        ht = n.shape.ht
        area = 0.
        g,t = int(cpt[2]), int(ht)
        for i in range(g+3,t,3):
            floorht = i+1.4
            refcpt = copy.copy(cpt)
            refcpt.Z = floorht
            contour = n.shape.get_bottom(n.shape.geom,refcpt)
            area += rs.Area(sc.doc.Objects.AddCurve(contour))
            floor_geom.append(contour)
        gfa_out.append(area)
        pt_out.append(cpt)
        ht_out.append(ht)
        gfa_ht.append("GFA: "+str(round(area,2)) + "   HT: " + str(round(ht,2)))
# ---------- end g_5 ----------
solarfanbasic = Ladybug_SolarFanBasic(
    boundary=geo_16,
    location=importepw.location,
    requiredHours=Slider(1, range=0..10),
    height=Slider(175, range=0..1000),
    analysisPeriod=analysisperiod.analysisPeriod)  # -> readMe, solarFan; plug-in component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
solarfan = Ladybug_SolarFan()  # -> readMe, solarFan; plug-in component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
python = PythonScript(ht=g_5.ht_out)  # -> z
# ---------- python: Python ----------
z = 2*ht
# ---------- end python ----------
devec = DeconstructVector(Vector=g_5.pt_out)  # -> XComponent, YComponent, ZComponent
swatch = ColourSwatch(SwatchColor=RGB(4, 0, 255))
vec_3 = VectorXYZ(XComponent=devec.XComponent, YComponent=devec.YComponent, ZComponent=python)  # -> Vector, Length
geo_17 = Geometry(solarfanbasic.solarFan)
material_2 = CreateMaterial(
    Diffuse=RGB(255, 105, 180),
    Specular=RGB(255, 255, 255),
    Emission=RGB(0, 0, 0),
    Transparency=Slider(0.5, range=0..1),
    Shine=0)
boundary = BoundarySurfaces(Edges=g_5.floor_geom)
wires_3 = BrepWireframe(Brep=geo_17, Density=-1)
ln = Line(StartPoint=vec_3.Vector, EndPoint=g_5.pt_out)
tag = TextTag3D(Location=vec_3.Vector, Text=g_5.gfa_ht, Size=Slider(3, range=0..10), Colour=swatch, Justification=8)
preview_2 = CustomPreview(Geometry=ln, Shader=swatch)
material_3 = CreateMaterial(
    Diffuse=ColourSwatch(SwatchColor=RGB(0, 255, 107)),
    Specular=RGB(255, 255, 255),
    Emission=RGB(0, 0, 0),
    Transparency=Slider(0.91, range=0..1),
    Shine=0)
preview_3 = CustomPreview(Geometry=boundary, Shader=material_2)
preview_4 = CustomPreview(Geometry=solarfanbasic.solarFan, Shader=material_3)
toggle_2 = BooleanToggle(True)
excelwrite = ExcelWriteLEGACY(
    WriteToggle=toggle_2,
    WriteHeading=toggle_2,
    ClearSheet=Toggle(True),
    Worksheet=Slider(1, range=0..10),
    ColumnStart=1,
    RowStart=1,
    ColumnHeadings=["ID", "GFA", "HEIGHT"],
    Column2=g_5.gfa_out,
    Column3=g_5.ht_out)
